# Grasshopper definition 03_build_robot_cell.ghx (Grasshopper 1.0.8)

mesh = Mesh(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)
plane = Plane(PlaneXY(0, 0, 0.2407661676))
compas_fab_tool_from_mesh = COMPASFABToolFromMesh(name="gripper", visual_mesh=mesh, collision_mesh=mesh, tcp_plane=plane)  # -> tool_model; inputs name: String
#   port name: Tool identifier (used as the tool id when added to a cell). Defaults to `attached_tool`.
#   port visual_mesh: Rhino mesh for visualization (and collision checking if no separate collision mesh is provided).
#   port collision_mesh: Optional Rhino mesh used only for collision checking. Defaults to `visual_mesh`.
#   port tcp_plane: Tool Coordinate Frame, as a Rhino Plane or COMPAS Frame, expressed in the coordinates the mesh was modelled in.
#   port base_plane: Optional plane, in the coordinates the mesh was modelled in, at which the robot's flange takes hold of the tool. Its Z axis points away from the robot: a tool drawn reaching along world Z needs none. For a tool drawn reaching along world X, wire the plane with Z = world X. Defaults to the world XY plane, i.e. the modelling coordinates are the tool's base frame.
# ---------- compas_fab_tool_from_mesh: Python ----------
# r: compas_fab>=2.0.1
"""
Construct a ToolModel from a Rhino mesh and a TCP plane.

`tcp_plane` may be a Rhino Plane or a compas Frame; it is the Tool
Coordinate Frame, expressed in the same coordinates you modelled the mesh
in. If `collision_mesh` is unwired, `visual_mesh` is reused for collision
checks.

`base_plane` is where the robot's flange takes hold of the geometry, also
in the coordinates you modelled in. Its Z axis points away from the robot,
matching the planning groups of the robots in the library, so a tool drawn
reaching along world Z needs no `base_plane` at all. Wire one when the tool
was drawn along another axis: for a tool reaching along world X, that is
the plane with Z = world X. Nothing is baked into the mesh, so the plane
can be re-wired at any time.

A remark is surfaced when the TCP does not sit roughly on the tool's +Z,
since that means the tool will point sideways once attached.

The result is a static (no joints) `ToolModel` ready to feed into a
`Load Robot Cell` component's `tools` input. Kinematic tools (with their
own joints) should be loaded from URDF instead.

COMPAS FAB v2.0.1 (built 2026-08-03 15:30 UTC)
"""

from math import degrees

import Grasshopper
import Rhino
import rhinoscriptsyntax as rs
import System
from compas.geometry import Frame
from compas.geometry import Vector
from compas_ghpython import remark
from compas_ghpython import warning as gh_warning
from compas_rhino.conversions import mesh_to_compas
from compas_rhino.conversions import plane_to_compas_frame
from compas_robots import ToolModel

# Beyond this angle between the tool's +Z and its TCP, the tool is considered
# to be pointing somewhere other than away from the flange.
MAX_TCP_OFF_AXIS_ANGLE = 30.0


def _off_axis_remark(tool):
    """Text for the mounting-axis remark, or None when the tool looks fine.

    The TCP direction is only a hint: it says nothing about the roll of the tool
    and is meaningless for a TCP sitting on the mount itself, so it is reported
    rather than applied.
    """
    tcp_direction = Vector(*tool.frame.point)
    if tcp_direction.length < 1e-6:
        return None

    angle = degrees(tcp_direction.angle(Vector.Zaxis()))
    if angle < MAX_TCP_OFF_AXIS_ANGLE:
        return None

    message = ("TCP sits {:.0f} deg off the tool's +Z axis, so this tool will point sideways once attached: tools mount with +Z pointing away from the flange. ").format(angle)

    unitized = tcp_direction.unitized()
    if abs(unitized.x) > 0.99:
        message += "Your tool reaches along X, so set `base_plane` to a plane with its Z axis along world X (origin, x=(0,1,0), y=(0,0,1))."
    elif abs(unitized.y) > 0.99:
        message += "Your tool reaches along Y, so set `base_plane` to a plane with its Z axis along world Y (origin, x=(0,0,1), y=(1,0,0))."
    else:
        message += "Set `base_plane` to a plane whose Z axis runs along your tool, with its X axis picked to give the roll you want."
    return message


class ToolFromMesh(Grasshopper.Kernel.GH_ScriptInstance):
    def RunScript(self,
            name: str,
            visual_mesh,
            collision_mesh,
            tcp_plane,
            base_plane):
        if visual_mesh is None or tcp_plane is None:
            return None

        frame = tcp_plane if isinstance(tcp_plane, Frame) else plane_to_compas_frame(tcp_plane)
        base_frame = None
        if base_plane is not None:
            base_frame = base_plane if isinstance(base_plane, Frame) else plane_to_compas_frame(base_plane)
        c_visual = mesh_to_compas(rs.coercemesh(visual_mesh)) if visual_mesh else None
        c_collision = mesh_to_compas(rs.coercemesh(collision_mesh)) if collision_mesh else None

        if collision_mesh is None:
            gh_warning(ghenv.Component, "No collision mesh provided: the tool will be visualized but ignored for collision checking.")  # noqa: F821

        # `base_frame` is only passed when wired, so an older compas_robots keeps
        # working for definitions that don't use it.
        kwargs = {"base_frame": base_frame} if base_frame else {}
        tool = ToolModel(
            visual=c_visual,
            frame_in_tool0_frame=frame,
            collision=c_collision,
            name=(name or "attached_tool").strip(),
            **kwargs,
        )

        message = _off_axis_remark(tool)
        if message:
            remark(ghenv.Component, message)  # noqa: F821

        return tool
# ---------- end compas_fab_tool_from_mesh ----------
compas_fab_rigid_body_from_library = COMPASFABRigidBodyFromLibrary(name="floor", size=Slider(2.64, range=1..5))  # -> rigid_body, meshes; inputs name: String, rigid_body_id: String, size: Double
#   port name: Name of the RigidBodyLibrary classmethod to call (e.g. 'target_marker').
#   port rigid_body_id: Optional id for the body. Used as its key when wired into a Load Robot Cell component's `rigid_bodies` input. Defaults to the library entry name.
#   port size: Scaling parameter passed to the library factory. Defaults to 1.0.
#   port meshes: The body's visual meshes as Rhino geometry, drawn in the body's own base frame. For preview only.
# ---------- compas_fab_rigid_body_from_library: Python ----------
# r: compas_fab>=2
"""
Load a pre-defined RigidBody from RigidBodyLibrary.

Currently exposes `target_marker(size=1.0)`, useful as a visualization
aid for IK/planning targets in the scene.

The body's `.name` defaults to the library entry name (e.g. 'target_marker');
override it with `rigid_body_id` to control the key it is registered under when
wired into a Load Robot Cell component.

Also returns the body's visual meshes as Rhino geometry for preview, drawn in
the body's own base frame (not yet placed in any cell).

COMPAS FAB v2.0.0
"""

import Grasshopper
import Rhino
import System
from compas.scene import SceneObject
from compas_ghpython import error

from compas_fab.ghpython.scene import RigidBodyObject
from compas_fab.robots import RigidBodyLibrary


class RigidBodyFromLibrary(Grasshopper.Kernel.GH_ScriptInstance):
    def RunScript(self, name: str, rigid_body_id: str, size: float):
        if not name:
            return (None, None)

        name = name.strip().lower()
        loader = getattr(RigidBodyLibrary, name, None)
        if loader is None:
            available = [attr for attr in dir(RigidBodyLibrary) if not attr.startswith("_") and callable(getattr(RigidBodyLibrary, attr))]
            error(ghenv.Component, "Unknown RigidBodyLibrary entry '{}'. Available: {}".format(name, ", ".join(available)))  # noqa: F821
            return (None, None)

        size = size if size else 1.0
        rigid_body = loader(size)
        rigid_body.name = rigid_body_id.strip() if rigid_body_id else name

        scene_object = SceneObject(
            item=rigid_body,
            sceneobject_type=RigidBodyObject,
            draw_visual=True,
            draw_collision=False,
        )
        meshes = scene_object.draw()

        return (rigid_body, meshes)
# ---------- end compas_fab_rigid_body_from_library ----------

name = ValueList({"abb_irb120_3_58", "abb_irb4600_40_255", "abb_irb4600_40_255_gripper_one_beam", "abb_irb4600_40_255_printing_tool", "panda", "rfl", "ur10e", "ur10e_gripper_one_beam", "ur5", "ur5_cone_tool", "ur5_gripper_one_beam"}, selected="abb_irb4600_40_255")
load_geometry = BooleanToggle(True)
compas_fab_load_robot_cell_from_library = COMPASFABLoadRobotCellFromLibrary(
    name=name,
    load_geometry=load_geometry,
    tools=compas_fab_tool_from_mesh,
    rigid_bodies=compas_fab_rigid_body_from_library.rigid_body)  # -> robot_cell, robot_cell_state; inputs name: String, reload: Boolean, tools: list, rigid_bodies: list
#   port name: Name of the RobotCellLibrary classmethod to call. A dropdown is auto-created on first use with every available cell (e.g. 'ur5', 'ur10e', 'abb_irb4600_40_255', 'panda', 'rfl', 'ur5_cone_tool', 'abb_irb4600_40_255_printing_tool').
#   port load_geometry: Whether to load the robot's mesh geometry. Required for visualization. Defaults to True when unwired. A Boolean Toggle is auto-created on this input when nothing is wired.
#   port reload: Force a reload (bypass cache). Defaults to False.
#   port tools: Optional list of ToolModels to register into the cell. Each is keyed by its `.name`.
#   port rigid_bodies: Optional list of RigidBodies to register into the cell. Each is keyed by its `.name` (set it on the Rigid Body From… component).
#   port robot_cell: The loaded RobotCell.
#   port robot_cell_state: The default RobotCellState matching the cell.
# ---------- compas_fab_load_robot_cell_from_library: Python ----------
# r: compas_fab>=2
"""
Load a pre-defined RobotCell (and matching default RobotCellState) from RobotCellLibrary.

Tools and rigid bodies can be wired directly into `tools` / `rigid_bodies` so the
returned cell already contains them - no separate Add* + set_robot_cell() step is
needed. Each tool/body is registered under its own `.name`.

A dropdown is auto-created on the `name` input listing every available cell.

COMPAS FAB v2.0.0
"""

import Grasshopper
import Rhino
import System
from compas_ghpython import create_id
from compas_ghpython import error
from scriptcontext import sticky as st

from compas_fab.ghpython import ensure_boolean_toggle
from compas_fab.ghpython import ensure_value_list
from compas_fab.ghpython import register_models_into_cell
from compas_fab.robots import RobotCellLibrary

_LIBRARY_NAMES = sorted(
    name
    for name in dir(RobotCellLibrary)
    if not name.startswith("_") and callable(getattr(RobotCellLibrary, name))
)


class LoadRobotCellFromLibrary(Grasshopper.Kernel.GH_ScriptInstance):
    def RunScript(self,
            name: str,
            load_geometry,
            reload: bool,
            tools: System.Collections.Generic.List[object],
            rigid_bodies: System.Collections.Generic.List[object]):
        ensure_value_list(ghenv.Component, "name", _LIBRARY_NAMES, default="ur5")  # noqa: F821
        ensure_boolean_toggle(ghenv.Component, "load_geometry", default=True)  # noqa: F821

        if not name:
            return (None, None)

        name = name.strip().lower()
        load_geometry = True if load_geometry is None else load_geometry

        loader = getattr(RobotCellLibrary, name, None)
        if loader is None or not callable(loader):
            error(  # noqa: F821
                ghenv.Component,  # noqa: F821
                "Unknown RobotCellLibrary entry '{}'. Available: {}".format(name, ", ".join(_LIBRARY_NAMES)),
            )
            return (None, None)

        # Cache only the base cell; tools/rigid bodies are merged fresh on every run so
        # input edits apply live without re-running the (potentially slow) library loader.
        key = create_id(ghenv.Component, "robot_cell_{}_{}".format(name, load_geometry))  # noqa: F821
        base_cell = st.get(key)

        if reload or base_cell is None:
            try:
                base_cell, _ = loader(load_geometry=load_geometry)
            except Exception as exc:
                # Don't poison the cache; let the user retry by toggling reload or fixing inputs.
                st.pop(key, None)
                error(  # noqa: F821
                    ghenv.Component,  # noqa: F821
                    "Failed to load '{}' (load_geometry={}): {}: {}".format(
                        name, load_geometry, type(exc).__name__, exc
                    ),
                )
                return (None, None)
            st[key] = base_cell

        robot_cell = register_models_into_cell(ghenv.Component, base_cell, tools, rigid_bodies)  # noqa: F821
        robot_cell_state = robot_cell.default_cell_state()
        return (robot_cell, robot_cell_state)
# ---------- end compas_fab_load_robot_cell_from_library ----------

target_mode = ValueList({"ROBOT", "TOOL", "WORKPIECE"}, selected="TOOL")
plane_2 = Plane(Plane(origin=(0.8889869526, -0.1288877825, 0.4619655423), x=(0.9962946504, -0.0860056365, 0), y=(-0.0859405595, -0.9955407944, 0.03889404803)))
compas_fab_frame_target = COMPASFABFrameTarget(plane=plane_2, target_mode=target_mode)  # -> target; inputs target_mode: String, tolerance_position: Double, tolerance_orientation: Double, native_scale: Double
#   port plane: Rhino plane or COMPAS Frame describing the target pose (in WCF).
#   port target_mode: Which frame on the robot to match. One of 'ROBOT' (PCF, default), 'TOOL' (TCF of attached tool), or 'WORKPIECE' (OCF of attached workpiece).
#   port tolerance_position: Position tolerance in meters (not affected by native_scale). If unset, the planner default is used.
#   port tolerance_orientation: Orientation tolerance in radians. If unset, the planner default is used.
#   port native_scale: Scale factor: user_value * native_scale = meters. Use 0.001 if modeling in millimeters. Defaults to 1.0.
# ---------- compas_fab_frame_target: Python ----------
# r: compas_fab>=2
"""
Create a FrameTarget for the robot's end-effector motion planning.

Accepts a Rhino plane or a COMPAS Frame. The `target_mode` controls which
frame on the robot/tool/workpiece is matched against the target.

COMPAS FAB v2.0.0
"""

import Grasshopper
import Rhino
import System
from compas.geometry import Frame
from compas_rhino.conversions import plane_to_compas_frame

from compas_fab.ghpython import ensure_value_list
from compas_fab.robots import FrameTarget
from compas_fab.robots import TargetMode

_TARGET_MODES = [mode.value for mode in TargetMode]


class FrameTargetComponent(Grasshopper.Kernel.GH_ScriptInstance):
    def RunScript(self,
            plane,
            target_mode: str,
            tolerance_position: float,
            tolerance_orientation: float,
            native_scale: float):
        ensure_value_list(ghenv.Component, "target_mode", _TARGET_MODES, default="ROBOT")  # noqa: F821

        if plane is None:
            return None

        frame = plane if isinstance(plane, Frame) else plane_to_compas_frame(plane)

        mode = target_mode or "ROBOT"
        if isinstance(mode, str):
            mode = TargetMode(mode.strip().upper())

        native_scale = native_scale if native_scale else 1.0

        target = FrameTarget(
            target_frame=frame,
            target_mode=mode,
            native_scale=native_scale,
            tolerance_position=tolerance_position,
            tolerance_orientation=tolerance_orientation,
        )
        return target
# ---------- end compas_fab_frame_target ----------

tool_id = ValueList({"gripper"}, selected="gripper")
compas_fab_attach_tool_to_robot = COMPASFABAttachToolToRobot(robot_cell=compas_fab_load_robot_cell_from_library.robot_cell, tool_id=tool_id)  # -> cell_state; inputs tool_id: String, group: String, touch_links: list of String
#   port robot_cell: Optional RobotCell — validates `tool_id`, derives the default `cell_state` when unwired, and resolves the main planning group when `group` is empty.
#   port cell_state: The RobotCellState to modify. If left unwired, the default state is derived from `robot_cell`.
#   port tool_id: Id of the tool inside the RobotCell.
#   port group: Planning group to attach the tool to. If empty, the main planning group is taken from `robot_cell`.
#   port attachment_plane: Optional Rhino Plane or COMPAS Frame describing the tool's frame relative to the end-effector link. Defaults to World XY (coincident with the end link).
#   port touch_links: Optional list of robot link names allowed to collide with the tool.
#   port cell_state: New RobotCellState with the tool attached.
# ---------- compas_fab_attach_tool_to_robot: Python ----------
# r: compas_fab>=2
"""
Attach a tool to a robot planning group inside a RobotCellState.

Passthrough builder: the input state is copied, the attachment is set, and
the new state is returned.

When `robot_cell` is wired and `tool_id` has no source, the component
auto-creates a Value List dropdown listing every tool currently in
`cell.tool_models` (refreshed when the set changes). The `tool_id` is also
validated against `cell.tool_models`; an unknown id raises an error rather
than producing a broken state.

If `cell_state` is left unwired, the default state is derived from
`robot_cell`, so attaching a single tool needs only `robot_cell` + `tool_id`.

If `group` is left empty, the cell's main planning group is used (requires
`robot_cell` to be wired in). Any tool already attached to the same group is
automatically detached.

If `touch_links` is left unwired, the component defaults to the end-effector
link of the planning group (plus its parent link when the end-effector link
itself has no geometry, e.g. UR's `tool0` is a zero-geometry frame so the
parent `wrist_3_link` is included automatically). A remark is surfaced so
the auto-pick isn't silent.

A remark always announces the link the tool actually ends up attached to:
the planning group's end-effector link as returned by
`robot_cell.get_end_effector_link_name(group)`. Override that effective
frame via the `attachment_plane` input.

COMPAS FAB v2.0.0
"""

from copy import deepcopy

import Grasshopper
import Rhino
import System
from compas.geometry import Frame
from compas_ghpython import error
from compas_ghpython import remark
from compas_rhino.conversions import plane_to_compas_frame

from compas_fab.ghpython import ensure_dynamic_value_list


class AttachToolToRobot(Grasshopper.Kernel.GH_ScriptInstance):
    def RunScript(self,
            robot_cell,
            cell_state,
            tool_id: str,
            group: str,
            attachment_plane,
            touch_links: System.Collections.Generic.List[str]):
        # Auto-populate the tool_id dropdown from the cell's tool inventory.
        # Runs even when tool_id is currently None: that's the trigger.
        if robot_cell is not None:
            ensure_dynamic_value_list(
                ghenv.Component,  # noqa: F821
                "tool_id",
                sorted(robot_cell.tool_models.keys()),
            )

        if not tool_id:
            return cell_state

        tool_id = tool_id.strip()

        # Validate the tool exists in the cell before attaching it.
        if robot_cell is not None and tool_id not in robot_cell.tool_models:
            error(  # noqa: F821
                ghenv.Component,  # noqa: F821
                "Tool id '{}' is not in the robot cell. Available tools: {}.".format(
                    tool_id, ", ".join(sorted(robot_cell.tool_models.keys())) or "(none)"
                ),
            )
            return cell_state

        # Derive the default state from the cell when `cell_state` is left unwired.
        if cell_state is None:
            if robot_cell is None:
                error(ghenv.Component, "Wire a `cell_state`, or wire `robot_cell` so the default state can be derived.")  # noqa: F821
                return None
            cell_state = robot_cell.default_cell_state()

        if not group:
            if robot_cell is None:
                error(ghenv.Component, "`group` is empty and no `robot_cell` was wired in: provide one or the other so the tool's planning group can be resolved.")  # noqa: F821
                return cell_state
            group = robot_cell.main_group_name

        group = group.strip()

        attachment_frame = None
        if attachment_plane is not None:
            attachment_frame = attachment_plane if isinstance(attachment_plane, Frame) else plane_to_compas_frame(attachment_plane)

        touch_links_list = list(touch_links) if touch_links else None

        if touch_links_list is None and robot_cell is not None:
            touch_links_list = robot_cell.default_touch_links(group)
            remark(ghenv.Component, "touch_links unwired; defaulted to {} (links the tool inevitably overlaps). Wire your own list to override.".format(touch_links_list))  # noqa: F821

        if robot_cell is not None:
            ee_link = robot_cell.get_end_effector_link_name(group)
            remark(  # noqa: F821
                ghenv.Component,  # noqa: F821
                "attaching '{}' at link '{}' (group '{}' end-effector). The tool's `tool0` frame is at this link; "
                "use `attachment_plane` to rotate/offset the tool relative to it.".format(tool_id, ee_link, group),
            )

        new_state = deepcopy(cell_state)
        new_state.set_tool_attached_to_group(
            tool_id=tool_id,
            group=group,
            attachment_frame=attachment_frame,
            touch_links=touch_links_list,
        )
        return new_state
# ---------- end compas_fab_attach_tool_to_robot ----------

compas_fab_analytical_kinematics_planner = COMPASFABAnalyticalKinematicsPlanner(solver=name, robot_cell=compas_fab_load_robot_cell_from_library.robot_cell)  # -> planner; inputs solver: String, verbose: Boolean
#   port solver: Name of the analytical solver: 'ur3', 'ur3e', 'ur5', 'ur5e', 'ur10', 'ur10e', 'staubli_tx260l', or 'abb_irb4600_40_255'.
#   port robot_cell: Optional RobotCell to assign to the planner (planner.set_robot_cell). Recommended so FK/IK/Cartesian-motion components can resolve TargetMode.TOOL / TargetMode.WORKPIECE.
#   port verbose: Print solver diagnostics. Defaults to False.
#   port planner: Configured AnalyticalKinematicsPlanner.
# ---------- compas_fab_analytical_kinematics_planner: Python ----------
# r: compas_fab>=2
"""
Create an AnalyticalKinematicsPlanner for closed-form FK/IK.

The planner runs in-process inside Rhino (no ROS/PyBullet required). It supports
a fixed set of robots whose kinematics are implemented analytically.

Note: the analytical kinematics convention may differ from the URDF model
(different base/flange frames). Pair this planner with a RobotCell that
matches its convention, or use it for FK/IK without visualization.

COMPAS FAB v2.0.0
"""

import Grasshopper
import Rhino
import System
from compas_ghpython import create_id
from compas_ghpython import error
from scriptcontext import sticky as st

from compas_fab.backends import AnalyticalKinematicsPlanner
from compas_fab.backends.kinematics.solvers import PLANNER_BACKENDS


class AnalyticalKinematicsPlannerComponent(Grasshopper.Kernel.GH_ScriptInstance):
    def RunScript(self, solver: str, robot_cell, verbose: bool):
        if not solver:
            return None

        solver = solver.strip().lower()
        if solver not in PLANNER_BACKENDS:
            error(ghenv.Component, "Unknown analytical solver '{}'. Available: {}".format(solver, ", ".join(sorted(PLANNER_BACKENDS.keys()))))  # noqa: F821
            return None

        verbose = bool(verbose)

        key = create_id(ghenv.Component, "planner_{}_{}".format(solver, verbose))  # noqa: F821
        cached = st.get(key)

        if cached is None:
            solver_instance = PLANNER_BACKENDS[solver]()
            planner = AnalyticalKinematicsPlanner(solver_instance, verbose=verbose)
            st[key] = planner
            cached = planner

        planner = cached

        if robot_cell is not None:
            planner.set_robot_cell(robot_cell)

        return planner
# ---------- end compas_fab_analytical_kinematics_planner ----------
compas_fab_inverse_kinematics = COMPASFABInverseKinematics(
    planner=compas_fab_analytical_kinematics_planner,
    target=compas_fab_frame_target,
    start_state=compas_fab_attach_tool_to_robot)  # -> configuration, cell_state, debug_info; inputs group: String, check_collision: Boolean
#   port planner: A planner instance (AnalyticalKinematicsPlanner, MoveItPlanner, PyBulletPlanner, AnalyticalPyBulletPlanner).
#   port target: Target to reach (FrameTarget, PointAxisTarget, etc.).
#   port start_state: Starting RobotCellState. The robot's configuration in this state is used as the IK seed.
#   port group: Optional planning group name. Defaults to the cell's main planning group.
#   port check_collision: When True, only collision-free IK solutions are returned; when False, in-collision solutions are accepted. Unwired keeps the backend default (True: collision-free).
#   port cell_state: A copy of the start_state with `robot_configuration` set to the IK result. Wire straight into VisualizeRobotCell / ForwardKinematics / next planner step- no SetRobotConfiguration needed.
#   port debug_info: The warnings / errors raised by this run (including a collision diagnostic on failure), as a single string. Wire a panel to read them; empty on a clean solve.
# ---------- compas_fab_inverse_kinematics: Python ----------
# r: compas_fab>=2
"""
Compute inverse kinematics for a target using a stateless planner.

`target` accepts either a proper Target object (`FrameTarget`,
`PointAxisTarget`, `ConfigurationTarget`, ...) or a bare `compas.geometry.Frame`
or Rhino `Plane`. In the latter two cases the component auto-wraps the input
as a `FrameTarget(target_mode=ROBOT)` with default tolerances and emits a
warning. Wire a dedicated Target component for non-default settings.

The starting RobotCellState provides the robot's seed configuration and any
attached tools/workpieces (which affect what 'TOOL'/'WORKPIECE' target modes
resolve to). The component returns both the resulting Configuration and a
copy of the start_state with that Configuration applied (`cell_state`), so
the next stage (Visualize / FK / next planner step) can wire directly
without an intermediate SetRobotConfiguration. The input state is not
mutated.

If `start_state` is left unwired, a zero-configuration default state is
derived from the planner's robot_cell and used as the seed; a warning is
surfaced on the component so the user knows attachments aren't being
considered. Wire an explicit `start_state` to pose the robot mid-process
or to use a state with attached tools / workpieces.

If no IK solution is found, the component is flagged with an error message and
returns nothing. When the planner supports collision checking, the start state is
additionally checked: a concise hint (the colliding pairs, or "collision-free /
likely unreachable") is appended to explain the failure. Every warning/error is
also mirrored to the `debug_info` output so it can be read in a wired panel.

COMPAS FAB v2.0.0
"""

from copy import deepcopy

import Grasshopper
import Rhino
import System
from compas.geometry import Frame
from compas_ghpython import error
from compas_ghpython import warning
from compas_rhino.conversions import plane_to_compas_frame

from compas_fab.backends.exceptions import BackendTargetNotSupportedError
from compas_fab.backends.exceptions import InverseKinematicsError
from compas_fab.ghpython import collision_diagnostic
from compas_fab.robots import FrameTarget
from compas_fab.robots import RobotCellState
from compas_fab.robots import Target
from compas_fab.robots import TargetMode


class InverseKinematicsComponent(Grasshopper.Kernel.GH_ScriptInstance):
    def RunScript(self,
            planner,
            target,
            start_state,
            group: str,
            check_collision: bool):
        # `debug_info` mirrors every warning/error the component raises, so the
        # messages can be read in a wired panel instead of only the balloon.
        debug = []

        def _warn(message):
            warning(ghenv.Component, message)  # noqa: F821
            debug.append(message)

        def _err(message):
            error(ghenv.Component, message)  # noqa: F821
            debug.append(message)

        def _result(configuration, cell_state):
            return (configuration, cell_state, "\n".join(debug))

        if planner is None or target is None:
            # Warn only when the input *is* wired but the upstream returned
            # None (i.e. upstream silently failed). If nothing is wired, the
            # user is still building the canvas: staying quiet keeps it clean.
            for name, value in (("planner", planner), ("target", target)):
                if value is None:
                    param = next(p for p in ghenv.Component.Params.Input if p.Name == name)  # noqa: F821
                    if param.SourceCount > 0:
                        _warn("{} input is wired but received None; check the upstream component for errors.".format(name))
            return _result(None, None)

        if not isinstance(target, Target):
            wrap_msg = "Wrapped a {} as FrameTarget(target_mode=ROBOT) with default tolerances. Wire a Target component for non-default settings."
            if isinstance(target, Frame):
                target = FrameTarget(target_frame=target, target_mode=TargetMode.ROBOT)
                _warn(wrap_msg.format("bare COMPAS Frame"))
            else:
                # Anything else (Rhino Plane, GH_Plane wrapper, ...): try the
                # plane-to-frame conversion. If it isn't plane-shaped, surface
                # a clean error.
                try:
                    frame = plane_to_compas_frame(target)
                except Exception:
                    _err("target must be a Target, a COMPAS Frame or a Rhino Plane; got {}.".format(type(target).__name__))
                    return _result(None, None)
                target = FrameTarget(target_frame=frame, target_mode=TargetMode.ROBOT)
                _warn(wrap_msg.format("Rhino Plane"))

        if start_state is None:
            if planner.robot_cell is None:
                _err("No start_state wired and the planner has no robot_cell to derive one from.")
                return _result(None, None)
            start_state = planner.robot_cell_state or RobotCellState.from_robot_cell(planner.robot_cell)
            _warn(
                "No start_state wired; using zero-configuration default from planner.robot_cell. "
                "Wire a state explicitly to seed from a different configuration or to keep tool/workpiece attachments."
            )

        options = None
        if check_collision is not None:
            options = {"check_collision": bool(check_collision)}

        try:
            configuration = planner.inverse_kinematics(
                target=target,
                robot_cell_state=start_state,
                group=group or None,
                options=options,
            )
        except BackendTargetNotSupportedError:
            # The exception is raised with no payload: surface something
            # actionable: name the target type and the planner that rejected it.
            _err(
                "Planner '{}' does not support target type '{}'. "
                "Use a target type supported by this backend (typically `FrameTarget` "
                "for the Analytical planner) or switch backends.".format(type(planner).__name__, type(target).__name__)
            )
            return _result(None, None)
        except InverseKinematicsError as e:
            msg = str(e)
            hint = collision_diagnostic(planner, start_state, group or None)
            if hint:
                msg += "\n" + hint
            _err(msg)
            return _result(None, None)

        if configuration is None:
            return _result(None, None)

        new_state = deepcopy(start_state)
        new_state.robot_configuration = configuration
        return _result(configuration, new_state)
# ---------- end compas_fab_inverse_kinematics ----------
compas_fab_visualize_robot_cell = COMPASFABVisualizeRobotCell(robot_cell=compas_fab_load_robot_cell_from_library.robot_cell, cell_state=compas_fab_inverse_kinematics.cell_state)  # -> robot_meshes, tool_meshes, rigid_body_meshes, base_plane; inputs draw_visual: Boolean, draw_collision: Boolean, native_scale: Double
#   port robot_cell: The RobotCell to draw.
#   port cell_state: Optional RobotCellState describing the configuration to draw. If unwired, the cell's default state is used.
#   port draw_visual: Draw visual meshes. Defaults to True.
#   port draw_collision: Draw collision meshes. Defaults to False.
#   port native_scale: Scale factor for the drawn geometry: meter_value / native_scale = native_value. Use 0.001 for a millimeter document. Defaults to 1.0.
#   port robot_meshes: Rhino meshes of the robot model.
#   port tool_meshes: Rhino meshes of all tool models in the cell.
#   port rigid_body_meshes: Rhino meshes of all rigid bodies in the cell.
#   port base_plane: Rhino plane at the robot's base frame.
# ---------- compas_fab_visualize_robot_cell: Python ----------
# r: compas_fab>=2
"""
Draw a RobotCell at the configuration described by a RobotCellState.

If no `cell_state` is wired, the cell's default state is used, so the cell is
still drawn (in its default configuration with nothing attached).

This component reuses a cached `RobotCellObject` keyed on the input cell's
identity, so meshes are only built once per canvas session and subsequent
state changes only update transforms (fast).

The robot model, tools, and rigid bodies are returned as separate outputs to
make wiring downstream styling/filtering easy.

COMPAS FAB v2.0.0
"""

import Grasshopper
import Rhino
import System
from compas.scene import SceneObject
from compas_ghpython import create_id
from compas_rhino.conversions import frame_to_rhino_plane
from scriptcontext import sticky as st

from compas_fab.ghpython.scene import RobotCellObject


class VisualizeRobotCell(Grasshopper.Kernel.GH_ScriptInstance):
    def RunScript(self,
            robot_cell,
            cell_state,
            draw_visual: bool,
            draw_collision: bool,
            native_scale: float):
        if robot_cell is None:
            return (None, None, None, None)

        # Fall back to the cell's default state when none is wired. The child
        # scene objects (robot model, tools, rigid bodies) are only built when a
        # state is applied, so without this the draws below hit a None object.
        if cell_state is None:
            cell_state = robot_cell.default_cell_state()

        draw_visual = True if draw_visual is None else draw_visual
        draw_collision = False if draw_collision is None else draw_collision
        native_scale = native_scale if native_scale else 1.0

        key = create_id(  # noqa: F821
            ghenv.Component,  # noqa: F821
            "robot_cell_object_{}_{}_{}_{}".format(id(robot_cell), draw_visual, draw_collision, native_scale),
        )
        scene_object = st.get(key)
        if scene_object is None:
            scene_object = SceneObject(
                item=robot_cell,
                sceneobject_type=RobotCellObject,
                draw_visual=draw_visual,
                draw_collision=draw_collision,
                native_scale=native_scale,
            )
            st[key] = scene_object

        scene_object.update(cell_state)

        # Collect outputs from the child scene objects directly so each output
        # can be wired separately without re-running draw().
        robot_meshes = scene_object._robot_model_scene_object.draw()

        tool_meshes = []
        for tool_so in scene_object._tool_scene_objects.values():
            tool_meshes.extend(tool_so.draw())

        rigid_body_meshes = []
        for rb_so in scene_object._rigid_body_scene_objects.values():
            rigid_body_meshes.extend(rb_so.draw())

        base_plane = None
        if cell_state.robot_base_frame is not None:
            base_plane = frame_to_rhino_plane(cell_state.robot_base_frame)

        return (robot_meshes, tool_meshes, rigid_body_meshes, base_plane)
# ---------- end compas_fab_visualize_robot_cell ----------
