# Grasshopper definition 05_kitchen_sink.ghx (Grasshopper 1.0.8)

# ---- group: ROS Connection
connect = BooleanToggle(True)
compas_fab_ros_client = COMPASFABROSClient(port="9090", connect=connect, transport="asyncio")  # -> ros_client, is_connected, ros_distro; inputs host: String, port: Int32, connect: Boolean, transport: String
#   port host: ROS bridge host. Defaults to '127.0.0.1'.
#   port port: ROS bridge port. Defaults to 9090.
#   port connect: If True, (re)connects. If False, disconnects. A Boolean Toggle (defaulting to False) is auto-created on this input when nothing is wired.
#   port transport: Optional roslibpy transport: 'twisted' (default on most platforms), 'asyncio' (opt-in, requires roslibpy[asyncio]), or 'cli' (IronPython). When empty the choice falls through to ROSLIBPY_TRANSPORT and roslibpy.set_default_transport.
#   port ros_client: Connected RosClient (or None if disconnected).
#   port is_connected: True if the client is currently connected.
#   port ros_distro: Detected ROS distribution (e.g. 'noetic', 'jazzy').
# ---------- compas_fab_ros_client: Python ----------
# r: compas_fab>=2
"""
Connect to a ROS bridge (ROS 1 or ROS 2).

The client is cached in sticky and survives canvas refreshes. Toggling
`connect` from True to False closes the connection. The ROS distro is
auto-detected after connecting.

COMPAS FAB v2.0.0
"""

import Grasshopper
import Rhino
import roslibpy
import System
from compas_ghpython import create_id
from compas_ghpython import remark
from compas_ghpython import warning
from scriptcontext import sticky as st

from compas_fab.backends import RosClient
from compas_fab.ghpython import ensure_boolean_toggle


def _roslibpy_supports_transport():
    """The ``transport`` argument was introduced in roslibpy 2.1."""
    try:
        major, minor = (int(part) for part in roslibpy.__version__.split(".")[:2])
        return (major, minor) >= (2, 1)
    except Exception:
        return False


class RosClientComponent(Grasshopper.Kernel.GH_ScriptInstance):
    def RunScript(self, host: str, port: int, connect: bool, transport: str):
        ensure_boolean_toggle(ghenv.Component, "connect", default=False)  # noqa: F821

        host = host or "127.0.0.1"
        port = port or 9090
        transport = transport.strip() if transport else None

        key = create_id(ghenv.Component, "ros_client")  # noqa: F821
        ros_client = st.get(key, None)

        if ros_client is not None:
            try:
                ros_client.close()
            except Exception as e:
                warning(ghenv.Component, "Error closing previous ROS client: {}".format(e))  # noqa: F821
            st.pop(key, None)
            ros_client = None

        if transport and not _roslibpy_supports_transport():
            warning(ghenv.Component, "The 'transport' input requires roslibpy >= 2.1; ignoring it.")  # noqa: F821
            transport = None

        if connect:
            if transport:
                ros_client = RosClient(host, port, transport=transport)
            else:
                ros_client = RosClient(host, port)
            ros_client.run(5)
            st[key] = ros_client

        is_connected = bool(ros_client and ros_client.is_connected)
        ros_distro = None
        if is_connected:
            try:
                ros_distro = ros_client.ros_distro.value
            except Exception as e:
                remark(ghenv.Component, "Could not detect ROS distro: {}".format(e))  # noqa: F821

        return (ros_client, is_connected, ros_distro)
# ---------- end compas_fab_ros_client ----------

# ---- group: Prepare robot cell elements
mesh = Mesh(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)
xy_plane = XYPlane(Origin=Point(0, 0, 0.1531965584))
compas_fab_tool_from_mesh = COMPASFABToolFromMesh(name="cone_tool", visual_mesh=mesh, collision_mesh=mesh, tcp_plane=xy_plane)  # -> tool_model; inputs name: String
#   port name: Tool identifier (used as the tool id when added to a cell). Defaults to `attached_tool`.
#   port visual_mesh: Rhino mesh for visualization (and collision checking if no separate collision mesh is provided).
#   port collision_mesh: Optional Rhino mesh used only for collision checking. Defaults to `visual_mesh`.
#   port tcp_plane: Tool Coordinate Frame, as a Rhino Plane or COMPAS Frame, expressed in the coordinates the mesh was modelled in.
#   port base_plane: Optional plane, in the coordinates the mesh was modelled in, at which the robot's flange takes hold of the tool. Its Z axis points away from the robot: a tool drawn reaching along world Z needs none. For a tool drawn reaching along world X, wire the plane with Z = world X. Defaults to the world XY plane, i.e. the modelling coordinates are the tool's base frame.
# ---------- compas_fab_tool_from_mesh: Python ----------
# r: compas_fab>=2.0.1
"""
Construct a ToolModel from a Rhino mesh and a TCP plane.

`tcp_plane` may be a Rhino Plane or a compas Frame; it is the Tool
Coordinate Frame, expressed in the same coordinates you modelled the mesh
in. If `collision_mesh` is unwired, `visual_mesh` is reused for collision
checks.

`base_plane` is where the robot's flange takes hold of the geometry, also
in the coordinates you modelled in. Its Z axis points away from the robot,
matching the planning groups of the robots in the library, so a tool drawn
reaching along world Z needs no `base_plane` at all. Wire one when the tool
was drawn along another axis: for a tool reaching along world X, that is
the plane with Z = world X. Nothing is baked into the mesh, so the plane
can be re-wired at any time.

A remark is surfaced when the TCP does not sit roughly on the tool's +Z,
since that means the tool will point sideways once attached.

The result is a static (no joints) `ToolModel` ready to feed into a
`Load Robot Cell` component's `tools` input. Kinematic tools (with their
own joints) should be loaded from URDF instead.

COMPAS FAB v2.0.1 (built 2026-08-03 15:30 UTC)
"""

from math import degrees

import Grasshopper
import Rhino
import rhinoscriptsyntax as rs
import System
from compas.geometry import Frame
from compas.geometry import Vector
from compas_ghpython import remark
from compas_ghpython import warning as gh_warning
from compas_rhino.conversions import mesh_to_compas
from compas_rhino.conversions import plane_to_compas_frame
from compas_robots import ToolModel

# Beyond this angle between the tool's +Z and its TCP, the tool is considered
# to be pointing somewhere other than away from the flange.
MAX_TCP_OFF_AXIS_ANGLE = 30.0


def _off_axis_remark(tool):
    """Text for the mounting-axis remark, or None when the tool looks fine.

    The TCP direction is only a hint: it says nothing about the roll of the tool
    and is meaningless for a TCP sitting on the mount itself, so it is reported
    rather than applied.
    """
    tcp_direction = Vector(*tool.frame.point)
    if tcp_direction.length < 1e-6:
        return None

    angle = degrees(tcp_direction.angle(Vector.Zaxis()))
    if angle < MAX_TCP_OFF_AXIS_ANGLE:
        return None

    message = ("TCP sits {:.0f} deg off the tool's +Z axis, so this tool will point sideways once attached: tools mount with +Z pointing away from the flange. ").format(angle)

    unitized = tcp_direction.unitized()
    if abs(unitized.x) > 0.99:
        message += "Your tool reaches along X, so set `base_plane` to a plane with its Z axis along world X (origin, x=(0,1,0), y=(0,0,1))."
    elif abs(unitized.y) > 0.99:
        message += "Your tool reaches along Y, so set `base_plane` to a plane with its Z axis along world Y (origin, x=(0,0,1), y=(1,0,0))."
    else:
        message += "Set `base_plane` to a plane whose Z axis runs along your tool, with its X axis picked to give the roll you want."
    return message


class ToolFromMesh(Grasshopper.Kernel.GH_ScriptInstance):
    def RunScript(self,
            name: str,
            visual_mesh,
            collision_mesh,
            tcp_plane,
            base_plane):
        if visual_mesh is None or tcp_plane is None:
            return None

        frame = tcp_plane if isinstance(tcp_plane, Frame) else plane_to_compas_frame(tcp_plane)
        base_frame = None
        if base_plane is not None:
            base_frame = base_plane if isinstance(base_plane, Frame) else plane_to_compas_frame(base_plane)
        c_visual = mesh_to_compas(rs.coercemesh(visual_mesh)) if visual_mesh else None
        c_collision = mesh_to_compas(rs.coercemesh(collision_mesh)) if collision_mesh else None

        if collision_mesh is None:
            gh_warning(ghenv.Component, "No collision mesh provided: the tool will be visualized but ignored for collision checking.")  # noqa: F821

        # `base_frame` is only passed when wired, so an older compas_robots keeps
        # working for definitions that don't use it.
        kwargs = {"base_frame": base_frame} if base_frame else {}
        tool = ToolModel(
            visual=c_visual,
            frame_in_tool0_frame=frame,
            collision=c_collision,
            name=(name or "attached_tool").strip(),
            **kwargs,
        )

        message = _off_axis_remark(tool)
        if message:
            remark(ghenv.Component, message)  # noqa: F821

        return tool
# ---------- end compas_fab_tool_from_mesh ----------
rigid_body_from_library = COMPASFABRigidBodyFromLibrary(name="floor")  # -> rigid_body, meshes; inputs name: String, rigid_body_id: String, size: Double
#   port name: Name of the RigidBodyLibrary classmethod to call (e.g. 'target_marker').
#   port rigid_body_id: Optional id for the body. Used as its key when wired into a Load Robot Cell component's `rigid_bodies` input. Defaults to the library entry name.
#   port size: Scaling parameter passed to the library factory. Defaults to 1.0.
#   port meshes: The body's visual meshes as Rhino geometry, drawn in the body's own base frame. For preview only.
# ---------- rigid_body_from_library: Python ----------
# r: compas_fab>=2
"""
Load a pre-defined RigidBody from RigidBodyLibrary.

Currently exposes `target_marker(size=1.0)`, useful as a visualization
aid for IK/planning targets in the scene.

The body's `.name` defaults to the library entry name (e.g. 'target_marker');
override it with `rigid_body_id` to control the key it is registered under when
wired into a Load Robot Cell component.

Also returns the body's visual meshes as Rhino geometry for preview, drawn in
the body's own base frame (not yet placed in any cell).

COMPAS FAB v2.0.0
"""

import Grasshopper
import Rhino
import System
from compas.scene import SceneObject
from compas_ghpython import error

from compas_fab.ghpython.scene import RigidBodyObject
from compas_fab.robots import RigidBodyLibrary


class RigidBodyFromLibrary(Grasshopper.Kernel.GH_ScriptInstance):
    def RunScript(self, name: str, rigid_body_id: str, size: float):
        if not name:
            return (None, None)

        name = name.strip().lower()
        loader = getattr(RigidBodyLibrary, name, None)
        if loader is None:
            available = [attr for attr in dir(RigidBodyLibrary) if not attr.startswith("_") and callable(getattr(RigidBodyLibrary, attr))]
            error(ghenv.Component, "Unknown RigidBodyLibrary entry '{}'. Available: {}".format(name, ", ".join(available)))  # noqa: F821
            return (None, None)

        size = size if size else 1.0
        rigid_body = loader(size)
        rigid_body.name = rigid_body_id.strip() if rigid_body_id else name

        scene_object = SceneObject(
            item=rigid_body,
            sceneobject_type=RigidBodyObject,
            draw_visual=True,
            draw_collision=False,
        )
        meshes = scene_object.draw()

        return (rigid_body, meshes)
# ---------- end rigid_body_from_library ----------

# ---- group: MoveIt Planner
load_geometry = BooleanToggle(True)
compas_fab_moveit_planner = COMPASFABMoveItPlanner(
    ros_client=compas_fab_ros_client.ros_client,
    tools=compas_fab_tool_from_mesh,
    rigid_bodies=rigid_body_from_library.rigid_body,
    load_geometry=load_geometry)  # -> planner, robot_cell, detected_distro; inputs tools: list, rigid_bodies: list, reload: Boolean
#   port ros_client: Connected RosClient (from the ROS Client component).
#   port tools: Optional list of ToolModels to register into the cell. Each is keyed by its `.name`. Re-applied on every refresh without refetching.
#   port rigid_bodies: Optional list of RigidBodies to register into the cell. Each is keyed by its `.name` (set it on the Rigid Body From… component).
#   port load_geometry: If True (default when unwired), fetch mesh geometry. Set to False for faster loads when only kinematics are needed. A Boolean Toggle is auto-created on this input when nothing is wired.
#   port options: Optional MoveItPlannerOptions (from the MoveIt Planner Options component) carrying advanced load parameters (URDF/SRDF names, HTTP file server URL). Not needed for standard ROS setups.
#   port reload: Force a refetch from ROS (bypass the sticky cache). The cell is loaded automatically on the first run; flip this to re-fetch after the robot description or geometry changes. Defaults to False.
#   port planner: MoveItPlanner with the loaded cell uploaded to the planning scene. Wire it into the planning / IK / FK components.
#   port robot_cell: The loaded RobotCell (with any registered tools / rigid bodies). Handy for visualization or building cell states without a separate Deconstruct Planner component.
#   port detected_distro: ROS distribution detected by the client (e.g. 'noetic', 'jazzy'). Useful for diagnosing ROS 1 vs ROS 2 loader mismatches.
# ---------- compas_fab_moveit_planner: Python ----------
# r: compas_fab>=2
"""
Create a MoveItPlanner from a connected RosClient, loading its robot cell from ROS.

Loading and planner setup are one step: MoveIt's planning scene is defined by the
URDF/SRDF loaded into move_group, so the cell can only come from ROS - there is
nothing to load separately and wire in. Tools and rigid bodies wired into
`tools` / `rigid_bodies` are registered into the cell and uploaded as collision
objects.

The base cell is fetched from ROS once and cached in sticky (the mesh payload can
be large); set `reload` to re-fetch. The planner is cached too and rebuilt if the
client changes (e.g. a reconnect). Advanced load parameters live on the optional
`options` input (see the MoveIt Planner Options component); the default case needs
none of them.

If you see HTTP 404 errors while loading geometry, your local ROS may be ROS 1 but
missing the `/rosapi/get_ros_version` service AND the `/rosdistro` parameter, which
makes the client fall back to ROS 2 defaults. Workarounds: set the `/rosdistro` ROS
param, install the rosapi service, or set `load_geometry` to False.

COMPAS FAB v2.0.0
"""

import Grasshopper
import Rhino
import System
from compas_ghpython import create_id
from compas_ghpython import error
from scriptcontext import sticky as st

from compas_fab.backends import MoveItPlanner
from compas_fab.ghpython import ensure_boolean_toggle
from compas_fab.ghpython import register_models_into_cell


class MoveItPlannerComponent(Grasshopper.Kernel.GH_ScriptInstance):
    def RunScript(self,
            ros_client,
            tools: System.Collections.Generic.List[object],
            rigid_bodies: System.Collections.Generic.List[object],
            load_geometry,
            options,
            reload: bool):
        ensure_boolean_toggle(ghenv.Component, "load_geometry", default=True)  # noqa: F821

        if ros_client is None or not ros_client.is_connected:
            return (None, None, None)

        load_geometry = True if load_geometry is None else load_geometry
        load_kwargs = options.to_load_kwargs() if options is not None else {}

        try:
            detected_distro = ros_client.ros_distro.value
        except Exception:
            detected_distro = None

        # Cache the planner; rebuild if the client changed (e.g. user reconnected).
        planner_key = create_id(ghenv.Component, "moveit_planner")  # noqa: F821
        planner = st.get(planner_key)
        planner_rebuilt = False
        if planner is not None and planner.client is not ros_client:
            planner = None
        if planner is None:
            planner = MoveItPlanner(ros_client)
            st[planner_key] = planner
            planner_rebuilt = True

        # Cache only the base cell; tools/rigid bodies are merged fresh on every run
        # so editing them does not require re-fetching the (large) mesh payload.
        sig = "{}_{}_{}".format(
            load_geometry,
            load_kwargs.get("urdf_param_name"),
            load_kwargs.get("srdf_param_name"),
        )
        cell_key = create_id(ghenv.Component, "ros_robot_cell_" + sig)  # noqa: F821
        base_cell = st.get(cell_key)

        if reload or base_cell is None:
            kwargs = dict(load_geometry=load_geometry)
            kwargs.update(load_kwargs)
            try:
                base_cell = ros_client.load_robot_cell(**kwargs)
            except Exception as e:
                st.pop(cell_key, None)  # don't poison the cache
                msg = str(e)
                if "404" in msg or "Not Found" in msg:
                    error(  # noqa: F821
                        ghenv.Component,  # noqa: F821
                        f"ROS load failed with HTTP 404. Detected ROS distro: '{detected_distro}'.",
                    )
                else:
                    error(ghenv.Component, "ROS load failed: {}".format(e))  # noqa: F821
                return (None, None, detected_distro)
            st[cell_key] = base_cell

        if base_cell is None:
            return (None, detected_distro)

        robot_cell = register_models_into_cell(ghenv.Component, base_cell, tools, rigid_bodies)  # noqa: F821

        # Upload to the planning scene only when the set of registered models
        # changed (a rebuilt planner, or tools/rigid bodies added/removed/renamed),
        # so a plain recompute does not re-upload the scene to MoveIt on every tick.
        # Content-only edits to a same-named model are caught by `reload`.
        cell_sig = robot_cell.structural_signature()
        sig_key = create_id(ghenv.Component, "moveit_cell_sig")  # noqa: F821
        if planner_rebuilt or reload or st.get(sig_key) != cell_sig:
            planner.set_robot_cell(robot_cell)
            st[sig_key] = cell_sig

        return (planner, robot_cell, detected_distro)
# ---------- end compas_fab_moveit_planner ----------
tool_id = ValueList({"cone_tool"}, selected="cone_tool")
compas_fab_attach_tool_to_robot = COMPASFABAttachToolToRobot(robot_cell=compas_fab_moveit_planner.robot_cell, tool_id=tool_id)  # -> cell_state; inputs tool_id: String, group: String, touch_links: list of String
#   port robot_cell: Optional RobotCell — validates `tool_id`, derives the default `cell_state` when unwired, and resolves the main planning group when `group` is empty.
#   port cell_state: The RobotCellState to modify. If left unwired, the default state is derived from `robot_cell`.
#   port tool_id: Id of the tool inside the RobotCell.
#   port group: Planning group to attach the tool to. If empty, the main planning group is taken from `robot_cell`.
#   port attachment_plane: Optional Rhino Plane or COMPAS Frame describing the tool's frame relative to the end-effector link. Defaults to World XY (coincident with the end link).
#   port touch_links: Optional list of robot link names allowed to collide with the tool.
#   port cell_state: New RobotCellState with the tool attached.
# ---------- compas_fab_attach_tool_to_robot: Python ----------
# r: compas_fab>=2
"""
Attach a tool to a robot planning group inside a RobotCellState.

Passthrough builder: the input state is copied, the attachment is set, and
the new state is returned.

When `robot_cell` is wired and `tool_id` has no source, the component
auto-creates a Value List dropdown listing every tool currently in
`cell.tool_models` (refreshed when the set changes). The `tool_id` is also
validated against `cell.tool_models`; an unknown id raises an error rather
than producing a broken state.

If `cell_state` is left unwired, the default state is derived from
`robot_cell`, so attaching a single tool needs only `robot_cell` + `tool_id`.

If `group` is left empty, the cell's main planning group is used (requires
`robot_cell` to be wired in). Any tool already attached to the same group is
automatically detached.

If `touch_links` is left unwired, the component defaults to the end-effector
link of the planning group (plus its parent link when the end-effector link
itself has no geometry, e.g. UR's `tool0` is a zero-geometry frame so the
parent `wrist_3_link` is included automatically). A remark is surfaced so
the auto-pick isn't silent.

A remark always announces the link the tool actually ends up attached to:
the planning group's end-effector link as returned by
`robot_cell.get_end_effector_link_name(group)`. Override that effective
frame via the `attachment_plane` input.

COMPAS FAB v2.0.0
"""

from copy import deepcopy

import Grasshopper
import Rhino
import System
from compas.geometry import Frame
from compas_ghpython import error
from compas_ghpython import remark
from compas_rhino.conversions import plane_to_compas_frame

from compas_fab.ghpython import ensure_dynamic_value_list


class AttachToolToRobot(Grasshopper.Kernel.GH_ScriptInstance):
    def RunScript(self,
            robot_cell,
            cell_state,
            tool_id: str,
            group: str,
            attachment_plane,
            touch_links: System.Collections.Generic.List[str]):
        # Auto-populate the tool_id dropdown from the cell's tool inventory.
        # Runs even when tool_id is currently None: that's the trigger.
        if robot_cell is not None:
            ensure_dynamic_value_list(
                ghenv.Component,  # noqa: F821
                "tool_id",
                sorted(robot_cell.tool_models.keys()),
            )

        if not tool_id:
            return cell_state

        tool_id = tool_id.strip()

        # Validate the tool exists in the cell before attaching it.
        if robot_cell is not None and tool_id not in robot_cell.tool_models:
            error(  # noqa: F821
                ghenv.Component,  # noqa: F821
                "Tool id '{}' is not in the robot cell. Available tools: {}.".format(
                    tool_id, ", ".join(sorted(robot_cell.tool_models.keys())) or "(none)"
                ),
            )
            return cell_state

        # Derive the default state from the cell when `cell_state` is left unwired.
        if cell_state is None:
            if robot_cell is None:
                error(ghenv.Component, "Wire a `cell_state`, or wire `robot_cell` so the default state can be derived.")  # noqa: F821
                return None
            cell_state = robot_cell.default_cell_state()

        if not group:
            if robot_cell is None:
                error(ghenv.Component, "`group` is empty and no `robot_cell` was wired in: provide one or the other so the tool's planning group can be resolved.")  # noqa: F821
                return cell_state
            group = robot_cell.main_group_name

        group = group.strip()

        attachment_frame = None
        if attachment_plane is not None:
            attachment_frame = attachment_plane if isinstance(attachment_plane, Frame) else plane_to_compas_frame(attachment_plane)

        touch_links_list = list(touch_links) if touch_links else None

        if touch_links_list is None and robot_cell is not None:
            touch_links_list = robot_cell.default_touch_links(group)
            remark(ghenv.Component, "touch_links unwired; defaulted to {} (links the tool inevitably overlaps). Wire your own list to override.".format(touch_links_list))  # noqa: F821

        if robot_cell is not None:
            ee_link = robot_cell.get_end_effector_link_name(group)
            remark(  # noqa: F821
                ghenv.Component,  # noqa: F821
                "attaching '{}' at link '{}' (group '{}' end-effector). The tool's `tool0` frame is at this link; "
                "use `attachment_plane` to rotate/offset the tool relative to it.".format(tool_id, ee_link, group),
            )

        new_state = deepcopy(cell_state)
        new_state.set_tool_attached_to_group(
            tool_id=tool_id,
            group=group,
            attachment_frame=attachment_frame,
            touch_links=touch_links_list,
        )
        return new_state
# ---------- end compas_fab_attach_tool_to_robot ----------
cell_state_with_tool = Data(compas_fab_attach_tool_to_robot)
robot_cell = Data(compas_fab_moveit_planner.robot_cell)
planner = Data(compas_fab_moveit_planner.planner)

# ---- group: Default state viz
robot_cell_2 = Data(robot_cell)
compas_fab_visualize_robot_cell = COMPASFABVisualizeRobotCell(robot_cell=robot_cell_2)  # -> robot_meshes, tool_meshes, rigid_body_meshes, base_plane; inputs draw_visual: Boolean, draw_collision: Boolean, native_scale: Double
#   port robot_cell: The RobotCell to draw.
#   port cell_state: Optional RobotCellState describing the configuration to draw. If unwired, the cell's default state is used.
#   port draw_visual: Draw visual meshes. Defaults to True.
#   port draw_collision: Draw collision meshes. Defaults to False.
#   port native_scale: Scale factor for the drawn geometry: meter_value / native_scale = native_value. Use 0.001 for a millimeter document. Defaults to 1.0.
#   port robot_meshes: Rhino meshes of the robot model.
#   port tool_meshes: Rhino meshes of all tool models in the cell.
#   port rigid_body_meshes: Rhino meshes of all rigid bodies in the cell.
#   port base_plane: Rhino plane at the robot's base frame.
# ---------- compas_fab_visualize_robot_cell: Python ----------
# r: compas_fab>=2
"""
Draw a RobotCell at the configuration described by a RobotCellState.

If no `cell_state` is wired, the cell's default state is used, so the cell is
still drawn (in its default configuration with nothing attached).

This component reuses a cached `RobotCellObject` keyed on the input cell's
identity, so meshes are only built once per canvas session and subsequent
state changes only update transforms (fast).

The robot model, tools, and rigid bodies are returned as separate outputs to
make wiring downstream styling/filtering easy.

COMPAS FAB v2.0.0
"""

import Grasshopper
import Rhino
import System
from compas.scene import SceneObject
from compas_ghpython import create_id
from compas_rhino.conversions import frame_to_rhino_plane
from scriptcontext import sticky as st

from compas_fab.ghpython.scene import RobotCellObject


class VisualizeRobotCell(Grasshopper.Kernel.GH_ScriptInstance):
    def RunScript(self,
            robot_cell,
            cell_state,
            draw_visual: bool,
            draw_collision: bool,
            native_scale: float):
        if robot_cell is None:
            return (None, None, None, None)

        # Fall back to the cell's default state when none is wired. The child
        # scene objects (robot model, tools, rigid bodies) are only built when a
        # state is applied, so without this the draws below hit a None object.
        if cell_state is None:
            cell_state = robot_cell.default_cell_state()

        draw_visual = True if draw_visual is None else draw_visual
        draw_collision = False if draw_collision is None else draw_collision
        native_scale = native_scale if native_scale else 1.0

        key = create_id(  # noqa: F821
            ghenv.Component,  # noqa: F821
            "robot_cell_object_{}_{}_{}_{}".format(id(robot_cell), draw_visual, draw_collision, native_scale),
        )
        scene_object = st.get(key)
        if scene_object is None:
            scene_object = SceneObject(
                item=robot_cell,
                sceneobject_type=RobotCellObject,
                draw_visual=draw_visual,
                draw_collision=draw_collision,
                native_scale=native_scale,
            )
            st[key] = scene_object

        scene_object.update(cell_state)

        # Collect outputs from the child scene objects directly so each output
        # can be wired separately without re-running draw().
        robot_meshes = scene_object._robot_model_scene_object.draw()

        tool_meshes = []
        for tool_so in scene_object._tool_scene_objects.values():
            tool_meshes.extend(tool_so.draw())

        rigid_body_meshes = []
        for rb_so in scene_object._rigid_body_scene_objects.values():
            rigid_body_meshes.extend(rb_so.draw())

        base_plane = None
        if cell_state.robot_base_frame is not None:
            base_plane = frame_to_rhino_plane(cell_state.robot_base_frame)

        return (robot_meshes, tool_meshes, rigid_body_meshes, base_plane)
# ---------- end compas_fab_visualize_robot_cell ----------

# ---- group: Inverse Kinematics to frame
robot_cell_3 = Data(robot_cell)
planner_2 = Data(planner)
cell_state = Data(cell_state_with_tool)
target_plane_ik = Plane(Plane(origin=(0.4937036997, 0.05697187173, 0.5034884601), x=(0.3696428087, -0.929173931, 0), y=(-0.929173931, -0.3696428087, 0)))
compas_fab_inverse_kinematics = COMPASFABInverseKinematics(planner=planner_2, target=target_plane_ik, start_state=cell_state)  # -> configuration, cell_state; inputs group: String, check_collision: Boolean
#   port planner: A planner instance (AnalyticalKinematicsPlanner, MoveItPlanner, PyBulletPlanner, AnalyticalPyBulletPlanner).
#   port target: Target to reach (FrameTarget, PointAxisTarget, etc.).
#   port start_state: Starting RobotCellState. The robot's configuration in this state is used as the IK seed.
#   port group: Optional planning group name. Defaults to the cell's main planning group.
#   port check_collision: When True, only collision-free IK solutions are returned; when False, in-collision solutions are accepted. Unwired keeps the backend default (True: collision-free).
#   port cell_state: A copy of the start_state with `robot_configuration` set to the IK result. Wire straight into VisualizeRobotCell / ForwardKinematics / next planner step- no SetRobotConfiguration needed.
# ---------- compas_fab_inverse_kinematics: Python ----------
# r: compas_fab>=2
"""
Compute inverse kinematics for a target using a stateless planner.

`target` accepts either a proper Target object (`FrameTarget`,
`PointAxisTarget`, `ConfigurationTarget`, ...) or a bare `compas.geometry.Frame`
or Rhino `Plane`. In the latter two cases the component auto-wraps the input
as a `FrameTarget(target_mode=ROBOT)` with default tolerances and emits a
warning. Wire a dedicated Target component for non-default settings.

The starting RobotCellState provides the robot's seed configuration and any
attached tools/workpieces (which affect what 'TOOL'/'WORKPIECE' target modes
resolve to). The component returns both the resulting Configuration and a
copy of the start_state with that Configuration applied (`cell_state`), so
the next stage (Visualize / FK / next planner step) can wire directly
without an intermediate SetRobotConfiguration. The input state is not
mutated.

If `start_state` is left unwired, a zero-configuration default state is
derived from the planner's robot_cell and used as the seed; a warning is
surfaced on the component so the user knows attachments aren't being
considered. Wire an explicit `start_state` to pose the robot mid-process
or to use a state with attached tools / workpieces.

If no IK solution is found, the component is flagged with an error message
(visible in the component balloon) and returns (None, None). When the planner
supports collision checking, the start state is additionally checked and, if it
is in collision, the colliding pairs are appended to the message to explain why
no collision-free solution exists.

COMPAS FAB v2.0.0
"""

from copy import deepcopy

import Grasshopper
import Rhino
import System
from compas.geometry import Frame
from compas_ghpython import error
from compas_ghpython import warning
from compas_rhino.conversions import plane_to_compas_frame

from compas_fab.backends.exceptions import BackendFeatureNotSupportedError
from compas_fab.backends.exceptions import BackendTargetNotSupportedError
from compas_fab.backends.exceptions import CollisionCheckError
from compas_fab.backends.exceptions import InverseKinematicsError
from compas_fab.robots import FrameTarget
from compas_fab.robots import RobotCellState
from compas_fab.robots import Target
from compas_fab.robots import TargetMode


def _collision_diagnostic(planner, state):
    """Explain an IK failure via a collision check on the start state, if available.

    Returns a human-readable hint, or `None` when the planner cannot collision-check
    (so the caller just reports the bare IK error). Never raises - a diagnostic must
    not mask the real failure.
    """
    try:
        planner.check_collision(state, options={"full_report": True})
    except CollisionCheckError as cc:
        return "The start state is in collision, which blocks every collision-free solution:\n{}".format(cc)
    except (BackendFeatureNotSupportedError, AttributeError, NotImplementedError):
        return None
    except Exception:
        return None
    return (
        "The start state itself is collision-free, so the failure is most likely reachability "
        "(target out of range or orientation infeasible) or collisions at the target pose."
    )


class InverseKinematicsComponent(Grasshopper.Kernel.GH_ScriptInstance):
    def RunScript(self,
            planner,
            target,
            start_state,
            group: str,
            check_collision: bool):
        if planner is None or target is None:
            # Warn only when the input *is* wired but the upstream returned
            # None (i.e. upstream silently failed). If nothing is wired, the
            # user is still building the canvas: staying quiet keeps it clean.
            for name, value in (("planner", planner), ("target", target)):
                if value is None:
                    param = next(p for p in ghenv.Component.Params.Input if p.Name == name)  # noqa: F821
                    if param.SourceCount > 0:
                        warning(ghenv.Component, "{} input is wired but received None; check the upstream component for errors.".format(name))  # noqa: F821
            return (None, None)

        if not isinstance(target, Target):
            wrap_msg = "Wrapped a {} as FrameTarget(target_mode=ROBOT) with default tolerances. Wire a Target component for non-default settings."
            if isinstance(target, Frame):
                target = FrameTarget(target_frame=target, target_mode=TargetMode.ROBOT)
                warning(ghenv.Component, wrap_msg.format("bare COMPAS Frame"))  # noqa: F821
            else:
                # Anything else (Rhino Plane, GH_Plane wrapper, ...): try the
                # plane-to-frame conversion. If it isn't plane-shaped, surface
                # a clean error.
                try:
                    frame = plane_to_compas_frame(target)
                except Exception:
                    error(ghenv.Component, "target must be a Target, a COMPAS Frame or a Rhino Plane; got {}.".format(type(target).__name__))  # noqa: F821
                    return (None, None)
                target = FrameTarget(target_frame=frame, target_mode=TargetMode.ROBOT)
                warning(ghenv.Component, wrap_msg.format("Rhino Plane"))  # noqa: F821

        if start_state is None:
            if planner.robot_cell is None:
                error(ghenv.Component, "No start_state wired and the planner has no robot_cell to derive one from.")  # noqa: F821
                return (None, None)
            start_state = planner.robot_cell_state or RobotCellState.from_robot_cell(planner.robot_cell)
            warning(  # noqa: F821
                ghenv.Component,  # noqa: F821
                "No start_state wired; using zero-configuration default from planner.robot_cell. "
                "Wire a state explicitly to seed from a different configuration or to keep tool/workpiece attachments.",
            )

        options = None
        if check_collision is not None:
            options = {"check_collision": bool(check_collision)}

        try:
            configuration = planner.inverse_kinematics(
                target=target,
                robot_cell_state=start_state,
                group=group or None,
                options=options,
            )
        except BackendTargetNotSupportedError:
            # The exception is raised with no payload: surface something
            # actionable: name the target type and the planner that rejected it.
            error(  # noqa: F821
                ghenv.Component,  # noqa: F821
                "Planner '{}' does not support target type '{}'. "
                "Use a target type supported by this backend (typically `FrameTarget` "
                "for the Analytical planner) or switch backends.".format(
                    type(planner).__name__, type(target).__name__),
            )
            return (None, None)
        except InverseKinematicsError as e:
            msg = "Inverse kinematics failed: {}".format(e)
            hint = _collision_diagnostic(planner, start_state)
            if hint:
                msg += "\n" + hint
            error(ghenv.Component, msg)  # noqa: F821
            return (None, None)

        if configuration is None:
            return (None, None)

        new_state = deepcopy(start_state)
        new_state.robot_configuration = configuration
        return (configuration, new_state)
# ---------- end compas_fab_inverse_kinematics ----------
visualize_ik = COMPASFABVisualizeRobotCell(robot_cell=robot_cell_3, cell_state=compas_fab_inverse_kinematics.cell_state)  # -> robot_meshes, tool_meshes, rigid_body_meshes, base_plane; inputs draw_visual: Boolean, draw_collision: Boolean, native_scale: Double; same code as compas_fab_visualize_robot_cell

# ---- group: Inverse Kinematics to frame target
robot_cell_4 = Data(robot_cell)
planner_3 = Data(planner)
cell_state_2 = Data(cell_state_with_tool)
target_plane_ik_2 = Plane(Plane(origin=(0.4937036997, 0.05697187173, 0.5034884601), x=(0.3696428087, -0.929173931, 0), y=(-0.929173931, -0.3696428087, 0)))
target_mode = ValueList({"ROBOT", "TOOL", "WORKPIECE"}, selected="TOOL")
compas_fab_frame_target = COMPASFABFrameTarget(plane=target_plane_ik_2, target_mode=target_mode)  # -> target; inputs target_mode: String, tolerance_position: Double, tolerance_orientation: Double, native_scale: Double
#   port plane: Rhino plane or COMPAS Frame describing the target pose (in WCF).
#   port target_mode: Which frame on the robot to match. One of 'ROBOT' (PCF, default), 'TOOL' (TCF of attached tool), or 'WORKPIECE' (OCF of attached workpiece).
#   port tolerance_position: Position tolerance in meters (not affected by native_scale). If unset, the planner default is used.
#   port tolerance_orientation: Orientation tolerance in radians. If unset, the planner default is used.
#   port native_scale: Scale factor: user_value * native_scale = meters. Use 0.001 if modeling in millimeters. Defaults to 1.0.
# ---------- compas_fab_frame_target: Python ----------
# r: compas_fab>=2
"""
Create a FrameTarget for the robot's end-effector motion planning.

Accepts a Rhino plane or a COMPAS Frame. The `target_mode` controls which
frame on the robot/tool/workpiece is matched against the target.

COMPAS FAB v2.0.0
"""

import Grasshopper
import Rhino
import System
from compas.geometry import Frame
from compas_rhino.conversions import plane_to_compas_frame

from compas_fab.ghpython import ensure_value_list
from compas_fab.robots import FrameTarget
from compas_fab.robots import TargetMode

_TARGET_MODES = [mode.value for mode in TargetMode]


class FrameTargetComponent(Grasshopper.Kernel.GH_ScriptInstance):
    def RunScript(self,
            plane,
            target_mode: str,
            tolerance_position: float,
            tolerance_orientation: float,
            native_scale: float):
        ensure_value_list(ghenv.Component, "target_mode", _TARGET_MODES, default="ROBOT")  # noqa: F821

        if plane is None:
            return None

        frame = plane if isinstance(plane, Frame) else plane_to_compas_frame(plane)

        mode = target_mode or "ROBOT"
        if isinstance(mode, str):
            mode = TargetMode(mode.strip().upper())

        native_scale = native_scale if native_scale else 1.0

        target = FrameTarget(
            target_frame=frame,
            target_mode=mode,
            native_scale=native_scale,
            tolerance_position=tolerance_position,
            tolerance_orientation=tolerance_orientation,
        )
        return target
# ---------- end compas_fab_frame_target ----------
compas_fab_inverse_kinematics_2 = COMPASFABInverseKinematics(planner=planner_3, target=compas_fab_frame_target, start_state=cell_state_2)  # -> configuration, cell_state; inputs group: String, check_collision: Boolean; same code as compas_fab_inverse_kinematics
visualize_ik_2 = COMPASFABVisualizeRobotCell(robot_cell=robot_cell_4, cell_state=compas_fab_inverse_kinematics_2.cell_state)  # -> robot_meshes, tool_meshes, rigid_body_meshes, base_plane; inputs draw_visual: Boolean, draw_collision: Boolean, native_scale: Double; same code as compas_fab_visualize_robot_cell
ik_end_state = Data(compas_fab_inverse_kinematics_2.cell_state)

# ----
ik_end_state_2 = Data(ik_end_state)
shoulder_pan_joint = Slider(0, range=-6.283185..6.283185)
shoulder_lift_joint = Slider(0, range=-6.283185..6.283185)
elbow_joint = Slider(0, range=-3.141593..3.141593)
wrist_1_joint = Slider(0, range=-6.283185..6.283185)
wrist_2_joint = Slider(0, range=-6.283185..6.283185)
wrist_3_joint = Slider(0, range=-6.283185..6.283185)

# ---- group: Forward Kinematics
planner_4 = Data(planner)
robot_cell_5 = Data(robot_cell)
compas_fab_robot_configuration = COMPASFABRobotConfiguration(
    robot_cell=robot_cell_5,
    joints=[shoulder_pan_joint, shoulder_lift_joint, elbow_joint, wrist_1_joint, wrist_2_joint, wrist_3_joint])  # -> configuration, cell_state; inputs joints: list of Double
#   port robot_cell: The RobotCell to derive joint metadata from. Wiring a new cell rebuilds the slider bank to match its configurable joints.
#   port joints: Joint values in canonical joint order. Auto-populated by the per-joint sliders the component creates; wire your own values to override.
#   port configuration: Configuration with joint_names and joint_types extracted from the cell.
#   port cell_state: A copy of the default cell state with `robot_configuration` set to the selected configuration.
# ---------- compas_fab_robot_configuration: Python ----------
# r: compas_fab>=2
"""
Build a Configuration from per-joint sliders auto-created from a RobotCell.

Wire a `robot_cell` to this component and one `GH_NumberSlider` per
configurable joint is generated automatically and wired to the `joints`
list input, with min/max set to the joint's limits (and ±2π fallback for
continuous joints / ±1m for prismatic when no limit is declared).

Re-wiring a different `robot_cell` replaces the slider bank to match the
new joint signature. Wiring your own values to `joints` overrides the
auto-sliders.

COMPAS FAB v2.0.0
"""

import Grasshopper
import Rhino
import System
from compas_ghpython import error
from compas_robots import Configuration

from compas_fab.ghpython import ensure_joint_sliders


class RobotConfigurationComponent(Grasshopper.Kernel.GH_ScriptInstance):
    def RunScript(self, robot_cell, joints: System.Collections.Generic.List[float]):
        if robot_cell is None:
            return None

        try:
            robot_model = robot_cell.robot_model
        except AttributeError:
            error(ghenv.Component, "robot_cell must be a RobotCell instance.")  # noqa: F821
            return None

        metadata = ensure_joint_sliders(ghenv.Component, robot_model, input_name="joints")  # noqa: F821
        if not metadata:
            return None

        names = [name for name, _, _ in metadata]
        types = [jtype for _, jtype, _ in metadata]
        defaults = [default for _, _, default in metadata]

        # `joints` may arrive empty on the very first solve (sliders are
        # wired in this pass but their values only flow on the scheduled
        # follow-up solve). Fall back to per-joint defaults then.
        if not joints or len(joints) < len(metadata):
            values = defaults
        else:
            values = [float(v) for v in joints]

        configuration = Configuration(joint_values=values, joint_types=types, joint_names=names)
        cell_state =robot_cell.default_cell_state()
        cell_state.robot_configuration = configuration
        return (configuration, cell_state)
# ---------- end compas_fab_robot_configuration ----------
target_mode_2 = ValueList({"ROBOT", "TOOL", "WORKPIECE"}, selected="ROBOT")
compas_fab_visualize_robot_cell_2 = COMPASFABVisualizeRobotCell(robot_cell=robot_cell_5, cell_state=compas_fab_robot_configuration.cell_state)  # -> robot_meshes, tool_meshes, rigid_body_meshes, base_plane; inputs draw_visual: Boolean, draw_collision: Boolean, native_scale: Double; same code as compas_fab_visualize_robot_cell
compas_fab_forward_kinematics = COMPASFABForwardKinematics(planner=planner_4, cell_state=compas_fab_robot_configuration.cell_state, target_mode=target_mode_2)  # -> frame, plane; inputs target_mode: String, group: String
#   port planner: A planner instance (AnalyticalKinematicsPlanner, MoveItPlanner, PyBulletPlanner, AnalyticalPyBulletPlanner).
#   port cell_state: RobotCellState containing the configuration to evaluate.
#   port target_mode: Which frame to return: 'ROBOT' (PCF, default), 'TOOL' (TCF of attached tool), or 'WORKPIECE' (OCF of attached workpiece).
#   port group: Optional planning group name. Defaults to the cell's main planning group.
#   port plane: Same result as a Rhino Plane for downstream Grasshopper components.
# ---------- compas_fab_forward_kinematics: Python ----------
# r: compas_fab>=2
"""
Compute forward kinematics from a RobotCellState using a stateless planner.

The returned frame depends on the `target_mode`:
* 'ROBOT'      : PCF (planner coordinate frame, last link of the planning group)
* 'TOOL'       : TCF of the attached tool
* 'WORKPIECE'  : OCF of the attached workpiece

The Configuration to evaluate is taken from `cell_state.robot_configuration`;
use the SetRobotConfiguration helper upstream to override it.

COMPAS FAB v2.0.0
"""

import Grasshopper
import Rhino
import System
from compas_rhino.conversions import frame_to_rhino_plane

from compas_fab.ghpython import ensure_value_list
from compas_fab.robots import TargetMode

_TARGET_MODES = [mode.value for mode in TargetMode]


class ForwardKinematicsComponent(Grasshopper.Kernel.GH_ScriptInstance):
    def RunScript(self, planner, cell_state, target_mode: str, group: str):
        ensure_value_list(ghenv.Component, "target_mode", _TARGET_MODES, default="ROBOT")  # noqa: F821

        if not (planner and cell_state):
            return (None, None)

        mode = target_mode or "ROBOT"
        if isinstance(mode, str):
            mode = TargetMode(mode.strip().upper())

        frame = planner.forward_kinematics(
            robot_cell_state=cell_state,
            target_mode=mode,
            group=group or None,
        )
        plane = frame_to_rhino_plane(frame)
        return (frame, plane)
# ---------- end compas_fab_forward_kinematics ----------

# ---- group: Plan motion
planner_5 = Data(planner)
ik_end_state_3 = Data(ik_end_state_2)
target_plane_pm = Plane(Plane(origin=(-0.295890276, -0.4308280237, 0.0817078708), x=(1, 0, 0), y=(0, -1, 0)))
target_mode_3 = ValueList({"ROBOT", "TOOL", "WORKPIECE"}, selected="TOOL")
compas_fab_frame_target_2 = COMPASFABFrameTarget(plane=target_plane_pm, target_mode=target_mode_3)  # -> target; inputs target_mode: String, tolerance_position: Double, tolerance_orientation: Double, native_scale: Double; same code as compas_fab_frame_target
compute_pm = BooleanToggle(True)
compas_fab_deconstruct_planner = COMPASFABDeconstructPlanner(planner=planner_5)  # -> robot_cell, robot_model
#   port planner: A planner (MoveItPlanner, PyBulletPlanner, AnalyticalKinematicsPlanner, …) that has had a robot cell set on it.
#   port robot_cell: The RobotCell currently held by the planner's client. None if no cell has been loaded yet.
#   port robot_model: The cell's RobotModel (`robot_cell.robot_model`). None if no cell has been loaded yet.
# ---------- compas_fab_deconstruct_planner: Python ----------
# r: compas_fab>=2
"""
Deconstruct a planner into the robot cell it currently holds: the
`robot_cell` and its `robot_model`.

These are read from the planner's client (the cell last set on it via a
Load Robot Cell + planner setup). Each output is `None` until a cell has
been loaded. Reads only; never mutates the planner.

The cell *state* is intentionally not exposed: the state held by the client
is whatever was last set internally and is rarely the one you want. Build the
state you need from `Default Cell State` / the `Attach*` components instead.

Works with any planner (MoveIt, PyBullet, Analytical, …).

COMPAS FAB v2.0.0
"""

import Grasshopper
import Rhino
import System


class DeconstructPlanner(Grasshopper.Kernel.GH_ScriptInstance):
    def RunScript(self, planner):
        if planner is None:
            return (None, None)

        robot_cell = planner.robot_cell
        robot_model = robot_cell.robot_model if robot_cell is not None else None

        return (robot_cell, robot_model)
# ---------- end compas_fab_deconstruct_planner ----------
idx_pm = Slider(0, range=0..100)

# ----
compas_fab_plan_motion = COMPASFABPlanMotion(planner=planner_5, target=compas_fab_frame_target_2, start_state=ik_end_state_3, compute=compute_pm)  # -> trajectory, planes, polyline, debug_info; inputs group: String, planner_id: String, num_planning_attempts: Int32, allowed_planning_time: Double, compute: Boolean
#   port planner: A planner that supports plan_motion (e.g. MoveItPlanner, PyBulletPlanner).
#   port target: Target to reach (FrameTarget, PointAxisTarget, ConfigurationTarget, ConstraintSetTarget).
#   port start_state: Starting RobotCellState. The robot's configuration in this state is used as the seed.
#   port group: Planning group name. Defaults to the cell's main planning group.
#   port planner_id: MoveIt planner algorithm name (e.g. 'RRTConnect', 'PRMstar'). Defaults to 'RRTConnect'.
#   port num_planning_attempts: Number of randomized attempts to make. Defaults to 5 for MoveIt.
#   port allowed_planning_time: Planning timeout in seconds. Defaults to 1.0.
#   port compute: Trigger planning. Defaults to False so the canvas does not plan on every refresh.
#   port planes: List of Rhino planes — one per trajectory point — at the planning group's end-effector frame (target_mode=ROBOT). Computed via FK on the planner with the start_state's attachments preserved.
#   port polyline: Polyline connecting the plane origins in trajectory order. None when the trajectory has fewer than two points.
#   port debug_info: The failure message (including a collision diagnostic on a full failure), as a single string. Wire a panel to read it; empty on success.
# ---------- compas_fab_plan_motion: Python ----------
# r: compas_fab>=2
"""
Plan a free-space (joint-interpolated) motion to a target.

Calls `planner.plan_motion(target, start_state)`. The result is cached in
sticky so the canvas does not re-plan on every refresh - set `compute` to
True to (re)plan.

Any planning failure (no plan found, start/goal in collision, timed out, …)
flags the component red with the backend error message. When the backend
returns a `partial_trajectory`, the component is flagged with a warning
instead and the partial trajectory is surfaced. On a full failure the start
state is collision-checked (when the planner supports it) and a concise hint
appended. The message is also exposed on the `debug_info` output so it can be
read in a wired panel.

COMPAS FAB v2.0.0
"""

import Grasshopper
import Rhino
import System
from compas_ghpython import create_id
from compas_ghpython import error as gh_error
from compas_ghpython import warning as gh_warning
from compas_rhino.conversions import frame_to_rhino_plane
from compas_rhino.conversions import polyline_to_rhino
from scriptcontext import sticky as st

from compas_fab.backends import BackendError
from compas_fab.backends import MotionPlanningError
from compas_fab.ghpython import collision_diagnostic


class PlanMotion(Grasshopper.Kernel.GH_ScriptInstance):
    def RunScript(self,
            planner,
            target,
            start_state,
            group: str,
            planner_id: str,
            num_planning_attempts: int,
            allowed_planning_time: float,
            compute: bool):
        key = create_id(ghenv.Component, "trajectory")  # noqa: F821

        def _viz(trajectory):
            if trajectory is None:
                return [], None
            frames, polyline = trajectory.to_frames_and_polyline(planner.robot_cell, start_state, group or None)
            planes = [frame_to_rhino_plane(f) for f in frames]
            polyline = polyline_to_rhino(polyline) if polyline else None
            return planes, polyline

        def _diagnose(error_msg, has_trajectory):
            """Flag the component for an error and return the message shown (for debug_info)."""
            if not error_msg:
                return ""
            if has_trajectory:
                message = "Motion planning failed but a partial trajectory was returned: {}".format(error_msg)
                gh_warning(ghenv.Component, message)  # noqa: F821
            else:
                message = "Motion planning failed: {}".format(error_msg)
                gh_error(ghenv.Component, message)  # noqa: F821
            return message

        if not (planner and target and start_state and compute):
            cached = st.get(key)
            if cached is None:
                return (None, [], None, "")
            trajectory, error_msg = cached
            debug_info = _diagnose(error_msg, trajectory is not None)
            planes, polyline = _viz(trajectory)
            return (trajectory, planes, polyline, debug_info)

        options = {}
        if planner_id:
            options["planner_id"] = planner_id
        if num_planning_attempts:
            options["num_planning_attempts"] = int(num_planning_attempts)
        if allowed_planning_time:
            options["allowed_planning_time"] = float(allowed_planning_time)

        trajectory = None
        error_msg = None
        # try:
        trajectory = planner.plan_motion(
            target=target,
            start_state=start_state,
            group=group or None,
            options=options or None,
        )
        # except MotionPlanningError as e:
        #     trajectory = getattr(e, "partial_trajectory", None)
        #     error_msg = str(e)
        # except BackendError as e:
        #     error_msg = str(e)

        # On a full failure, append a concise collision check on the start state
        # (a common cause). Cached with the error so replays don't re-query the backend.
        if error_msg and trajectory is None:
            hint = collision_diagnostic(planner, start_state, group or None)
            if hint:
                error_msg += "\n" + hint

        debug_info = _diagnose(error_msg, trajectory is not None)
        st[key] = (trajectory, error_msg)
        planes, polyline = _viz(trajectory)
        return (trajectory, planes, polyline, debug_info)
# ---------- end compas_fab_plan_motion ----------

# ---- group: Plan motion (continued)
geometry = Geometry(compas_fab_plan_motion.planes)
geometry_2 = Geometry(compas_fab_plan_motion.polyline)
deconstruct_cm = COMPASFABDeconstructTrajectory(trajectory=compas_fab_plan_motion.trajectory)  # -> configurations, cell_states, velocities, accelerations, efforts
#   port trajectory: A JointTrajectory (typically the output of PlanMotion or PlanCartesianMotion). The per-point `cell_states` are derived from `trajectory.start_state`, which the planner sets automatically.
#   port configurations: One Configuration per trajectory point, in order.
#   port cell_states: One RobotCellState per trajectory point: a copy of `trajectory.start_state` with `robot_configuration` set to the corresponding point. Empty when the trajectory has no `start_state`.
#   port velocities: DataTree of joint velocities — one branch per trajectory point, each branch ordered to match the trajectory's `joint_names`. Zeros when the backend didn't populate this field.
#   port accelerations: DataTree of joint accelerations — one branch per trajectory point, ordered to match `joint_names`. Zeros when the backend didn't populate this field.
#   port efforts: DataTree of joint efforts — one branch per trajectory point, ordered to match `joint_names`. Zeros when the backend didn't populate this field.
# ---------- deconstruct_cm: Python ----------
# r: compas_fab>=2
"""
Expand a JointTrajectory into per-point Configurations and RobotCellStates,
plus the per-point velocity/acceleration/effort profiles.

`configurations` is always populated (one Configuration per trajectory
point). `cell_states` is populated when the trajectory carries a
`start_state` (set by the planner that produced it). Each entry is a copy
of that state with `robot_configuration` set to the corresponding
trajectory point, so it can be piped straight into `VisualizeRobotCell`
(e.g. via an index slider to scrub through frames).

`velocities`, `accelerations` and `efforts` are lists of lists: one
inner list per trajectory point, each ordered to match the trajectory's
`joint_names`. They land on the GH canvas as DataTrees (one branch per
point), so a Quick Graph / chart node can plot the profile directly.
Backends that don't populate these fields return lists of zeros.

When the trajectory's joint set is a subset of `start_state.robot_configuration`
(common for robots with extra joints outside the planning group, e.g. Panda's
finger), the values are merged by joint name so the unrelated joints keep
the value they had in `start_state`.

COMPAS FAB v2.0.0
"""

from copy import deepcopy

import Grasshopper
import Rhino
import System
from ghpythonlib.treehelpers import list_to_tree


def _state_with_point(start_state, point, trajectory_joint_names):
    new_state = deepcopy(start_state)
    base = new_state.robot_configuration
    if base is None:
        new_state.robot_configuration = point
        return new_state
    if not point.joint_names and trajectory_joint_names:
        point = deepcopy(point)
        point.joint_names = list(trajectory_joint_names)
    new_state.robot_configuration = base.merged(point)
    return new_state


class DeconstructTrajectory(Grasshopper.Kernel.GH_ScriptInstance):
    def RunScript(self, trajectory):
        if trajectory is None or not getattr(trajectory, "points", None):
            return ([], [], [], [], [])

        points = trajectory.points
        configurations = list(points)
        velocities = list_to_tree([p.velocities for p in points])
        accelerations = list_to_tree([p.accelerations for p in points])
        efforts = list_to_tree([p.effort for p in points])

        start_state = getattr(trajectory, "start_state", None)
        if start_state is None:
            return (configurations, [], velocities, accelerations, efforts)

        trajectory_joint_names = getattr(trajectory, "joint_names", None)
        cell_states = [_state_with_point(start_state, pt, trajectory_joint_names) for pt in points]
        return (configurations, cell_states, velocities, accelerations, efforts)
# ---------- end deconstruct_cm ----------
list_item = ListItem(List=deconstruct_cm.cell_states, Index="-1", Wrap=True)
list_item_2 = ListItem(List=deconstruct_cm.cell_states, Index=idx_pm, Wrap=True)
visualize_pm = COMPASFABVisualizeRobotCell(robot_cell=compas_fab_deconstruct_planner.robot_cell, cell_state=list_item_2)  # -> robot_meshes, tool_meshes, rigid_body_meshes, base_plane; inputs draw_visual: Boolean, draw_collision: Boolean, native_scale: Double; same code as compas_fab_visualize_robot_cell
quick_graph = QuickGraph(deconstruct_cm.velocities, SortOrder=0)
motion_end_state = Data(list_item)
trajectory = Data(compas_fab_plan_motion.trajectory)

# ---- group: Plan cartesian motion
robot_cell_6 = Data(robot_cell)
planner_6 = Data(planner)
motion_end_state_2 = Data(motion_end_state)
target_mode_4 = ValueList({"ROBOT", "TOOL", "WORKPIECE"}, selected="TOOL")
compute_cm = BooleanToggle(True)
idx_pm_2 = Slider(40, range=0..100)

# ---- group: Create example linear frames
target_mode_5 = ValueList({"ROBOT", "TOOL", "WORKPIECE"}, selected="TOOL")
compas_fab_forward_kinematics_2 = COMPASFABForwardKinematics(planner=planner_6, cell_state=motion_end_state_2, target_mode=target_mode_5)  # -> frame, plane; inputs target_mode: String, group: String; same code as compas_fab_forward_kinematics
create_planes = Python3Script(
    frame=compas_fab_forward_kinematics_2.frame,
    radius=Slider(0.38, range=0.1..2),
    angle=Slider(1.85, range=0..6.28),
    rot=Slider(1.948, range=-3.142..3.142),
    tan_aligned=Toggle(False))  # -> frames, planes
# ---------- create_planes: Python ----------
from math import radians
from compas.geometry import Frame, Point, Vector, Circle, Arc
from compas_rhino.conversions import frame_to_rhino_plane
from compas_rhino.conversions import arc_to_rhino

# Arc lies in the XY plane of the frame
center = frame.point - frame.xaxis * radius

arc = Arc(radius, 0, angle, Frame(center, frame.xaxis, frame.yaxis))
arc.rotate(angle=rot, axis=frame.zaxis, point=frame.point)
planes = arc_to_rhino(arc)

n = n or 10
points = [arc.point_at(t) for t in [i / (n - 1) for i in range(n)]]
frames = []

for t, point in zip([i / (n - 1) for i in range(n)], points):
    if tan_aligned:
        tangent = arc.tangent_at(t)
        xaxis = tangent.unitized()
        yaxis = frame.zaxis.cross(xaxis).unitized()
        frames.append(Frame(point, xaxis, yaxis))
    else:
        frames.append(Frame(point, frame.xaxis, frame.yaxis))

planes = list(map(frame_to_rhino_plane, frames))
# ---------- end create_planes ----------

# ---- group: Plan cartesian motion (continued)
frame_waypoints = COMPASFABFrameWaypoints(planes=create_planes.frames, target_mode=target_mode_4)  # -> waypoints; inputs planes: list, target_mode: String, tolerance_position: Double, tolerance_orientation: Double, native_scale: Double
#   port planes: Ordered list of Rhino planes (or COMPAS Frames) to interpolate through (in WCF).
#   port target_mode: Which frame on the robot to match: 'ROBOT' (default), 'TOOL', or 'WORKPIECE'.
#   port tolerance_position: Position tolerance in meters. If unset, the planner default is used.
#   port tolerance_orientation: Orientation tolerance in radians. If unset, the planner default is used.
#   port native_scale: Scale factor: user_value * native_scale = meters. Use 0.001 for millimeter documents. Defaults to 1.0.
#   port waypoints: FrameWaypoints.
# ---------- frame_waypoints: Python ----------
# r: compas_fab>=2
"""
Create FrameWaypoints from a list of Rhino planes (or COMPAS Frames).

Used as input to PlanCartesianMotion to interpolate linearly through a
sequence of fully-constrained poses.

COMPAS FAB v2.0.0
"""

import Grasshopper
import Rhino
import System
from compas.geometry import Frame
from compas_rhino.conversions import plane_to_compas_frame

from compas_fab.ghpython import ensure_value_list
from compas_fab.robots import FrameWaypoints
from compas_fab.robots import TargetMode

_TARGET_MODES = [mode.value for mode in TargetMode]


class FrameWaypointsComponent(Grasshopper.Kernel.GH_ScriptInstance):
    def RunScript(self,
            planes: System.Collections.Generic.List[object],
            target_mode: str,
            tolerance_position: float,
            tolerance_orientation: float,
            native_scale: float):
        ensure_value_list(ghenv.Component, "target_mode", _TARGET_MODES, default="ROBOT")  # noqa: F821

        if not planes:
            return None

        frames = []
        for plane in planes:
            if plane is None:
                continue
            frames.append(plane if isinstance(plane, Frame) else plane_to_compas_frame(plane))

        if not frames:
            return None

        mode = target_mode or "ROBOT"
        if isinstance(mode, str):
            mode = TargetMode(mode.strip().upper())

        native_scale = native_scale if native_scale else 1.0

        return FrameWaypoints(
            target_frames=frames,
            target_mode=mode,
            native_scale=native_scale,
            tolerance_position=tolerance_position,
            tolerance_orientation=tolerance_orientation,
        )
# ---------- end frame_waypoints ----------
compas_fab_plan_cartesian_motion = COMPASFABPlanCartesianMotion(planner=planner_6, waypoints=frame_waypoints, start_state=motion_end_state_2, compute=compute_cm)  # -> trajectory, fraction, planes, polyline, debug_info; inputs group: String, max_step: Double, avoid_collisions: Boolean, compute: Boolean
#   port planner: A planner that supports plan_cartesian_motion (e.g. MoveItPlanner, PyBulletPlanner, AnalyticalKinematicsPlanner).
#   port waypoints: FrameWaypoints or PointAxisWaypoints to interpolate through.
#   port start_state: Starting RobotCellState. The robot's configuration in this state is used as the seed.
#   port group: Planning group name. Defaults to the cell's main planning group.
#   port max_step: Maximum interpolation step in meters. Defaults to 0.01.
#   port avoid_collisions: If True, the planner checks for collisions along the path. Defaults to True.
#   port compute: Trigger planning. Defaults to False so the canvas does not plan on every refresh.
#   port fraction: Fraction of the requested path that was achievable (0..1).
#   port planes: List of Rhino planes — one per trajectory point — at the planning group's end-effector frame (target_mode=ROBOT). Computed via FK on the planner with the start_state's attachments preserved.
#   port polyline: Polyline connecting the plane origins in trajectory order. None when the trajectory has fewer than two points.
#   port debug_info: The failure message (including a collision diagnostic on a full failure), as a single string. Wire a panel to read it; empty on success.
# ---------- compas_fab_plan_cartesian_motion: Python ----------
# r: compas_fab>=2
"""
Plan a Cartesian (linear-in-tool-space) motion through waypoints.

Calls `planner.plan_cartesian_motion(waypoints, start_state)`. The result is
cached in sticky; toggle `compute` to (re)plan.

Any planning failure (no plan found, start/goal in collision, …) flags the
component red with the backend error message. When the backend returns a
`partial_trajectory`, the component is flagged with a warning instead and
the partial trajectory is surfaced. On a full failure the start state is
collision-checked (when the planner supports it) and a concise hint appended.
The message is also exposed on the `debug_info` output for reading in a panel.

COMPAS FAB v2.0.0
"""

import Grasshopper
import Rhino
import System
from compas_ghpython import create_id
from compas_ghpython import error as gh_error
from compas_ghpython import warning as gh_warning
from compas_rhino.conversions import frame_to_rhino_plane
from compas_rhino.conversions import polyline_to_rhino
from scriptcontext import sticky as st

from compas_fab.backends import BackendError
from compas_fab.backends import MotionPlanningError
from compas_fab.ghpython import collision_diagnostic
from compas_fab.robots import JointTrajectory


class PlanCartesianMotion(Grasshopper.Kernel.GH_ScriptInstance):
    def RunScript(self,
            planner,
            waypoints,
            start_state,
            group: str,
            max_step: float,
            avoid_collisions: bool,
            compute: bool):
        key = create_id(ghenv.Component, "trajectory")  # noqa: F821

        def _viz(trajectory : JointTrajectory):
            if trajectory is None:
                return [], None
            frames, polyline = trajectory.to_frames_and_polyline(planner.robot_cell, start_state, group or None)
            planes = [frame_to_rhino_plane(f) for f in frames]
            polyline = polyline_to_rhino(polyline) if polyline else None
            return planes, polyline

        def _diagnose(error_msg, has_trajectory):
            """Flag the component for an error and return the message shown (for debug_info)."""
            if not error_msg:
                return ""
            if has_trajectory:
                message = "Cartesian motion planning failed but a partial trajectory was returned: {}".format(error_msg)
                gh_warning(ghenv.Component, message)  # noqa: F821
            else:
                message = "Cartesian motion planning failed: {}".format(error_msg)
                gh_error(ghenv.Component, message)  # noqa: F821
            return message

        if not (planner and waypoints and start_state and compute):
            cached = st.get(key)
            if cached is None:
                return (None, None, [], None, "")
            trajectory, fraction, error_msg = cached
            debug_info = _diagnose(error_msg, trajectory is not None)
            planes, polyline = _viz(trajectory)
            return (trajectory, fraction, planes, polyline, debug_info)

        options = {}
        if max_step:
            options["max_step"] = float(max_step)
        if avoid_collisions is not None:
            options["avoid_collisions"] = bool(avoid_collisions)

        trajectory = None
        error_msg = None
        try:
            trajectory = planner.plan_cartesian_motion(
                waypoints=waypoints,
                start_state=start_state,
                group=group or None,
                options=options or None,
            )
        except MotionPlanningError as e:
            trajectory = getattr(e, "partial_trajectory", None)
            error_msg = str(e)
        except BackendError as e:
            error_msg = str(e)

        # On a full failure, append a concise collision check on the start state.
        # Cached with the error so replays don't re-query the backend.
        if error_msg and trajectory is None:
            hint = collision_diagnostic(planner, start_state, group or None)
            if hint:
                error_msg += "\n" + hint

        debug_info = _diagnose(error_msg, trajectory is not None)
        fraction = trajectory.fraction if trajectory is not None else None
        st[key] = (trajectory, fraction, error_msg)
        planes, polyline = _viz(trajectory)
        return (trajectory, fraction, planes, polyline, debug_info)
# ---------- end compas_fab_plan_cartesian_motion ----------
deconstruct_cm_2 = COMPASFABDeconstructTrajectory(trajectory=compas_fab_plan_cartesian_motion.trajectory)  # -> configurations, cell_states, velocities, accelerations, efforts; same code as deconstruct_cm
geometry_3 = Geometry(compas_fab_plan_cartesian_motion.polyline)
list_item_3 = ListItem(List=deconstruct_cm_2.cell_states, Index=idx_pm_2, Wrap=True)
visualize_pm_2 = COMPASFABVisualizeRobotCell(robot_cell=robot_cell_6, cell_state=list_item_3)  # -> robot_meshes, tool_meshes, rigid_body_meshes, base_plane; inputs draw_visual: Boolean, draw_collision: Boolean, native_scale: Double; same code as compas_fab_visualize_robot_cell
quick_graph_2 = QuickGraph(deconstruct_cm_2.velocities, SortOrder=0)
trajectory_2 = Data(compas_fab_plan_cartesian_motion.trajectory)

# ---- group: MotionPlan composition
robot_cell_7 = Data(robot_cell_6)
ik_end_state_4 = Data(ik_end_state_2)
trajectory_3 = Data(trajectory)
trajectory_4 = Data(trajectory_2)
compas_fab_trajectory_action = COMPASFABTrajectoryAction(name="free_move", trajectory=trajectory_3)  # -> action; inputs name: String, tags: String, description: String
#   port name: Unique name for this action within the chain (e.g. 'approach', 'descend', 'retract').
#   port trajectory: JointTrajectory output of a planner (Plan Motion / Plan Cartesian Motion).
#   port tags: Optional comma-separated tags driving differentiated downstream execution (e.g. 'approach, linear'). Stored on the action's attributes.
#   port description: Optional free-form human description.
#   port action: Action — wire into Cf_ActionChain's `actions` input.
# ---------- compas_fab_trajectory_action: Python ----------
# r: compas_fab>=2
"""
Wrap a JointTrajectory into a named Action, ready for Cf_ActionChain.

Use this between a planner output (Plan Motion / Plan Cartesian Motion)
and the Cf_ActionChain assembler: drop one per trajectory in the chain,
type the name next to the trajectory it labels. Optional `tags` (CSV)
drive differentiated downstream execution (e.g. approach, linear).

COMPAS FAB v2.0.0
"""


import Grasshopper
import Rhino
import System

from compas_fab.robots import Action


class TrajectoryAction(Grasshopper.Kernel.GH_ScriptInstance):
    def RunScript(self, name: str, trajectory, tags: str, description: str):
        if not name or trajectory is None:
            return None
        tag_list = [t.strip() for t in (tags or "").split(",") if t.strip()]
        return Action(
            name=name.strip(),
            trajectory=trajectory,
            tags=tag_list,
            description=(description or "").strip(),
        )
# ---------- end compas_fab_trajectory_action ----------
compas_fab_trajectory_action_2 = COMPASFABTrajectoryAction(name="place", trajectory=trajectory_4)  # -> action; inputs name: String, tags: String, description: String; same code as compas_fab_trajectory_action
merge = Merge(Data1=compas_fab_trajectory_action, Data2=compas_fab_trajectory_action_2)  # -> flatten(Result)
idx = Slider(0, range=0..150)
compas_fab_action_chain = COMPASFABActionChain(name="demo_action_chain", start_state=ik_end_state_4, actions=merge, robot_cell=robot_cell_7)  # -> chain, planes, polyline, cell_states, duration, end_state; inputs name: String, actions: list, group: String, description: String
#   port name: Chain identifier.
#   port start_state: RobotCellState the chain starts from.
#   port actions: Ordered list of Action objects, typically from Cf_TrajectoryAction and Cf_StateChangeAction components.
#   port robot_cell: Optional RobotCell. When provided, a structural signature is stored on the chain so a mismatched cell on load can be detected via verify_cell().
#   port group: Planning group name used for the FK visualisation. Defaults to the cell's main group.
#   port description: Optional free-form description of the chain.
#   port chain: The assembled ActionChain. Serialisable via to_json / to_jsonstring.
#   port planes: DataTree of Rhino planes — one branch per trajectory action, one plane per trajectory point. Flatten for a single combined list.
#   port polyline: List of Rhino polylines — one per trajectory action, through the EE origins.
#   port cell_states: Flat list of RobotCellState snapshots covering the whole chain — one per trajectory point plus one per state-change action. Pair with an index slider + VisualizeRobotCell to scrub through the entire motion.
#   port duration: Sum of trajectory durations along the realized path, in seconds. Backends that do not time their trajectories report 0.
#   port end_state: RobotCellState at the end of the realized path.
# ---------- compas_fab_action_chain: Python ----------
# r: compas_fab>=2
"""
Assemble an ActionChain from a list of Actions and emit the composite trajectory visualisation.

Wire the outputs of Cf_TrajectoryAction / Cf_StateChangeAction components
into `actions` in the order the motion should be executed. The component
threads the cell state through the chain, validates each action, and emits
the assembled chain plus composite outputs for visualisation.

`planes` is a DataTree with one branch per trajectory action (per-action
coloring / filtering work out of the box); `polyline` is a list of
polylines parallel to those branches. `cell_states` is a flat list of
RobotCellState snapshots -one per trajectory point plus one per state
change- so a single index slider + VisualizeRobotCell can scrub through
the whole chain frame by frame.

COMPAS FAB v2.0.0
"""

import Grasshopper
import Rhino
import System
from compas_ghpython import error as gh_error
from compas_rhino.conversions import frame_to_rhino_plane
from compas_rhino.conversions import polyline_to_rhino
from ghpythonlib.treehelpers import list_to_tree

from compas_fab.robots import ActionChain


class ActionChainComponent(Grasshopper.Kernel.GH_ScriptInstance):
    def RunScript(self,
            name: str,
            start_state,
            actions: System.Collections.Generic.List[object],
            robot_cell,
            group: str,
            description: str):
        if not name or start_state is None or not actions:
            return (None, [], None, [], 0.0, start_state)

        try:
            chain = ActionChain(
                name=name.strip(),
                start_state=start_state,
                robot_cell=robot_cell,
                description=(description or "").strip(),
            )
            for action in actions:
                if action is None:
                    continue
                chain.append_action(action)
        except ValueError as e:
            gh_error(ghenv.Component, "Chain assembly failed: {}".format(e))  # noqa: F821
            return (None, [], None, [], 0.0, start_state)

        cell_states = list(chain.iter_cell_states())

        if robot_cell is None:
            return (chain, [], None, cell_states, chain.duration, chain.end_state)

        # Composite visualisation: one branch per trajectory action. Walk the
        # chain so each action's FK uses the correct pre-state.
        planes_per_action = []
        polylines_per_action = []
        running_state = chain.start_state
        for action in chain:
            if not action.is_trajectory:
                running_state = action.post_state
                continue

            frames, polyline = action.trajectory.to_frames_and_polyline(robot_cell, running_state, group or None)
            planes = [frame_to_rhino_plane(f) for f in frames]
            polyline = polyline_to_rhino(polyline) if polyline else None

            planes_per_action.append(planes)
            polylines_per_action.append(polyline)
            running_state = action.post_state

        planes_tree = list_to_tree(planes_per_action) if planes_per_action else []
        return (chain, planes_tree, polylines_per_action or None, cell_states, chain.duration, chain.end_state)
# ---------- end compas_fab_action_chain ----------
list_item_4 = ListItem(List=compas_fab_action_chain.cell_states, Index=idx, Wrap=True)
visualize_pm_3 = COMPASFABVisualizeRobotCell(robot_cell=robot_cell_7, cell_state=list_item_4)  # -> robot_meshes, tool_meshes, rigid_body_meshes, base_plane; inputs draw_visual: Boolean, draw_collision: Boolean, native_scale: Double; same code as compas_fab_visualize_robot_cell
action_chain = Data(compas_fab_action_chain.chain)
