# Grasshopper definition e01_listener_topic_chatter_roslibpy.gh (Grasshopper 1.0.7)

unload_roslibpy = Button()
reset_loggers = Button()
disconnect = Button()
connect = Button()
path = FilePath("C:\Users\kathrind\workspace\projects\augmented_bricks\log\debug.log")

unload_compas = Button()
unload = GhPythonScript(unload_compas=unload_compas, unload_roslibpy=unload_roslibpy, reset_loggers=reset_loggers, log_path=path)  # -> out, a
# ---------- unload: Python ----------
__author__ = "kathrind"
__version__ = "2018.07.20"

from compas_ghpython.utilities import unload_modules

if unload_compas:
    unload_modules("compas")
    unload_modules("compas_fab")
    
if unload_compas:
    unload_modules("roslibpy")


import logging

formatter = logging.Formatter('[%(thread)03d] [%(asctime)s] %(message)s')
LOGGER = logging.getLogger('roslibpy')
LOGGER.setLevel(logging.DEBUG)

if reset_loggers:
    print('Removing all logging handlers')
    while LOGGER.handlers:
        LOGGER.handlers.pop()

if not LOGGER.handlers:
    print('Updating logging handlers')
    ch = logging.StreamHandler()
    ch.setLevel(logging.DEBUG)
    ch.setFormatter(formatter)
    LOGGER.addHandler(ch)

    fh = logging.FileHandler(log_path)
    fh.setLevel(logging.DEBUG)
    fh.setFormatter(formatter)
    LOGGER.addHandler(fh)

    LOGGER.propagate = False
# ---------- end unload ----------

ros = PythonScript(restart=Button())  # -> ros_client
# ---------- ros: Python ----------
import time
import logging
import scriptcontext as sc

from roslibpy import Ros
from System import TimeSpan
from System.Threading import ManualResetEventSlim

LOGGER = logging.getLogger('roslibpy')

key = 'rosclient_%s' % str(ghenv.Component.InstanceGuid)
previous_client = sc.sticky.get(key, None)
if previous_client:
    previous_client.terminate()

ros_client = Ros('127.0.0.1', 9090)
sc.sticky[key] = ros_client

waitLock = ManualResetEventSlim(False)

ros_client.on_ready(lambda: waitLock.Set())

if not waitLock.Wait(TimeSpan.FromSeconds(5)):
    raise Exception('Unable to connect to ROS')

LOGGER.info('ROS connection opened')
# ---------- end ros ----------
switch = PythonScript(ros_client=ros, connect=connect, disconnect=disconnect)  # -> out, ros_client
# ---------- switch: Python ----------
import logging
from System import TimeSpan
from System.Threading import ManualResetEventSlim

LOGGER = logging.getLogger('roslibpy')

if connect:
    if not ros_client.is_connected:
        LOGGER.debug('Connecting...')
        waitLock = ManualResetEventSlim(False)
        ros_client.on_ready(lambda: waitLock.Set())
        ros_client.connect()

        if not waitLock.Wait(TimeSpan.FromSeconds(5)):
            raise Exception('Unable to connect to ROS')
        LOGGER.debug('Reconnected')

if disconnect:
    if ros_client.is_connected:
        ros_client.terminate()
        LOGGER.debug('Terminated')
# ---------- end switch ----------
start_timer = Button()
stop_timer = Button()
subscribe = PythonScript(ros_client=switch.ros_client)  # -> out
# ---------- subscribe: Python ----------
import time
import logging
import datetime
import Grasshopper
from roslibpy import Topic
import scriptcontext as sc

LOGGER = logging.getLogger('roslibpy')
data = dict(requesting_solution=False)

def expire(grasshopper_doc):
    grasshopper_doc = ghenv.Component.OnPingDocument()
    if grasshopper_doc.SolutionState != Grasshopper.Kernel.GH_ProcessStep.Process:
        data['requesting_solution'] = True
        ghenv.Component.ExpireSolution(False)
        data['requesting_solution'] = False

def receive_message(message):
    sc.sticky['message'] = str(datetime.datetime.now()) + ': ' + str(message)

if ros_client:
    key = 'listener_%s' % str(ghenv.Component.InstanceGuid)
    if ros_client.is_connected:
        needs_subscribe = True

        previous_listener = sc.sticky.get(key, None)
        
        if previous_listener and previous_listener.is_subscribed:
            if previous_listener.ros != ros_client:
                LOGGER.debug('Previous subscription linked to different ROS client, will terminate.')
                previous_listener.ros.terminate()
                sc.sticky[key] = None
            else:
                needs_subscribe = False

        LOGGER.info('Needs subscribing? ' + str(needs_subscribe))

        if needs_subscribe:
            LOGGER.debug('Subscribing...')
            try:
                listener = Topic(ros_client, '/chatter', 'std_msgs/String')
                sc.sticky[key] = listener
    
                def start_receiving():
                    LOGGER.debug('Listening...')
                    listener.subscribe(receive_message)
            
                ros_client.on_ready(start_receiving)
            except Exception as e:
                LOGGER.error('error')
                LOGGER.error(e)
    else:
        LOGGER.debug('Not connected')
else:
    LOGGER.debug('No ROS client found')
# ---------- end subscribe ----------
python = GhPythonScript(start_timer=start_timer, stop_timer=stop_timer)  # -> out, a
# ---------- python: Python ----------
import scriptcontext as sc
from compas_fab.fab.grasshopper.utilities import update_component


guid = str(ghenv.Component.InstanceGuid)
timer_running_key = "timer_running_" + guid


if stop_timer or timer_running_key not in sc.sticky:
    sc.sticky[timer_running_key] = False

if start_timer:
    sc.sticky[timer_running_key] = True

if sc.sticky[timer_running_key]:
    update_component(ghenv, 1000)

if 'message' in sc.sticky:
    print sc.sticky['message']
# ---------- end python ----------
panel = Panel(subscribe)
subscribe_selfupdate = PythonScript()  # -> out, topics; disabled
# ---------- subscribe_selfupdate: Python ----------
import time
import logging
import datetime
import Grasshopper
from roslibpy import Topic
import scriptcontext as sc

LOGGER = logging.getLogger('roslibpy')
data = dict(requesting_solution=False)

def expire(grasshopper_doc):
    grasshopper_doc = ghenv.Component.OnPingDocument()
    if grasshopper_doc.SolutionState != Grasshopper.Kernel.GH_ProcessStep.Process:
        data['requesting_solution'] = True
        ghenv.Component.ExpireSolution(False)
        data['requesting_solution'] = False

def receive_message(message):
    sc.sticky['message'] = str(datetime.datetime.now()) + ': ' + str(message)
    #print(message)
    #data['message'] = str(datetime.datetime.now()) + ': ' + str(message)  
#    ghenv.DataAccessManager.SetData(1, data['message'])
#    time.sleep(1.0)
#    grasshopper_doc = ghenv.Component.OnPingDocument()
#    if grasshopper_doc.SolutionState != Grasshopper.Kernel.GH_ProcessStep.Process and data['requesting_solution'] == False:
#        grasshopper_doc.ScheduleSolution(1, grasshopper_doc.GH_ScheduleDelegate(expire))

if ros_client:
    key = 'listener_%s' % str(ghenv.Component.InstanceGuid)
    if ros_client.is_connected:
        needs_subscribe = True

        previous_listener = sc.sticky.get(key, None)
        
        if previous_listener and previous_listener.is_subscribed:
            if previous_listener.ros != ros_client:
                LOGGER.debug('Previous subscription linked to different ROS client, will terminate.')
#                previous_listener.unsubscribe(receive_message)
                previous_listener.ros.terminate()
                sc.sticky[key] = None
            else:
                needs_subscribe = False

        LOGGER.info('Needs subscribing? ' + str(needs_subscribe))

        if needs_subscribe:
            LOGGER.debug('Subscribing...')
            try:
                listener = Topic(ros_client, '/chatter', 'std_msgs/String')
                sc.sticky[key] = listener
    
                def start_receiving():
                    LOGGER.debug('Listening...')
                    listener.subscribe(receive_message)
            
                ros_client.on_ready(start_receiving)
            except Exception as e:
                LOGGER.error('error')
                LOGGER.error(e)
    else:
        LOGGER.debug('Not connected')
else:
    LOGGER.debug('No ROS client found')
# ---------- end subscribe_selfupdate ----------
panel_2 = Panel(python.out)
panel_3 = Panel(subscribe_selfupdate.out)
