# Grasshopper definition grasshopper-path-planner.ghx (Grasshopper 0.9.76)
# plug-ins: Python Interpreter

# ----
# Algorithm
# Resolution (relative to space's extent)
# Metric (1=blocked joint)
# Only search one possible config
number_slider = Slider(0.02, range=0..0.5)
quick_shallow_state_search = BooleanToggle(True)
list = ValueList({"bitrrt", "bkpiece1", "est", "kpiece1", "lazyprmstar", "lbkpiece1", "lbtrrt", "pdst", "prm", "prrt", "rrt", "rrtconnect", "rrtstar", "sbl", "stride", "trrt"}, selected="rrtconnect")

building_member = Mesh(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)
collision_meshes = Mesh(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)
gripping_plane = Plane(Plane(origin=(7852.514188, 9288.12028, 1500), x=(1, 0, 0), y=(0, -1, 0)))
list_2 = ValueList({"Robot 11": 11, "Robot 12": 12, "Robot 21": 21, "Robot 22": 22}, selected="Robot 12")
goal_plane = Plane(Plane(origin=(12037.16057, 7811.497132, 2000), x=(0, -1, 0), y=(-0.02117759615, 0, -0.9997757296)))

# ----
# Basic config
trigger = BooleanToggle(True)
path_planning = PythonScript(
    trigger=trigger,
    selected_robot=list_2,
    gripping_plane_or_config=gripping_plane,
    goal_plane_or_pose=goal_plane,
    building_member=building_member,
    collision_meshes=collision_meshes,
    algorithm=list,
    resolution=number_slider,
    metric="0.1,0.1,0.1,0.1,0.1,0.1,0.1,0.1,0.1",
    shallow_state_search=quick_shallow_state_search)  # -> out, path, a; inputs collision_meshes: list
# ---------- path_planning: Python ----------
import logging
from compas_fabrication.fabrication.robots import Pose
from compas_fabrication.fabrication.robots.rfl import *
from compas_fabrication.fabrication.grasshopper import *
from compas_fabrication.fabrication.grasshopper.path_planning import InputParameterParser, PathPlanner

logging.basicConfig(level=logging.DEBUG)
LOG = logging.getLogger()

if trigger:
    options = {
            'debug': True,
            'trials': 1,
            'shallow_state_search': shallow_state_search,
            'algorithm': algorithm or 'rrtconnect',
            'resolution': resolution or 0.02,
            'collision_meshes': collision_meshes,
            'robots': [
                {
                    'robot': selected_robot,
                    'start': gripping_plane_or_config,
                    'goal': goal_plane_or_pose,
                    'building_member': building_member,
                    'metric_values': metric or [0.1]*9,
                    'joint_limits': {
                        'gantry': [
                            [0, 40000],
                            [-12000, 0],
                            [-4600, -1000]
                        ],
                        'arm': [
                            [-180, 180],
                            [-90, 150],
                            [-180, 75],
                            [-400, 400],
                            [-125, 120],
                            [-400, 400]
                        ]
                    }
                }
            ]
        }

    path = PathPlanner.find_path(**options)
# ---------- end path_planning ----------

# ----
# Additional configuration
# Debug info
# All components in this group are optional and can be deleted
panel = Panel(path_planning.out)

visualization = PythonScript(frame=Slider(100, range=0..100), selected_robot=list_2, building_member=building_member, path=path_planning.path)  # -> out, a; inputs frame: Int32, path: list
# ---------- visualization: Python ----------
import logging
import scriptcontext as sc

from compas_fabrication.fabrication.robots.rfl import Simulator, Robot
from compas_fabrication.fabrication.grasshopper.path_planning import PathVisualizer, InputParameterParser

LOG = logging.getLogger()
path = InputParameterParser().compact_list(path)

#if "rfl_meshes" in sc.sticky:
#    del sc.sticky["rfl_meshes"]

if path:
    with Simulator(debug=True) as simulator:
        frame_index = ((len(path) - 1) * frame) // 100
        LOG.debug('Rendering frame %d out of %d', frame_index + 1, len(path))
        
        robot = Robot(selected_robot, client=simulator)
        visualizer = PathVisualizer(simulator, robot, building_member)
        a = visualizer.get_frame_meshes(path, frame_index, sc.sticky)
# ---------- end visualization ----------
