# Grasshopper definition robot.ghx (Grasshopper 0.9.76)
# plug-ins: Python Interpreter

# Settings
reload = Button()

# ---- group: Robot
# 1. Set the robot model
# 2. Set tool
# 3. Set the base
panel = Panel("C:\Users\rustr\workspace\robot_description\")
list = ValueList({"ur3", "ur5", "ur10", "abb", "staubli"}, selected="ur5")
py = PythonScript(path=panel, robot_name=list)  # -> path
# ---------- py: Python ----------
import os

path = os.path.join(os.path.abspath(path), robot_name)

assert(os.path.isdir(path))
# ---------- end py ----------
create = Button()
create_2 = PythonScript(path=py, create=create)  # -> robot
# ---------- create_2: Python ----------
from scriptcontext import sticky as st

from compas_fab.fab.robots import Robot

from compas_ghpython import mesh_draw
from compas_ghpython.geometry import xform_from_transformation

# store data in component
guid = str(ghenv.Component.InstanceGuid)
robot_key = "robot_" + guid

class Mesh(object):

    def __init__(self, mesh):
        self.mesh = mesh_draw(mesh)

    def transform(self, transformation):
        T = xform_from_transformation(transformation)
        self.mesh.Transform(T)
    
    def draw(self):
        return self.mesh

if create:
    st[robot_key] = Robot(path)
    st[robot_key].create(Mesh)

robot = st[robot_key]
# ---------- end create_2 ----------
robot = Data(create_2)

# ----
py_2 = PythonScript(reload=reload)
# ---------- py_2: Python ----------
from compas_rhino.utilities.misc import get_tolerance
from compas_rhino.utilities.misc import unload_modules

from compas_ghpython import unload_modules
unload_modules("compas")
# ---------- end py_2 ----------

# ----
# TODO
# 2. Set tool
# 3. Set the base
list_2 = ValueList({"no_tool": 0, "measurement_tool": 1, "gripper": 2}, selected="gripper")
tools = Tools(tool_id=list_2)
base = PythonScript()  # -> base_frame
# ---------- base: Python ----------
from compas_fab.fab.geometry import Frame

"""
origin = [-478.32, -214.49, -194.35]
xaxis = [0.00832, 0.99996, -0.00275]
yaxis = [-0.99990, 0.00835, 0.01182]

"""
origin = [0, 0, 0]
xaxis = [1, 0, 0]
yaxis = [0, 1, 0]

base_frame = Frame(list(origin), list(xaxis), list(yaxis))
# ---------- end base ----------

python = PythonScript(robot=create_2)  # -> out, M, F, L, C
# ---------- python: Python ----------
import Rhino.Geometry as rg
from System.Drawing import Color

M = []
F = []

for link in robot.model.iter_links():
    #for item in link.collision:
    #    m = item.geometry.shape.geometry
    #    if m:
    #        M.append(m.mesh)
        
    for item in link.visual:
        m = item.geometry.shape.geometry
        M.append(m.mesh)
    
    for cjoint in link.joints:
        print cjoint.type
        if cjoint.type == "revolute":
            F.append(cjoint.origin)
        print cjoint.origin
        print



def draw_frame(frame, scale=100):
    pl = rg.Plane(rg.Point3d(*list(frame.point)), rg.Vector3d(*list(frame.xaxis)), rg.Vector3d(*list(frame.yaxis)))
    x = rg.Line(pl.Origin, pl.XAxis * scale)
    y = rg.Line(pl.Origin, pl.YAxis * scale)
    z = rg.Line(pl.Origin, pl.ZAxis * scale)
    r = Color.FromArgb(255, 0, 0)
    g = Color.FromArgb(0, 255, 0)
    b = Color.FromArgb(0, 0, 255)
    return [x, y, z], [r, g, b]
    



L = []
C = []
for f in F:
    l, c = draw_frame(f)
    L += l
    C += c


import rhinoscriptsyntax as rs

"""
ExtractDuplicateMeshFaces
ExtractNonManifoldMeshEdges
CullDegenerateMeshFaces
UnifyMeshNormals
"""
# ---------- end python ----------
forward = PythonScript(
    robot=create_2,
    s1=Slider(106, range=-180..180),
    s2=Slider(-90, range=-180..180),
    s3=Slider(75, range=-180..180),
    s4=Slider(-47, range=-180..180),
    s5=Slider(30, range=-180..180),
    s6=Slider(-63, range=-180..180))  # -> out, init_transformations, robot, Ax, L, C, current_transformations
# ---------- forward: Python ----------
from compas.geometry.xforms import Rotation
from compas.geometry.xforms import Transformation
import Rhino.Geometry as rg
from System.Drawing import Color
import math


joint_state_positions = [math.radians(s) for s in [s1, s2, s3, s4, s5, s6]]

print joint_state_positions

"""
'error_code': {'val': 1}, 
'solution': {'is_diff': False, 
    'attached_collision_objects': [], 
    'multi_dof_joint_state': {
        'twist': [], 
        'header': {'stamp': {'secs': 0, 'nsecs': 0}, 'frame_id': '/world', 'seq': 0}, 
        'joint_names': [], 
        'transforms': [], 
        'wrench': []}, 
    'joint_state': {
        'header': {'stamp': {'secs': 0, 'nsecs': 0}, 'frame_id': '/world', 'seq': 0}, 
        'velocity': [], 
        'effort': [], 
        'name': ['shoulder_pan_joint', 'shoulder_lift_joint', 'elbow_joint', 'wrist_1_joint', 'wrist_2_joint', 'wrist_3_joint'], 
        'position': [6.254248742364907, -0.06779616254839081, 4.497665741209763, -4.429869574230193, -4.741325546996638, 3.1415926363120015]}}}
"""

joint_names = ['shoulder_pan_joint', 'shoulder_lift_joint', 'elbow_joint', 'wrist_1_joint', 'wrist_2_joint', 'wrist_3_joint']
joint_positions = [6.254248742364907, -0.06779616254839081, 4.497665741209763, -4.429869574230193, -4.741325546996638, 3.1415926363120015]
joint_positions = [6.254248737006559, -5.874885906732766, 4.110686942268209, -1.3773936859827733, -1.5418597546004678, -6.2831853]
#joint_positions = [-0.02196519084805111, 6.25176050551736, 4.7198796389652555, -4.688454833713309, -4.734354173027651, -3.141592653589375]
#joint_positions = [6.254248742364907, 0, 0, 0, 0, 0]
joint_positions = joint_state_positions

joint_state = {}
for k,v in zip(joint_names, joint_positions):
    joint_state[k] = v

"""
def calculate_transformations():
    
    q0, q1, q2, q3, q4, q5 = configuration.joint_values
    j0, j1, j2, j3, j4, j5 = self.j0, self.j1, self.j2, self.j3, self.j4, self.j5

    T0 = Rotation.from_axis_and_angle(subtract_vectors(j0[1], j0[0]), q0, j0[1])
    j1 = transform_xyz(j1, T0)
    T1 = Rotation.from_axis_and_angle(subtract_vectors(j1[1], j1[0]), q1, j1[1]) * T0
    j2 = transform_xyz(j2, T1)
    T2 = Rotation.from_axis_and_angle(subtract_vectors(j2[1], j2[0]), q2, j2[1]) * T1
    j3 = transform_xyz(j3, T2)
    T3 = Rotation.from_axis_and_angle(subtract_vectors(j3[1], j3[0]), q3, j3[1]) * T2
    j4 = transform_xyz(j4, T3)
    T4 = Rotation.from_axis_and_angle(subtract_vectors(j4[1], j4[0]), q4, j4[1]) * T3
    j5 = transform_xyz(j5, T4)
    T5 = Rotation.from_axis_and_angle(subtract_vectors(j5[1], j5[0]), q5, j5[1]) * T4
"""

"""
for link in robot.model.iter_links():
    for item in link.visual:
        print item.geometry.shape.current_transformation
"""

"""
init_transformations = {}
for link in robot.model.iter_links():
    print("*****")
    print link.init_transformation
    for joint in link.joints:
        T = Transformation.from_frame(joint.origin)
        for item in joint.childlink.visual:
            init_transformations[joint.childlink.name] = T
            item.geometry.shape.current_transformation = T
            
print("===============")
for link in robot.model.iter_links():
    for item in link.visual:
        print item.geometry.shape.current_transformation
"""

"""
"""

"""
def update_origins(link, joint_names, joint_positions, parent_transformation=None):
    for joint in link.joints:
        #print joint.name
        if joint.name in joint_names:
            #print "\t", joint.name
            #print "\t", joint.type
            if joint.type == "revolute":
                idx = joint_names.index(joint.name)
                angle = joint_positions[idx]
                T = Rotation.from_axis_and_angle(joint.axis.vector, angle, joint.origin.point)
                if parent_transformation:
                    T = parent_transformation * T
                joint.origin.update(T)
                print joint.origin
            else:
                if parent_transformation:
                    joint.origin.update(parent_transformation)
        else:
            if parent_transformation:
                joint.origin.update(parent_transformation)
        
        update_origins(joint.childlink, joint_names, joint_positions, T)
        update_origins(joint.childlink, joint_names, joint_positions, parent_transformation)
        update_origins(joint.childlink, joint_names, joint_positions, parent_transformation)
"""

print ">>>>>>>>>>>>>>>>>>>>>>>>>>>>>>>>>>>>>>>"
#robot.reset_transformations()
print ">>>>>>>>>>>>>>>>>>>>>>>>>>>>>>>>>>>>>>>"
robot.update(joint_state)
print ">>>>>>>>>>>>>>>>>>>>>>>>>>>>>>>>>>>>>>>"

"""

current_transformations = {}
for link in robot.model.iter_links():
    for joint in link.joints:
        T = Transformation.from_frame(joint.origin)
        for item in joint.childlink.visual:
            current_transformations[joint.childlink.name] = T
"""


#update_origins(robot.model.root, joint_names, joint_positions)

"""
for link in robot.model.iter_links():
    print link.name
    for joint in link.joints:
        if joint.name in joint_names:
            print "\t", joint.name
            print "\t", joint.type
            if joint.type == "revolute":
            idx = joint_names.index(joint.name)
            angle = joint_positions[idx]
            T = Rotation.from_axis_and_angle(joint.axis.vector, angle, joint.origin.point)
            
            print joint.origin.transformed(T)
            #print joint.axis.transformed(T)
            # apply transformation to all children
            #for 
            # apply this transformation to the >> origin frame
            # >> to the axis
            # >> to the geometry
            
"""

"""
print "==================================="
axes = {}
meshes = {}

def find_parent_link(model, name):
    for link in model.links:
        #print link.name
        if link.name == str(name):
            return link 

for joint in robot.model.iter_joints():
    
    print joint.parent
    print ">>", joint.childlink.name
    parent_link = find_parent_link(robot.model, joint.parent)
    
    if joint.axis:
        print joint.name
        print joint.axis
        #print joint.origin.transformation 
        #joint.axis.transform(joint.origin.transformation)
        #joint.axis.transform(joint.childlink.joints[0].origin.transformation)
        print joint.axis
        axes[joint.name] = joint.axis
        #meshes[joint.name] = parent_link.visual[0].geometry.shape.geometry.mesh
        meshes[joint.name] = joint.childlink.visual[0].geometry.shape.geometry.mesh
    print
    #print joint.__dict__
    
    #for item in link.visual:
    #    m = item.geometry.shape.geometry
    #    M.append(m.mesh)

"""
F = []

print "==================================="

for link in robot.model.iter_links():
    
    
    for cjoint in link.joints:
        #print cjoint.type
        if cjoint.type == "revolute":
            F.append(cjoint.origin)
        if cjoint.type == "fixed":
            F.append(cjoint.origin)
        #print cjoint.name
        #print cjoint.origin.point + cjoint.origin.quaternion
        print



def draw_frame(frame, scale=100):
    #print frame.point
    #print frame.xaxis
    #print frame.yaxis
    pl = rg.Plane(rg.Point3d(*frame.point), rg.Vector3d(*list(frame.xaxis)), rg.Vector3d(*list(frame.yaxis)))
    x = rg.Line(pl.Origin, pl.XAxis * scale)
    y = rg.Line(pl.Origin, pl.YAxis * scale)
    z = rg.Line(pl.Origin, pl.ZAxis * scale)
    r = Color.FromArgb(255, 0, 0)
    g = Color.FromArgb(0, 255, 0)
    b = Color.FromArgb(0, 0, 255)
    return [x, y, z], [r, g, b]


L = []
C = []
for f in F:
    print f
    l, c = draw_frame(f)
    L += l
    C += c
    
current_transformations = [current_transformations]
init_transformations = [init_transformations]
# ---------- end forward ----------
pipe = Pipe(Curve=python.L, Radius=1, Caps=0)  # -> flatten(Pipe)
preview = CustomPreview(Geometry=pipe, Shader=python.C)
preview_2 = CustomPreview(Geometry=python.M, Shader=ColourSwatch(SwatchColor=RGBA(38, 252, 0, 139)))
pt = Point(Point(591.9704478, 191.2843799, 202.3792074))
python_2 = PythonScript(robot=forward.robot)  # -> out, a; disabled
# ---------- python_2: Python ----------
for link in robot.model.iter_links():
    print("*****")
    print link.init_transformation
    print link.__dict__
# ---------- end python_2 ----------
pln = Plane(pt)
panel_2 = Panel(forward.Ax)
pipe_2 = Pipe(Curve=forward.L, Radius=1, Caps=0)  # -> flatten(Pipe)
python_3 = PythonScript(robot=robot)  # -> visual, collision
# ---------- python_3: Python ----------
visual = robot.draw_visual()
collision = robot.draw_collision()
# ---------- end python_3 ----------
preview_3 = CustomPreview(Geometry=pipe_2, Shader=forward.C)
# Visualisation
# Select the input for the visualisation of the robot:
# 
# 0: forward, from angles
# 1: inverse, from one plane
# 2: inverse, from multiple planes
# 3: forward, from robot
geo = Geometry(python_3.visual)
geo_2 = Geometry(python_3.collision)
python_4 = PythonScript()  # -> out, M
# ---------- python_4: Python ----------
from compas.robots import Robot
from compas.datastructures.mesh import Mesh
from compas_fab import get_data
import os

from compas_ghpython import unload_modules

unload_modules("compas")

from compas_ghpython import mesh_draw
from compas.geometry.xforms import Transformation
from compas.geometry import Frame

from compas_ghpython.geometry import xtransform


class IndustrialRobot(Robot):
    """Represents an the base class for all robots.

    Communication with the actual robot is delegated via the `client` instance
    passed when initializing the robot.

    Args:
        client (:obj:`object`): A client to execute the commands such as 
            :class:`ros_client`.

    
    https://github.com/ros-visualization/rviz/blob/melodic-devel/src/rviz/robot/robot.cpp

    http://wiki.ros.org/urdf/Tutorials/Parse%20a%20urdf%20file
    """

    mesh_draw_func = None
    mesh_transform_func = None

    def __init__(self, client = None):
        self.client = client
        if client:
            # get urdf from robot description parameter server
            def func(text):
                self = super(IndustrialRobot, self).from_urdf_string(text)
            param = roslibpy.Param(self.ros_client, '/robot_description')
            param.get(func)
        else:
            self = super(IndustrialRobot, self).__init__(None)
    
    @classmethod
    def from_urdf_file(cls, file, client = None):
        urdf_robot = super(IndustrialRobot, cls).from_urdf_file(file)
        robot = cls(client)
        robot.name = urdf_robot.name
        robot.links = urdf_robot.links
        robot.joints = urdf_robot.joints
        return robot
    
    def get_root_link(self):
        """Returns the robot's root link.
        """
        root_link = None

        for link in self.links:
            found = False
            # search the link, which is never child for a joint
            for joint in self.joints:
                if str(joint.child) == link.name:
                    found = True
            if not found:
                root_link = link
                break
        if not root_link:
            raise Exception("Root link not found. Something wrong with URDF?")
        return root_link

   
    def get_child_joint(self, link):
        for joint in self.joints:
            if str(joint.parent) == link.name:
                return joint
    
    def get_child_link(self, joint):
        for link in self.links:
            if link.name == joint.child.link:
                return link
    
    def joint_set_transforms(self, visual, v_position, v_orientation):
        # parent_link_position, parent_link_orientation
        position = parent_link_position + parent_link_orientation * joint_origin_pos_
        orientation = parent_link_orientation * joint_origin_rot_
        
        #position_property_->setVector( position );
        #orientation_property_->setQuaternion( orientation );
        #if ( axis_ )
        #    axis_->setPosition( position );
        #    axis_->setOrientation( orientation );
        #    axis_->setDirection( parent_link_orientation * axis_property_->getVector() );
    
    def link_set_transforms(self, visual, v_position, v_orientation, collision, c_position, c_orientation):
        pass

        
    def load(self, mesh_draw_func = None, mesh_transform_func = None):
        
        self.mesh_draw_func = mesh_draw_func
        self.mesh_transform_func = mesh_transform_func

        # 1. search root link
        root_link = self.get_root_link()
        next_link = root_link

        meshes = []
        count = 0
        while next_link:
            next_joint = self.get_child_joint(next_link)
            if not next_joint:
                break
            next_link = self.get_child_link(next_joint)

            print(next_joint.name)
            print(next_link.name)

            print(next_joint.origin)
            if next_joint.axis:
                axis = [next_joint.axis.x, next_joint.axis.y, next_joint.axis.z]
            print(next_link.visual)
            print("=")
            link = next_link
            if len(link.visual):
                package_filename = link.visual[0].geometry.shape.filename
                filename = package_filename[len("package://"):]
                filename = get_data(filename)
                if not os.path.isfile(filename):
                    raise FileNotFoundError("No such file: '%s'" % filename)
                extension = filename[(filename.rfind(".") + 1):]
                if extension == "dae": # no dae support yet
                    #mesh = Mesh.from_dae(filename)
                    obj_filename = filename.replace(".dae", ".obj")
                    if os.path.isfile(obj_filename):
                        mesh = Mesh.from_obj(obj_filename)
                    else:
                        raise FileNotFoundError("No such file: '%s'" % filename)
                elif extension == "obj":
                    mesh = Mesh.from_obj(filename)
                elif extension == "stl":
                    mesh = Mesh.from_stl(filename)
                else:
                    raise ValueError("%s file types not yet supported" % 
                        extension.upper())
                #print(link.visual[0].geometry.shape.scale)
                
                if self.mesh_draw_func:
                    mesh = self.mesh_draw_func(mesh)
                    meshes.append(mesh)
                count +=1
                    
                #print(link.visual[0].geometry.shape.scale)
            if count == 7:
                break
        return meshes
    
    @property
    def dof(self):
        return len(self.links)
        
        
 
 
ur5 = IndustrialRobot.from_urdf_file(r"C:\Users\rustr\Desktop\tmp\ur5.urdf.xml")
M = ur5.load(mesh_draw, xtransform)
# ---------- end python_4 ----------
item = ListItem(List=python_4.M, Index=2, Wrap=True)
mesh = Mesh([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])
python_5 = PythonScript(meshes=mesh)  # -> out, m0, m1, m2, m3, m4, m5, m6, L, C; inputs meshes: list
# ---------- python_5: Python ----------
from compas.geometry.xforms import Transformation
from compas.geometry.xforms import Translation
from compas.geometry.xforms import Rotation
from compas.geometry import Frame, add_vectors, Point
from compas_ghpython.geometry import xtransform

import Rhino.Geometry as rg
from System.Drawing import Color

import math

m0, m1, m2, m3, m4, m5, m6 = meshes

def calculate_frame_and_transform(pos_parent, rot_parent, pos, rot, mesh = None):
    
    
    rotated_point = Point(*pos)
    rotated_point.transform(rot_parent.matrix)
    pos = add_vectors(pos_parent, rotated_point)
    
    #pos = add_vectors(pos_parent, rot_parent.transform_point(pos))
    rot = rot_parent * rot
    
    f = Frame.from_rotation(rot)
    f.point = pos
    
    
    
    fx = Frame(f.point, f.xaxis, f.zaxis)
    Tx = Transformation.from_frame(fx)
    
    
    
    print f
    #print fx
    #print "============"
    
    if mesh:
        mesh_cp = mesh.Duplicate()
        xtransform(mesh_cp, Tx)
        #return f, xtransform(mesh, Tx, copy=True)
        return f, mesh_cp
    else:
        return f

"""
createEntityForGeometryElement( link, *visual->geometry, visual->origin, visual_node_, visual_mesh );
          if( visual_mesh )
"""

pos0 = [0,0,0]
rot0 = Rotation.from_euler_angles([0, 0, 0])
f0 = Frame.from_rotation(rot0)
f0.point = pos0

"""
<link name="base"/>
  <joint name="base_link-base_fixed_joint" type="fixed">
    <origin rpy="0 0 -3.14159265" xyz="0 0 0"/>
    <parent link="base_link"/>
    <child link="base"/>
  </joint>
"""

pos0x = [0.0, 0.0, 0]
rot0x = Rotation.from_euler_angles([0, 0, -3.14159265])
f0x, m0 = calculate_frame_and_transform(f0.point, Rotation.from_frame(f0), pos0x, rot0x, m0)

# for m1, R1, T1
# <joint name="shoulder_pan_joint" type="revolute">
#    <parent link="base_link"/>
#    <child link="shoulder_link"/>
#    <origin rpy="0.0 0.0 0.0" xyz="0.0 0.0 0.089159"/>
#    <axis xyz="0 0 1"/>

pos1 = [0.0, 0.0, 0.089159 * 1000]
rot1 = Rotation.from_euler_angles([0.0, 0, 0.0])
f1, m1 = calculate_frame_and_transform(f0.point, Rotation.from_frame(f0), pos1, rot1, m1)

# <joint name="shoulder_lift_joint" type="revolute">
#    <parent link="shoulder_link"/>
#    <child link="upper_arm_link"/>
#    <origin rpy="0.0 1.570796325 0.0" xyz="0.0 0.13585 0.0"/>
#    <axis xyz="0 1 0"/>

pos2 = [0.0, 0.13585 * 1000, 0.0]
rot2 = Rotation.from_euler_angles([0.0, 1.570796325, 0.0])
f2, m2 = calculate_frame_and_transform(f1.point, Rotation.from_frame(f1), pos2, rot2, m2)

"""
<joint name="elbow_joint" type="revolute">
    <parent link="upper_arm_link"/>
    <child link="forearm_link"/>
    <origin rpy="0.0 0.0 0.0" xyz="0.0 -0.1197 0.425"/>
    <axis xyz="0 1 0"/>
  </joint>
"""

pos3 = [0.0, -0.1197 * 1000, 0.425 * 1000]
rot3 = Rotation.from_euler_angles([0.0, 0.0, 0.0])
f3, m3 = calculate_frame_and_transform(f2.point, Rotation.from_frame(f2), pos3, rot3, m3)

"""
<joint name="wrist_1_joint" type="revolute">
    <parent link="forearm_link"/>
    <child link="wrist_1_link"/>
    <origin rpy="0.0 1.570796325 0.0" xyz="0.0 0.0 0.39225"/>
    <axis xyz="0 1 0"/>
    <limit effort="28.0" lower="-6.2831853" upper="6.2831853" velocity="3.2"/>
    <dynamics damping="0.0" friction="0.0"/>
  </joint>
"""

pos4 = [0.0, 0.0, 0.39225 * 1000]
rot4 = Rotation.from_euler_angles([0.0, 1.570796325, 0.0])
f4, m4 = calculate_frame_and_transform(f3.point, Rotation.from_frame(f3), pos4, rot4, m4)

"""
<joint name="wrist_2_joint" type="revolute">
    <parent link="wrist_1_link"/>
    <child link="wrist_2_link"/>
    <origin rpy="0.0 0.0 0.0" xyz="0.0 0.093 0.0"/>
    <axis xyz="0 0 1"/>
    <limit effort="28.0" lower="-6.2831853" upper="6.2831853" velocity="3.2"/>
    <dynamics damping="0.0" friction="0.0"/>
  </joint>
"""

pos5 = [0.0, 0.093 * 1000, 0.0]
rot5 = Rotation.from_euler_angles([0.0, 0.0, 0.0])
f5, m5 = calculate_frame_and_transform(f4.point, Rotation.from_frame(f4), pos5, rot5, m5)

"""
<joint name="wrist_3_joint" type="revolute">
    <parent link="wrist_2_link"/>
    <child link="wrist_3_link"/>
    <origin rpy="0.0 0.0 0.0" xyz="0.0 0.0 0.09465"/>
    <axis xyz="0 1 0"/>
    <limit effort="28.0" lower="-6.2831853" upper="6.2831853" velocity="3.2"/>
    <dynamics damping="0.0" friction="0.0"/>
  </joint>

"""

pos6 = [0.0, 0.0, 0.09465 * 1000]
rot6 = Rotation.from_euler_angles([0.0, 0.0, 0.0])
f6, m6 = calculate_frame_and_transform(f5.point, Rotation.from_frame(f5), pos6, rot6, m6)


"""
<link name="tool0"/>
  <joint name="wrist_3_link-tool0_fixed_joint" type="fixed">
    <origin rpy="-1.570796325 0 0" xyz="0 0.0823 0"/>
    <parent link="wrist_3_link"/>
    <child link="tool0"/>
  </joint>
"""

pos7 = [0, 0.0823 * 1000, 0]
rot7 = Rotation.from_euler_angles([-1.570796325, 0, 0])
f7 = calculate_frame_and_transform(f6.point, Rotation.from_frame(f6), pos7, rot7)


def draw_frame(frame, scale=100):
    pl = rg.Plane(rg.Point3d(*frame.point), rg.Vector3d(*frame.xaxis), rg.Vector3d(*frame.yaxis))
    x = rg.Line(pl.Origin, pl.XAxis * scale)
    y = rg.Line(pl.Origin, pl.YAxis * scale)
    z = rg.Line(pl.Origin, pl.ZAxis * scale)
    r = Color.FromArgb(255, 0, 0)
    g = Color.FromArgb(0, 255, 0)
    b = Color.FromArgb(0, 0, 255)
    return [x, y, z], [r, g, b]


F = [f0, f1, f2, f3, f4, f5, f6, f7]
    
print F


l0, c0 = draw_frame(f0)
l1, c1 = draw_frame(f1)
l2, c2 = draw_frame(f2)
l3, c3 = draw_frame(f3)
l4, c4 = draw_frame(f4)
l5, c5 = draw_frame(f5)
l6, c6 = draw_frame(f6)
l7, c7 = draw_frame(f7)

L = l0 + l1 + l2 + l3 + l4 + l5 + l6 + l7
C = c0 + c1 + c2 + c3 + c4 + c5 + c6 + c7
# ---------- end python_5 ----------
rotax = RotateAxis(Geometry=item, Angle=1.570796327, Axis=Line((0, 0, 0), (0, 556.4722999, 0)))  # -> Geometry, Transform
rad = Radians(Degrees=Slider(-90, range=-180..180))
rotax_2 = RotateAxis(Geometry=rotax.Geometry, Angle=rad, Axis=Line((0, 0, 0), (0, 0, 594.4344816)))  # -> Geometry, Transform
vec = VectorXYZ(XComponent=Slider(0, range=0..1000), YComponent=Slider(133, range=0..1000), ZComponent=Slider(89, range=0..1000))  # -> Vector, Length
move = Move(Geometry=rotax_2.Geometry, Motion=vec.Vector)  # -> Geometry, Transform
preview_4 = CustomPreview(
    Geometry=[python_5.m5, python_5.m4, python_5.m6, python_5.m3, python_5.m2, python_5.m1, python_5.m0],
    Shader=ColourSwatch(SwatchColor=RGBA(158, 158, 158, 139)))
python_6 = PythonScript(X1=rotax.Transform, X2=rotax_2.Transform, X3=move.Transform)  # -> out, X
# ---------- python_6: Python ----------
X = X3 * X2 * X1
print X
# ---------- end python_6 ----------
pipe_3 = Pipe(Curve=python_5.L, Radius=1, Caps=0)  # -> flatten(Pipe)
transform = Transform(Geometry=item, Transform=python_6.X)
preview_5 = CustomPreview(Geometry=pipe_3, Shader=python_5.C)

# ==== cluster Tools
tool_id = ClusterInput()

test_geometry = Geometry([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])
yaxis_line = Curve(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)
xaxis_line = Curve(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)
mesh = Mesh(test_geometry)
brep = Brep(test_geometry)
tool = Tool(meshes=mesh, breps=brep, xline=xaxis_line, yline=yaxis_line)

# ---- group: measurement tool
measurement_tool_geo = Geometry([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])
tool_2 = PythonScript(breps=measurement_tool_geo)  # -> tool; inputs breps: list
# ---------- tool_2: Python ----------
from compas_fab.fab.robots.ur.tools import MeasurementTool
from compas_fab.fab.grasshopper.helpers import draw_mesh

tool = MeasurementTool()
tool.load_model(xdraw_function=draw_mesh)
tool.breps = breps
# ---------- end tool_2 ----------

# ----
tool_id_2 = Integer(tool_id)
tool_3 = PythonScript()  # -> tool
# ---------- tool_3: Python ----------
from compas_fab.fab.geometry import Frame
from compas_fab.fab.robots import Tool

tcp_frame = Frame.worldXY()

tool = Tool(tcp_frame)
tool.model = []
tool.breps = []
# ---------- end tool_3 ----------
filter = StreamFilter(Gate=tool_id_2, Stream0=tool_3, Stream1=tool_2, Stream2=tool)
py = PythonScript(tool=filter)  # -> tcp_frame, model
# ---------- py: Python ----------
tcp_frame = tool.tcp_frame
model = tool.model
# ---------- end py ----------
tool_4 = Data(filter)
draw = PythonScript(frame=py.tcp_frame)  # -> G, C
# ---------- draw: Python ----------
import Rhino.Geometry as rg
from System.Drawing import Color

if not size:
    size = 100

if frame:
    
    plane = rg.Plane(rg.Point3d(*frame.point), rg.Vector3d(*frame.xaxis), rg.Vector3d(*frame.yaxis))

    G = []
    G.append(rg.Line(plane.Origin, size * plane.XAxis))
    G.append(rg.Line(plane.Origin, size * plane.YAxis))
    G.append(rg.Line(plane.Origin, size * plane.ZAxis))
    
    C = []
    C.append(Color.FromArgb(255, 0, 0))
    C.append(Color.FromArgb(0, 255, 0))
    C.append(Color.FromArgb(0, 0, 255))
# ---------- end draw ----------
tool_5 = ClusterOutput(tool_4)
preview = CustomPreview(Geometry=draw.G, Shader=draw.C)
preview_2 = CustomPreview(Geometry=py.model, Shader=ColourSwatch(SwatchColor=RGB(141, 170, 178)))

# ==== cluster Tool
breps = ClusterInput()
meshes = ClusterInput()
meshes_2 = Mesh(meshes)
mjoin = MeshJoin(Meshes=meshes_2)
xline = ClusterInput()
yline = ClusterInput()
tool = PythonScript(meshes=mjoin, breps=breps, xline=xline, yline=yline)  # -> tool; inputs meshes: list of Mesh, breps: list of Brep
# ---------- tool: Python ----------
import Rhino.Geometry as rg
from compas_fab.fab.geometry import Frame
from compas_fab.fab.robots import Tool
from compas.datastructures.mesh import Mesh

xaxis = rg.Line(xline.PointAtStart, xline.PointAtEnd)
yaxis = rg.Line(yline.PointAtStart, yline.PointAtEnd)

if xaxis.From.DistanceTo(yaxis.From) < 0.01:
    origin = xaxis.From
    xaxis = xaxis.Direction
    yaxis = yaxis.Direction
elif xaxis.To.DistanceTo(yaxis.To) < 0.01:
    origin = xaxis.To
    xaxis = -xaxis.Direction
    yaxis = -yaxis.Direction
elif xaxis.From.DistanceTo(yaxis.To) < 0.01:
    origin = xaxis.From
    xaxis = xaxis.Direction
    yaxis = -yaxis.Direction
elif xaxis.To.DistanceTo(yaxis.From) < 0.01:
    origin = xaxis.To
    xaxis = -xaxis.Direction
    yaxis = yaxis.Direction

xaxis.Unitize()
yaxis.Unitize()

print origin
print xaxis
print yaxis

tcp_frame = Frame(origin, xaxis, yaxis)

tool = Tool(tcp_frame)
tool.model = meshes
tool.breps = breps
# ---------- end tool ----------
tool_2 = ClusterOutput(tool)
