# Grasshopper definition robot-playground.ghx (Grasshopper 1.0.7)
# plug-ins: COMPAS FAB

# Robot
reload = Button()

# ---- group: ROS client
disconnect = Button()
connect = Button()
ros_connect = ROSConnect(Ip="127.0.0.1", Connect=connect, Disconnect=disconnect)  # -> Ros_client, Is_connected
is_connected = Panel(ros_connect.Is_connected)

# ----
# Load robot directly from ROS
# (only working if connected and file_server launched)
panel = Panel("Load example UR5 robot")
load = Button()
load_2 = Button()
units = ValueList({"m": 1, "cm": 100, "mm": 1000}, selected="m")
create = PythonScript(scale_factor=units, load=load_2)  # -> robot
# ---------- create: Python ----------
import os
from scriptcontext import sticky as st

import compas
from compas_fab.robots import RobotLibrary
from compas_ghpython.artists import RobotModelArtist

compas.PRECISION = '12f'

# store robot in component
guid = str(ghenv.Component.InstanceGuid)
robot_key = "robot_" + guid

if robot_key not in st:
    st[robot_key] = None

if load:
    robot = RobotLibrary.ur5(load_geometry=True)
    robot.artist = RobotModelArtist(robot.model)
    st[robot_key] = robot
    robot.scale(scale_factor)

robot = st[robot_key]
# ---------- end create ----------
ros_robot = ROSRobot(Ros_client=ros_connect.Ros_client, Load=load)
set = PythonScript(robot=create)  # -> robot
# ---------- set: Python ----------
if robot and client:
    robot.client = client
# ---------- end set ----------
list = ValueList({"use from ROS": 0, "use example UR5": 1}, selected="use from ROS")
filter = StreamFilter(Gate=list, Stream0=ros_robot, Stream1=set)
robot = Data(filter)

# ----
# Planning scene
# Pass collision objects to planning scene
# Select the links the object is allowed to touch
planning_scene = PlanningScene(Robot=robot)
idxs = Data([3, 4, 5, 6, 7])
py = PythonScript(robot=robot, idxs=idxs)  # -> touch_links; inputs idxs: list of Int32
# ---------- py: Python ----------
if robot:
    link_names = robot.get_link_names()
    touch_links = [link_names[i] for i in idxs]
# ---------- end py ----------
panel_2 = Panel(py)

# ----
# Attach an collision object
# Select link name to attach
yz = YZPlane(Origin=Point(0, 0, 0))
cone = Cone(Base=yz, Radius=0.035, Length=0.1)  # -> Cone, Tip
mesh = Mesh(cone.Cone)
py_2 = PythonScript(robot=robot, idx=Slider(4, range=0..7))  # -> link_name; inputs idx: Int32
# ---------- py_2: Python ----------
if robot:
    link_names = robot.get_link_names()
    link_name = link_names[idx]
# ---------- end py_2 ----------
panel_3 = Panel(py_2)
remove = Button()
add = Button()
attached_collision_mesh = AttachedCollisionMesh(Scene=planning_scene, Mesh=mesh, Identifier="tip", Link_name=py_2, Touch_links=py, Add=add, Remove=remove)

panel_4 = Panel("Define an obstacle")
brep = Brep(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)
mesh_2 = Mesh(brep)
preview = CustomPreview(Geometry=brep, Shader=ColourSwatch(SwatchColor=RGB(255, 255, 255)))
remove_2 = Button()
add_2 = Button()
collision_mesh = CollisionMesh(Scene=planning_scene, Mesh=mesh_2, Identifier="box", Add=add_2, Remove=remove_2)

py_3 = PythonScript(reload=reload)
# ---------- py_3: Python ----------
from compas_rhino.utilities.misc import get_tolerance
from compas_rhino.utilities.misc import unload_modules

from compas_ghpython import unload_modules
unload_modules("compas")
unload_modules("compas_fab")
unload_modules("roslibpy")
# ---------- end py_3 ----------

# ----
# Info
info = PythonScript(robot=robot)  # -> out, main_group_name
# ---------- info: Python ----------
if robot:
    robot.info()
    main_group_name = robot.main_group_name
# ---------- end info ----------
panel_5 = Panel(info.out)

# ----
# Input
panel_6 = Panel("End plane")
pt = Point(Point(0.1971566713, 0.5054777355, 0.4114659475))
panel_7 = Panel("Start plane")
pt_2 = Point(Point(-0.106387682, 0.5523810773, 0))
py_4 = GhPythonScript(pt=pt)  # -> pln
# ---------- py_4: Python ----------
import Rhino.Geometry as rg

pln = rg.Plane(pt, -rg.Vector3d.ZAxis)
# ---------- end py_4 ----------
py_5 = GhPythonScript(pt=pt_2)  # -> pln; same code as py_4
end_plane = Plane(py_4)
start_plane = Plane(py_5)

# ---- group: forward kinematics
a1 = Slider(0, range=-360..360)
a5 = Slider(-7, range=-360..360)
a6 = Slider(90, range=-360..360)
a2 = Slider(0, range=-360..360)
a4 = Slider(-93, range=-360..360)
a3 = Slider(0, range=-360..360)
set_joint_positions = BooleanToggle(False)
jp = GhPythonScript()  # -> joint_positions
# ---------- jp: Python ----------
import math
joint_positions = [-3.136, -0.328, -1.218, 3.129, 0.852, 0.008]
joint_positions = [0] * 6
print joint_positions
# ---------- end jp ----------
forward_kinematics = PythonScript(robot=robot, set_joint_positions=set_joint_positions, joint_positions=jp, a1=a1, a2=a2, a3=a3, a4=a4, a5=a5, a6=a6)  # -> full_configuration; inputs joint_positions: list
# ---------- forward_kinematics: Python ----------
import math
import Grasshopper
from compas_robots import Configuration
from compas_robots.model import Joint

if set_joint_positions:

    j = 0
    for i in range(ghenv.Component.Params.Input.Count):
        nslider = ghenv.Component.Params.Input[i].Sources[0]
        if nslider.GetType() == Grasshopper.Kernel.Special.GH_NumberSlider:
            nslider.TrySetSliderValue(math.degrees(joint_positions[j]))
            j += 1

if robot:
    joint_positions = [a1, a2, a3, a4, a5, a6]
    joint_types = robot.get_configurable_joint_types()
    for i, joint_type in enumerate(joint_types):
        if joint_type == Joint.REVOLUTE:
            joint_positions[i] = math.radians(joint_positions[i])
    full_configuration = Configuration(joint_positions, joint_types)
# ---------- end forward_kinematics ----------

# ----
# Configuration
# TODO Example:
# Add path constraints
main_planning_group = Text(info.main_group_name)
compute = Button()
py_6 = PythonScript(robot=robot)  # -> configuration
# ---------- py_6: Python ----------
from compas.robots import Configuration

if robot:
    types = robot.get_configurable_joint_types()
    values = [0] * len(types)

    configuration = Configuration(values, types)
    print configuration
# ---------- end py_6 ----------
list_2 = ValueList({"0", "1"}, selected="0")
py_7 = PythonScript(start_plane=start_plane, end_plane=end_plane)  # -> planes
# ---------- py_7: Python ----------
planes = [start_plane, end_plane]
print planes
# ---------- end py_7 ----------
avoid_collisions = BooleanToggle(True)
compute_2 = Button()

# ---- group: inverse kinematics
py_8 = PythonScript(robot=robot)  # -> configuration
# ---------- py_8: Python ----------
from compas.robots import Configuration

if robot:
    types = robot.get_configurable_joint_types()
    values = [0] * len(types)
    configuration = Configuration(values, types)
    print configuration
    print robot.get_configurable_joint_names()
# ---------- end py_8 ----------
start_configuration = Data(forward_kinematics)
list_3 = ValueList({"0", "1"}, selected="0")
filter_2 = StreamFilter(Gate=list_3, Stream0=start_configuration, Stream1=py_8)
inverse_kinematics = InverseKinematics(Robot=robot, Plane=start_plane, Start_configuration=filter_2, Group=main_planning_group)

# ---- group: plan motion
# Plan motion
# If you specify the tolerance vector with [360, 1, 1], it means that
#     the frame's y-axis and z-axis are allowed to rotate about the x-axis by an
#     angle of 360 degrees, whereas the x-axis can only change 1 degree.
group = Data(main_planning_group)
py_9 = PythonScript(robot=robot)  # -> configuration; same code as py_6
list_4 = ValueList({"don't use attached collision mesh": 0, "use attached collision mesh": 1}, selected="use attached collision mesh")
constraints_from_plane = ConstraintsFromPlane(
    Robot=robot,
    Plane=end_plane,
    Group=group,
    Tolerance_position=Slider(0.001, range=0..0.001),
    Tolerance_xaxis=Slider(1, range=1..360),
    Tolerance_yaxis=Slider(1, range=1..360),
    Tolerance_zaxis=Slider(1, range=1..360))
start_configuration_2 = Data(inverse_kinematics)
list_5 = ValueList({"0", "1"}, selected="0")
filter_3 = StreamFilter(Gate=list_4)
list_6 = ValueList({"RRT", "RRT*": "RRTStar", "EST", "PRM": "RPM", "PRM*": "RPMStar", "SPARS"}, selected="RRT*")
filter_4 = StreamFilter(Gate=list_5, Stream0=start_configuration_2, Stream1=py_9)
plan_motion = PlanMotion(
    Robot=robot,
    Goal_constraints=constraints_from_plane,
    Start_configuration=filter_4,
    Group=group,
    Attached_collision_meshes=filter_3,
    Planner_id=list_6,
    Compute=compute_2)
panel_8 = Panel("positions")
trajectory_visualize = TrajectoryVisualize(Robot=robot, Group=group, Trajectory=plan_motion)  # -> Start_configuration, Configurations, Fraction, Time, Planes, P, V, A
prismatic = QuickGraph(trajectory_visualize.P, SortOrder=0)
fraction = Panel(trajectory_visualize.Fraction)
time_s = Panel(trajectory_visualize.Time)
stop = Button()
start = Button()
graph = QuickGraph(trajectory_visualize.V, SortOrder=0)
graph_2 = QuickGraph(trajectory_visualize.A, SortOrder=0)
panel_9 = Panel("velocities")
panel_10 = Panel("accelerations")
pline = PolyLine(Vertices=trajectory_visualize.Planes, Closed=False)
counter = CountThroughList(L=trajectory_visualize.Configurations, start=start, stop=stop, step=False, interval=1)  # -> item; inputs L: list, start: Boolean, stop: Boolean
# ---------- counter: Python ----------
from scriptcontext import sticky as st
from compas_ghpython.utilities import update_component

if not interval:
    interval = 5

# store data in component
guid = str(ghenv.Component.InstanceGuid)
counter_key = "counter_" + guid
running_key = "running_" + guid

if counter_key not in st or reset:
    st[counter_key] = 0

if running_key not in st:
    st[running_key] = False




if start:
    st[running_key] = True

if stop:
    st[running_key] = False

if step:
    if st[counter_key] < len(L) - 1:
        st[counter_key] += 1

if back:
    if st[counter_key] > 1:
        st[counter_key] -= 1

if len(L):
    item = L[st[counter_key]]

if st[running_key]:
    if st[counter_key] < len(L) - 1:
        st[counter_key] += 1
        update_component(ghenv, interval)
    else:
        st[counter_key] = 0
        st[running_key] = False
# ---------- end counter ----------
preview_2 = CustomPreview(Geometry=pline, Material=ColourSwatch(SwatchColor=RGB(59, 161, 95)))

# ---- group: forward kinematics
forward = PythonScript(robot=robot, group=main_planning_group, full_configuration=forward_kinematics)  # -> out, frame_WCF
# ---------- forward: Python ----------
"""Calculate the robot's forward kinematic.
    Inputs:
        robot: :class:`compas_fab.robots.Robot`
            The robot.
        group: str, optional
            The planning group used for calculation. Defaults to the robot's
            main planning group.
        full_configuration : :class:`compas_fab.robots.Configuration`
            The full configuration to calculate the forward kinematic for. If no
            full configuration is passed, the zero-joint state for the other
            configurable joints is assumed.
    Output:
        :class:`Frame`
            The frame in the world coordinate frame (WCF).
"""
from __future__ import print_function
import logging

LOGGER = logging.getLogger('roslibpy')

if robot and robot.client and full_configuration:
    if robot.client.is_connected:
        frame_WCF = robot.forward_kinematics(full_configuration, group, options={'solver':'model'})
        print(frame_WCF)
    else:
        print("Robot is not connected")
# ---------- end forward ----------
panel_11 = Panel(forward.out)

# ---- group: cartesian motion
# Plan cartesian motion
group_2 = Data(main_planning_group)
list_7 = ValueList({"don't use attached collision mesh": 0, "use attached collision mesh": 1}, selected="use attached collision mesh")
filter_5 = StreamFilter(Gate=list_7, Stream1=attached_collision_mesh)
start_2 = Button()
stop_2 = Button()

# ----
start_configuration_3 = Data(inverse_kinematics)
filter_6 = StreamFilter(Gate=list_2, Stream0=start_configuration_3, Stream1=py_6)

# ---- group: cartesian motion (continued)
plan_cartesian_motion = PlanCartesianMotion(
    Robot=robot,
    Planes=py_7,
    Start_configuration=filter_6,
    Group=group_2,
    Attached_collision_meshes=filter_5,
    Max_step=Slider(0.01, range=0..0.01),
    Compute=compute)
trajectory_visualize_2 = TrajectoryVisualize(Robot=robot, Group=group_2, Trajectory=plan_cartesian_motion)  # -> Start_configuration, Configurations, Fraction, Time, Planes, P, V, A
prismatic_2 = QuickGraph(trajectory_visualize_2.P, SortOrder=0)
time_s_2 = Panel(trajectory_visualize_2.Time)
graph_3 = QuickGraph(trajectory_visualize_2.V, SortOrder=0)
graph_4 = QuickGraph(trajectory_visualize_2.A, SortOrder=0)
pline_2 = PolyLine(Vertices=trajectory_visualize_2.Planes, Closed=False)
counter_2 = CountThroughList(L=trajectory_visualize_2.Configurations, start=start_2, stop=stop_2, step=False, interval=1)  # -> item; inputs L: list, start: Boolean, stop: Boolean; same code as counter
preview_3 = CustomPreview(Geometry=pline_2, Material=ColourSwatch(SwatchColor=RGB(59, 137, 161)))

# ----
fraction_2 = Panel(trajectory_visualize_2.Fraction)

# ----
# Visualisation
# Select configuration input: from fk, ik, path, or from real robot
list_8 = ValueList({"0 forward_kinematics": 0, "1 inverse_kinematics": 1, "2 cartesian motion": 2, "3 free-space motion": 3}, selected="0 forward_kinematics")
filter_7 = StreamFilter(Gate=list_8, Stream0=forward_kinematics, Stream1=inverse_kinematics, Stream2=counter_2, Stream3=counter)
show_end_effector_frame = BooleanToggle(True)
show_base_frame = BooleanToggle(True)
attached_collision_meshes = Data(attached_collision_mesh)
show_collision = BooleanToggle(False)
show_frames = BooleanToggle(False)
show_visual = BooleanToggle(True)
show_acm = BooleanToggle(True)
robot_visualize = RobotVisualize(
    Robot=robot,
    Group=main_planning_group,
    Configuration=filter_7,
    Attached_collision_meshes=attached_collision_meshes,
    Show_visual=show_visual,
    Show_collision=show_collision,
    Show_frames=show_frames,
    Show_base_frame=show_base_frame,
    Show_end_effector_frame=show_end_effector_frame,
    Show_acm=show_acm)  # -> Visual, Collision, Attached_meshes, Frames, Base_frame, Ee_frame
geo = Geometry(robot_visualize.Visual)
py_10 = PythonScript(robot=robot)  # -> scale
# ---------- py_10: Python ----------
if robot:
    scale = robot.scale_factor * 0.1
else:
    scale = 1.
# ---------- end py_10 ----------
draw = GhPythonScript(frames=[robot_visualize.Frames, robot_visualize.Base_frame, robot_visualize.Ee_frame], scale=py_10)  # -> P, V, C, W; inputs frames: list
# ---------- draw: Python ----------
from System.Drawing import Color
from compas_ghpython import draw_frame

red = Color.FromArgb(255, 0, 0)
green = Color.FromArgb(0, 255, 0)
blue = Color.FromArgb(0, 0, 255)

P = []
V = []
C = []

scale = float(scale)

for frame in frames:
    if not frame:
        continue
    plane = draw_frame(frame)
    P += [plane.Origin] * 3
    V.append(plane.XAxis * scale)
    V.append(plane.YAxis * scale)
    V.append(plane.ZAxis * scale)
    C += [red, green, blue]

W = 3
# ---------- end draw ----------
geo_2 = Geometry(robot_visualize.Collision)
preview_4 = CustomPreview(Geometry=geo, Shader=ColourSwatch(SwatchColor=RGB(105, 105, 105)))
vdisex = VectorDisplayEx(Point=draw.P, Vector=draw.V, Colour=draw.C, Width=draw.W)

geo_3 = Geometry(robot_visualize.Attached_meshes)
