# Grasshopper definition 01_load_robot_6.ghx (Grasshopper 1.0.7)

reload = Button()

# ----
# Robot
# Create (move to Load)
load = Button()
load_2 = Button()
load_3 = Button()
python = PythonScript(load=load)  # -> robot
# ---------- python: Python ----------
from scriptcontext import sticky as st
import compas
from compas.robots import LocalPackageMeshLoader
from compas.robots import Robot

compas.PRECISION = '12f'

# store robot in component-based key
robot_key = 'robot_{}'.format(str(ghenv.Component.InstanceGuid))

if robot_key not in st:
    st[robot_key] = None

if load:
    # Load robot
    path = "C:\\Users\\gcasas\\eth\\Projects\\ros-packages\\abb"
    #package = 'abb_irb120_support'
    package = 'abb_irb6600_support'
    
    loader = LocalPackageMeshLoader(path, package)
    
    robot = Robot.from_urdf_file(loader.load_urdf('irb6640.urdf'))
    robot.load_geometry(loader)
    print robot.name
    st[robot_key] = robot

robot = st[robot_key]
# ---------- end python ----------
python_2 = PythonScript(load=load_2)  # -> robot
# ---------- python_2: Python ----------
from scriptcontext import sticky as st
import compas
from compas.robots import GithubPackageMeshLoader
from compas.robots import Robot

compas.PRECISION = '12f'

# store robot in component-based key
robot_key = 'robot_{}'.format(str(ghenv.Component.InstanceGuid))

if robot_key not in st:
    st[robot_key] = None

if load:
    # Load robot
    repo = 'ros-industrial/abb'
    #package = 'abb_irb120_support'
    package = 'abb_irb6600_support'
    branch = 'kinetic-devel'
    
    loader = GithubPackageMeshLoader(repo, package, branch)
    
    robot = Robot.from_urdf_file(loader.load_urdf('irb6640.urdf'))
    robot.load_geometry(loader)

    st[robot_key] = robot

robot = st[robot_key]
# ---------- end python_2 ----------
python_3 = PythonScript(load=load_3)  # -> robot
# ---------- python_3: Python ----------
from scriptcontext import sticky as st
import compas
from compas.robots import GithubPackageMeshLoader
from compas.robots import Robot

compas.PRECISION = '12f'

# store robot in component-based key
robot_key = 'robot_{}'.format(str(ghenv.Component.InstanceGuid))

if robot_key not in st:
    st[robot_key] = None

if load:
    # Load robot
    repo = 'ros-industrial/abb_experimental'
    package = 'abb_irb120_support'
    branch = 'kinetic-devel'
    
    loader = GithubPackageMeshLoader(repo, package, branch)
    
    robot = Robot.from_urdf_file(loader.load_urdf('irb120t_3_58.urdf'))
    robot.load_geometry(loader)

    st[robot_key] = robot

robot = st[robot_key]
# ---------- end python_3 ----------
create = PythonScript(robot=python)  # -> robot
# ---------- create: Python ----------
import itertools

from compas.geometry import Transformation
from compas_ghpython import mesh_draw
from compas_ghpython.geometry import xform_from_transformation
from compas_fab.robots import BaseRobotArtist

class RobotArtist(BaseRobotArtist):
    def __init__(self, robot):
        super(RobotArtist, self).__init__(robot)

    def transform(self, native_mesh, transformation):
        T = xform_from_transformation(transformation)
        native_mesh.Transform(T)

    def draw_mesh(self, compas_mesh):
        return mesh_draw(compas_mesh)

artist = RobotArtist(robot)
robot.artist = artist
# ---------- end create ----------
robot = Data(create)

load_4 = Button()
py = PythonScript(reload=reload)
# ---------- py: Python ----------
if reload:
    from compas_ghpython import unload_modules
    unload_modules('compas')
# ---------- end py ----------
python_4 = PythonScript()  # -> out, a; disabled
# ---------- python_4: Python ----------
from compas.datastructures import Mesh
from compas.files import STL
from compas_ghpython import mesh_draw
#from compas_rhino.artists import MeshArtist
 
try:
    from urllib.request import urlopen, urlretrieve
except ImportError:
    from urllib2 import urlopen
    from urllib import urlretrieve
 
url = 'https://raw.githubusercontent.com/ros-industrial/abb/kinetic-devel/abb_irb6600_support/meshes/irb6640/visual/link_1.stl'
tempfile, _ = urlretrieve(url)

stl = STL(tempfile, precision='10f')
vertices = stl.parser.vertices
faces = stl.parser.faces
mesh = Mesh.from_vertices_and_faces(vertices, faces)
 
a = mesh_draw(mesh)
# ---------- end python_4 ----------
python_5 = PythonScript(load=load_4)  # -> robot
# ---------- python_5: Python ----------
from scriptcontext import sticky as st
import compas
from compas.robots import LocalPackageMeshLoader
from compas.robots import Robot

compas.PRECISION = '12f'

# store robot in component-based key
robot_key = 'robot_{}'.format(str(ghenv.Component.InstanceGuid))

if robot_key not in st:
    st[robot_key] = None

if load:
    # Load robot
    
    path = "C:\\Users\\gcasas\\eth\\Labs\\robot_description"
    #package = 'abb_irb120_support'
    package = 'ur_description'
    
    loader = LocalPackageMeshLoader(path, package)
    
    robot = Robot.from_urdf_file(loader.load_urdf('ur5.urdf'))
    robot.load_geometry(loader)
    print robot.name
    st[robot_key] = robot

robot = st[robot_key]
# ---------- end python_5 ----------
python_6 = GhPythonScript()  # -> out, a
# ---------- python_6: Python ----------
__author__ = "gcasas"
__version__ = "2018.09.04"
import compas_fab
print compas_fab.__file__

import rhinoscriptsyntax as rs
# ---------- end python_6 ----------
python_7 = GhPythonScript(robot=robot)  # -> out, a; disabled
# ---------- python_7: Python ----------
__author__ = "gcasas"
__version__ = "2018.09.04"

import math
import rhinoscriptsyntax as rs
from compas_fab.robots import Configuration

positions = map(math.radians, [-65, 8, -37, 0, 0, 40])
config = Configuration.from_revolute_values(positions)
robot.artist.update(config)
# ---------- end python_7 ----------
visualize = PythonScript()  # -> visual, collision
# ---------- visualize: Python ----------
import itertools

from compas.geometry import Transformation
from compas.geometry.transformations import mesh_transform
from compas_ghpython import mesh_draw
from compas_ghpython.geometry import xform_from_transformation

#class RobotArtist(object):
#    def transform_geometry(self, geo, transformation):
#        if geo:
#            mesh_transform(geo, transformation)

#class Mesh(object):
#
#    def __init__(self, mesh):
#        self.mesh = mesh_draw(mesh)
#
#    def transform(self, transformation):
#        T = xform_from_transformation(transformation)
#        self.mesh.Transform(T)
#    
#    def draw(self):
#        return self.mesh
#    
#    def set_color(self, color_rgba):
#        
#        from System.Array import CreateInstance
#        from System.Drawing import Color
#
#        r, g, b, a = color_rgba
#        col = Color.FromArgb(int(a*255), int(r*255), int(g*255), int(b*255))
#
#        count = self.mesh.Vertices.Count
#        colors = CreateInstance(Color, count)
#        for i in range(count):
#            colors[i] = col
#        self.mesh.VertexColors.SetColors(colors)

class AbstractRobotArtist(object):
    def __init__(self, robot):
        self.robot = robot
        self.create(robot.root, Transformation())

#    def update(self, 
    def create(self, link, parent_transformation):
        for item in itertools.chain(link.visual, link.collision):
            item.native_geometry = self.draw_mesh(item.geometry.geo)
#            mesh_transformed(item.geometry.geo, parent_transformation)
            self.transform(item.native_geometry, parent_transformation)

        for child_joint in link.joints:
            child_joint_origin = child_joint.origin.transformed(parent_transformation)
            transformation = Transformation.from_frame(child_joint_origin)
            if child_joint.axis:
                child_joint.axis.create(transformation)

            # Recursively call creation
            child_link = child_joint.child_link
            self.create(child_link, transformation)

class RobotArtist(AbstractRobotArtist):
    def __init__(self, robot):
        super(RobotArtist, self).__init__(robot)

    def transform(self, mesh, transformation):
        T = xform_from_transformation(transformation)
        mesh.Transform(T)

    def draw_mesh(self, compas_mesh):
        return mesh_draw(compas_mesh)

    def draw_visual(self):
        for link in self.robot.iter_links():
            for item in link.visual:
                yield item.native_geometry

    def draw_collision(self):
        for link in self.robot.iter_links():
            for item in link.collision:
                yield item.native_geometry

artist = GHRobotArtist(robot)
visual = artist.draw_visual()
collision = artist.draw_collision()
# ---------- end visualize ----------
preview = CustomPreview(
    Geometry=visualize.collision,
    Shader={diffuse=RGB(255, 105, 180), emission=RGB(76, 32, 54), shine=0.5, specular=RGB(255, 255, 255), transparency=0})
preview_2 = CustomPreview(Geometry=visualize.visual, Shader=ColourSwatch(SwatchColor=RGBA(130, 57, 255, 111)))

# ---- group: forward kinematics
# Configuration
a1 = Slider(-89, range=-360..360)
a2 = Slider(8, range=-360..360)
a3 = Slider(-29, range=-360..360)
a4 = Slider(0, range=-360..360)
a5 = Slider(-75, range=-360..360)
a6 = Slider(40, range=-360..360)
forward_kinematics = PythonScript(robot=robot, a1=a1, a2=a2, a3=a3, a4=a4, a5=a5, a6=a6)  # -> configuration
# ---------- forward_kinematics: Python ----------
import math

if robot:
    configuration = [a1, a2, a3, a4, a5, a6]
    configuration = [math.radians(a) for a in configuration]
# ---------- end forward_kinematics ----------

# ----
python_8 = GhPythonScript()  # -> out, a
# ---------- python_8: Python ----------
__author__ = "gcasas"
__version__ = "2018.09.04"

import math
import rhinoscriptsyntax as rs
from compas.datastructures import Mesh
from compas.geometry import Rotation
from compas.geometry import Translation
from compas.geometry import mesh_transform
from compas.geometry import mesh_transformed
from compas_ghpython import mesh_draw

mesh = Mesh.from_obj('https://u.nu/hypar')
t = Translation([10, 10, 3])
mesh_transform(mesh, t)

#a = 
a = [mesh_draw(mesh)]
r = Rotation.from_axis_and_angle([0,1,0], math.radians(10), [15,0,0])
new_mesh = mesh_transformed(mesh, r)

a.append(mesh_draw(new_mesh))

r2 = r.inverse()
reverted_mesh = mesh_transformed(new_mesh, r2)

a.append(mesh_draw(reverted_mesh))
# ---------- end python_8 ----------

# ----
# Visualisation
list = ValueList({"forward_kinematics": 0, "inverse_kinematics": 1, "calculated_path": 2}, selected="forward_kinematics")
filter = StreamFilter(Gate=list, Stream0=forward_kinematics)
show_end_effector_frame = BooleanToggle(True)
show_base_frame = BooleanToggle(True)
show_collision = BooleanToggle(False)
show_visual = BooleanToggle(True)
show_axes = BooleanToggle(True)
visualize_2 = PythonScript(
    robot=robot,
    configuration=filter,
    show_visual=show_visual,
    show_collision=show_collision,
    show_axes=show_axes,
    show_base_frame=show_base_frame,
    show_end_effector_frame=show_end_effector_frame)  # -> visual, collision, axes, axes_color, ee_frame, ee_color, base_frame, base_color; inputs configuration: list
# ---------- visualize_2: Python ----------
from System.Drawing import Color

from compas.geometry import Vector
from compas.geometry import Point
from compas.geometry import Frame
from compas_ghpython.utilities import xdraw_frame
from compas_ghpython.utilities import xdraw_pipes

from compas_fab.robots import Configuration

frames = []

size = .100
radius = .001 

red = Color.FromArgb(255, 0, 0)
green = Color.FromArgb(0, 255, 0)
blue = Color.FromArgb(0, 0, 255)

frame_colors = [red, green, blue]

def pipes_from_frame(frame, size, radius): 
    pipes = []
    for axis in [frame.xaxis, frame.yaxis, frame.zaxis]:
        pipe = {}
        pipe['points'] = [list(frame.point), list(Point(*frame.point) + Vector(*axis) * size)]
        pipe['radius'] = radius
        pipes.append(pipe)
    return pipes

if robot and len(configuration):
    #configuration = configuration + [0]
    configuration = Configuration.from_revolute_values(configuration)
    print configuration
    robot.artist.update(configuration, collision=show_collision)
    
    if show_visual:
        visual = robot.artist.draw_visual()
    if show_collision:
        collision = robot.artist.draw_collision()
    
    if show_axes:
        pipes = []
        axes_color = []
        for frame in robot.frames:
            pipes += pipes_from_frame(frame, size, radius)
            axes_color += frame_colors
        axes = xdraw_pipes(pipes, cap=1)



    if show_end_effector_frame:
        link = robot.get_link_by_name(str(robot.get_end_effector_link_name()))
        ee_frame = link.parent_joint.origin.copy()
#        ee_frame = robot.get_end_effector_frame()
        ee_pipes = pipes_from_frame(ee_frame, size, radius)
        ee_frame = xdraw_pipes(ee_pipes, cap=1)
        ee_color = frame_colors
        
    if show_base_frame:
        link = robot.get_link_by_name(str(robot.get_base_link_name()))
        for joint in link.joints:
            if joint.type == 'fixed':
                base_frame = joint.origin.copy()
                break
        else:
            base_frame = Frame.worldXY()

#        base_frame = robot.get_base_frame()
        base_pipes = pipes_from_frame(base_frame, size, radius)
        base_frame = xdraw_pipes(base_pipes, cap=1)
        base_color = frame_colors
# ---------- end visualize_2 ----------
preview_3 = CustomPreview(Geometry=visualize_2.axes, Shader=visualize_2.axes_color)
preview_4 = CustomPreview(Geometry=visualize_2.base_frame, Shader=visualize_2.base_color)
geo = Geometry(visualize_2.collision)
preview_5 = CustomPreview(Geometry=visualize_2.ee_frame, Shader=visualize_2.ee_color)
geo_2 = Geometry(visualize_2.visual)
