# Grasshopper definition 0x_load_robot_6.ghx (Grasshopper 1.0.7)

reload = Button()
panel = Panel("2. Load from github")
py = PythonScript(reload=reload)
# ---------- py: Python ----------
if reload:
    from compas_ghpython import unload_modules
    unload_modules('compas')
# ---------- end py ----------
list = ValueList({"0 UR5": 0, "1 local": 1, "2 github": 2, "3 ROS": 3}, selected="2 github")

# ----
# Robot
# Load robot directly from ROS
# (only working if connected and file_server launched)
panel_2 = Panel("127.0.0.1")
panel_3 = Panel("0. Load example UR5 robot")
load = Button()
# 1. Load from local filesystem
panel_4 = Panel("C:\Users\rustr\workspace\robotic_setups\src")
panel_5 = Panel("3. Load from ROS")
restart = Button()
load_2 = Button()
load_3 = Button()
load_4 = Button()
ur5 = PythonScript(load=load)  # -> robot
# ---------- ur5: Python ----------
from scriptcontext import sticky as st

import compas
from compas_fab.robots.ur5 import Robot

compas.PRECISION = '12f'

# store robot in component
guid = str(ghenv.Component.InstanceGuid)
robot_key = "robot_" + guid

if robot_key not in st:
    st[robot_key] = None

if load:
    st[robot_key] = Robot(load_geometry=True).model

robot = st[robot_key]
# ---------- end ur5 ----------
ros = PythonScript(ip=panel_2, restart=restart)  # -> out, ros_client, is_connected
# ---------- ros: Python ----------
import sys
import time
import logging
import scriptcontext as sc

from compas_fab.backends import RosClient

from System import TimeSpan
from System.Threading import ManualResetEventSlim

LOGGER = logging.getLogger('roslibpy')

key = 'rosclient_%s' % str(ghenv.Component.InstanceGuid)
previous_client = sc.sticky.get(key, None)
if previous_client:
    previous_client.terminate()

ros_client = RosClient(ip, 9090)
sc.sticky[key] = ros_client

waitLock = ManualResetEventSlim(False)

ros_client.on_ready(lambda: waitLock.Set())

if not waitLock.Wait(TimeSpan.FromSeconds(5)):
    raise Exception('Unable to connect to ROS')

LOGGER.info('ROS connection opened')


is_connected = ros_client.is_connected
# ---------- end ros ----------
python = PythonScript(client=ros.ros_client, load=load_2)  # -> robot; inputs load: Boolean
# ---------- python: Python ----------
from scriptcontext import sticky as st
import compas
from compas.robots import RobotModel
from compas_fab.backends import RosClient
from compas_fab.backends import RosFileServerLoader

# Set high precision to import meshes defined in meters
compas.PRECISION = '24f'

# store robot in component
guid = str(ghenv.Component.InstanceGuid)
robot_key = "robot_" + guid

if robot_key not in st:
    st[robot_key] = None

if client and client.is_connected and load:
    # Load URDF from ROS
    loader = RosFileServerLoader(client)
    urdf = loader.load_urdf()
    srdf = loader.load_srdf()

    # Create robot model from URDF and load geometry
    model = RobotModel.from_urdf_string(urdf)
    model.load_geometry(loader)
    st[robot_key] = model

robot = st[robot_key]
# ---------- end python ----------
local = GhPythonScript(path=panel_4, package="abb_irb4600_40_255", load=load_3)  # -> robot
# ---------- local: Python ----------
from scriptcontext import sticky as st

import compas
from compas.robots import LocalPackageMeshLoader
from compas.robots import RobotModel

compas.PRECISION = '12f'

# store robot in component-based key
robot_key = 'robot_{}'.format(str(ghenv.Component.InstanceGuid))

if robot_key not in st:
    st[robot_key] = None

if load:
    loader = LocalPackageMeshLoader(path, package)
    urdf = loader.load_urdf('abb_irb4600_40_255.urdf')
    robot = RobotModel.from_urdf_file(urdf)
    robot.load_geometry(loader)
    st[robot_key] = robot

robot = st[robot_key]
# ---------- end local ----------
python_2 = PythonScript(repo="ros-industrial/abb", package="abb_irb6600_support", branch="kinetic-devel", load=load_4)  # -> robot
# ---------- python_2: Python ----------
from scriptcontext import sticky as st
import compas
from compas.robots import GithubPackageMeshLoader
from compas.robots import RobotModel

compas.PRECISION = '12f'

# store robot in component-based key
robot_key = 'robot_{}'.format(str(ghenv.Component.InstanceGuid))

if robot_key not in st:
    st[robot_key] = None

if load:
    # Load robot
    loader = GithubPackageMeshLoader(repo, package, branch)

    robot = RobotModel.from_urdf_file(loader.load_urdf('irb6640.urdf'))
    robot.load_geometry(loader)

    st[robot_key] = robot

robot = st[robot_key]
# ---------- end python_2 ----------
is_connected = Panel(ros.is_connected)

filter = StreamFilter(Gate=list, Stream0=ur5, Stream1=local, Stream2=python_2, Stream3=python)

create = PythonScript(robot=filter)  # -> robot
# ---------- create: Python ----------
import itertools

from compas_fab.ghpython import RobotArtist

artist = RobotArtist(robot)
robot.artist = artist
# ---------- end create ----------
robot = Data(create)

# ---- group: forward kinematics
# Configuration
a1 = Slider(47, range=-360..360)
a2 = Slider(-5, range=-360..360)
a3 = Slider(1, range=-360..360)
a4 = Slider(-95, range=-360..360)
a5 = Slider(-11, range=-360..360)
a6 = Slider(40, range=-360..360)
forward_kinematics = PythonScript(robot=robot, a1=a1, a2=a2, a3=a3, a4=a4, a5=a5, a6=a6)  # -> configuration
# ---------- forward_kinematics: Python ----------
import math
from compas_fab.robots import Configuration

if robot:
    joint_values = [a1, a2, a3, a4, a5, a6]
    joint_names = robot.get_configurable_joint_names()
    configuration = Configuration.from_revolute_values([math.radians(a) for a in joint_values])
# ---------- end forward_kinematics ----------

# ----
# Visualisation
list_2 = ValueList({"forward_kinematics": 0, "inverse_kinematics": 1, "calculated_path": 2}, selected="forward_kinematics")
filter_2 = StreamFilter(Gate=list_2, Stream0=forward_kinematics)
show_end_effector_frame = BooleanToggle(True)
show_base_frame = BooleanToggle(True)
show_collision = BooleanToggle(False)
show_frames = BooleanToggle(True)
show_visual = BooleanToggle(True)
visualize = PythonScript(
    robot=robot,
    configuration=filter_2,
    show_visual=show_visual,
    show_collision=show_collision,
    show_frames=show_frames,
    show_base_frame=show_base_frame,
    show_end_effector_frame=show_end_effector_frame)  # -> visual, collision, frames, ee_frame, base_frame
# ---------- visualize: Python ----------
"""Visualizes a robot.
    Inputs:
        robot: The robot
        configuration: :class:`compas_fab.robots.Configuration`
            The robot's full configuration to display.
        show_visual: bool
           Whether or not to show the robot's visual meshes.
        show_collision: bool
           Whether or not to show the robot's collision meshes.
        show_frames: bool
           Whether or not to show the robot's joint frames.
        show_base_frame: bool
           Whether or not to show the robot's base frame.
        show_end_effector_frame: bool
            Whether or not to show the robot's end-effector frame.
    Output:
        visual: The robot's visual meshes.
        collision: The robot's collision meshes.
        frames: The robot's joint frames.
        base_frame: The robot's base frame.
        ee_frame: The robot's end-effector frame.
"""
from __future__ import print_function

if robot and configuration:
    configuration.joint_names = robot.get_configurable_joint_names()
    robot.artist.update(configuration, visual=show_visual, collision=show_collision)
    
    joint_state = dict(zip(configuration.joint_names, configuration.values))
    
    print(joint_state)

    if show_visual:
        visual = robot.artist.draw_visual()

    if show_collision:
        collision = robot.artist.draw_collision()

    if show_frames:
        axes = robot.transformed_axes(joint_state)
        frames = robot.transformed_frames(joint_state)

    if show_base_frame:
        frames = robot.transformed_frames(joint_state)
        base_frame = frames[0]

    if show_end_effector_frame:
        ee_frame = robot.forward_kinematics(joint_state)
        print("End-effector", ee_frame)
# ---------- end visualize ----------
draw = GhPythonScript(frames=[visualize.frames, visualize.ee_frame, visualize.base_frame], scale=Slider(0.1, range=0..1))  # -> P, V, C, W; inputs frames: list
# ---------- draw: Python ----------
from System.Drawing import Color
from compas_ghpython import draw_frame

red = Color.FromArgb(255, 0, 0)
green = Color.FromArgb(0, 255, 0)
blue = Color.FromArgb(0, 0, 255)

P = []
V = []
C = []

scale = float(scale)

for frame in frames:
    if not frame:
        continue
    plane = draw_frame(frame)
    P += [plane.Origin] * 3
    V.append(plane.XAxis * scale)
    V.append(plane.YAxis * scale)
    V.append(plane.ZAxis * scale)
    C += [red, green, blue]

W = 3
# ---------- end draw ----------
geo = Geometry(visualize.collision)
geo_2 = Geometry(visualize.visual)
vdisex = VectorDisplayEx(Point=draw.P, Vector=draw.V, Colour=draw.C, Width=draw.W)
