# Grasshopper definition 01_grasshopper_basic_example.ghx (Grasshopper 1.0.7)

reload = Button()
py = PythonScript(reload=reload)
# ---------- py: Python ----------
if reload:
    from compas_ghpython import unload_modules
    unload_modules('compas')
# ---------- end py ----------

# ----
# Basic config
list = ValueList({"Robot A": "A", "Robot B": "B", "Robot C": "C", "Robot D": "D"}, selected="Robot A")
trigger = BooleanToggle(True)
building_member = Mesh(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)
gripping_plane = Plane(Plane(origin=(7.453, 2.905, 0.679), x=(1, 0, 0), y=(0, -1, 0)))
goal_plane = Plane(Plane(origin=(12.03716057, 7.811497132, 2), x=(0, -1, 0), y=(-0.02117759615, 0, -0.9997757296)))

path_planning = PythonScript(
    trigger=trigger,
    selected_robot=list,
    gripping_plane=gripping_plane,
    goal_plane=goal_plane,
    building_member=building_member)  # -> out, path, a
# ---------- path_planning: Python ----------
import logging
from compas.datastructures import Mesh
from compas.geometry import Frame
from compas_rhino.geometry import RhinoMesh

from compas_fab.robots import *
from compas_fab.robots import rfl
from compas_fab.backends import VrepClient

logging.basicConfig(level=logging.DEBUG)

start_pose = Frame(gripping_plane.Origin, gripping_plane.XAxis, gripping_plane.YAxis)
goal_pose = Frame(goal_plane.Origin, goal_plane.XAxis, goal_plane.YAxis)


if trigger:
    building_member_mesh = RhinoMesh.from_guid(building_member).to_compas()

    with VrepClient() as client:
        robot = rfl.Robot(selected_robot)
        client.planner.pick_building_member(robot, building_member_mesh, start_pose)
        pickup_config = client.get_robot_config(robot)

        path = client.plan_motion(robot, goal_pose, group=robot.model.attr['index'])
        if len(path) > 0:
            path.insert(0, pickup_config)
            print('Found path of %d steps' % len(path))
        else:
            print('No path found')
# ---------- end path_planning ----------
visualization = PythonScript(frame=Slider(100, range=0..100), selected_robot=list, building_member=building_member, path=path_planning.path)  # -> out, a; inputs frame: Int32, path: list
# ---------- visualization: Python ----------
import logging
import scriptcontext as sc

from compas_fab.robots import *
from compas_fab.robots import rfl
from compas_fab.backends import VrepClient
from compas_fab.ghpython import PathVisualizer

LOG = logging.getLogger('visualization')

##if "scene_meshes" in sc.sticky:
##    del sc.sticky["scene_meshes"]

if path:
    with VrepClient(debug=True) as simulator:
        frame_index = ((len(path) - 1) * frame) // 100
        LOG.debug('Rendering frame %d out of %d', frame_index + 1, len(path))

        robot = rfl.Robot(selected_robot, client=simulator)
        visualizer = PathVisualizer(simulator, robot, building_member)
        a = visualizer.get_frame_meshes(path, frame_index, sc.sticky)
# ---------- end visualization ----------
