# Grasshopper definition reachability_map.ghx (Grasshopper 1.0.7)

reload = Button()

# ----
# Robot
load = Button()
python = PythonScript(load=load)  # -> robot
# ---------- python: Python ----------
from scriptcontext import sticky as st

import compas

from compas_fab.robots.ur5 import Robot
from compas_ghpython.artists import RobotModelArtist

# Robot meshes are usually in meters
# Set a high precision to prevent parsing errors
# and configure Rhino itself in meters
compas.PRECISION = '12f'

# Store robot in component-based key
robot_key = 'robot_{}'.format(str(ghenv.Component.InstanceGuid))

if robot_key not in st:
    st[robot_key] = None

if load:
    robot = Robot(load_geometry=True)
    robot.artist = RobotModelArtist(robot.model)

    st[robot_key] = robot

robot = st[robot_key]
# ---------- end python ----------
robot = Data(python)

pt = Point(Point(0.4667804797, 1.470603145, 0))
pt_2 = Point(Point(1.25068974, 2.149468062, 1.139083964))
vec = Vector()
py = PythonScript(reload=reload)
# ---------- py: Python ----------
if reload:
    from compas_ghpython import unload_modules
    unload_modules('compas')
    unload_modules('compas_fab')
# ---------- end py ----------
vec2pt = Vector2Pt(PointA=pt_2, PointB=pt, Unitize=True)  # -> Vector, Length
python_2 = GhPythonScript(robot=python)  # -> out, a
# ---------- python_2: Python ----------
robot.info()

print robot.main_group_name
# ---------- end python_2 ----------
python_3 = GhPythonScript(axis=vec2pt.Vector, max_alpha=Slider(60, range=0..100), step=Slider(2, range=0..10))  # -> out, vectors; inputs step: Int32
# ---------- python_3: Python ----------
import math
from compas_fab.robots.reachability_map.frame_generator import DeviationVectorsGenerator
import Rhino.Geometry as rg 

vectors = []

for zaxis in DeviationVectorsGenerator(axis, math.radians(max_alpha), int(step)):
    print zaxis
    vectors.append(rg.Vector3d(*list(zaxis)))
# ---------- end python_3 ----------
vdisex = VectorDisplayEx(Point=pt_2, Vector=vec2pt.Vector, Colour=ColourSwatch(SwatchColor=RGB(255, 0, 0)), Width=5)
pt_3 = Point(Point(0.5306654049, 0.1533687507, 0))
py_2 = GhPythonScript()  # -> DATA; unedited script template

# ---- group: forward kinematics
# Configuration
a1 = Slider(0, range=-360..360)
a2 = Slider(0, range=-360..360)
a3 = Slider(0, range=-360..360)
a4 = Slider(0, range=-360..360)
a5 = Slider(0, range=-360..360)
a6 = Slider(0, range=-360..360)
forward_kinematics = PythonScript(robot=robot, a1=a1, a2=a2, a3=a3, a4=a4, a5=a5, a6=a6)  # -> configuration
# ---------- forward_kinematics: Python ----------
import math
from compas.robots import Configuration

if robot:
    joint_values = [a1, a2, a3, a4, a5, a6]
    joint_names = robot.get_configurable_joint_names()
    configuration = Configuration.from_revolute_values([math.radians(a) for a in joint_values])
# ---------- end forward_kinematics ----------

# ----
python_4 = GhPythonScript(point=pt_3, radius=Slider(0.15, range=0..1))  # -> out, sphere, a, b
# ---------- python_4: Python ----------
from compas.geometry import Sphere
from compas.artists import ShapeArtist


sphere = Sphere(point, radius)

a = ShapeArtist(sphere).draw()
# ---------- end python_4 ----------
vdis = VectorDisplay(Anchor=pt_2, Vector=python_3.vectors)
vdisex_2 = VectorDisplayEx(Point=pt_2, Vector=python_3.vectors, Colour=ColourSwatch(SwatchColor=RGB(0, 0, 0)), Width=1)
python_5 = GhPythonScript(folder=py_2, filename="reachability\map2D.json")  # -> filepath
# ---------- python_5: Python ----------
import os

filepath = os.path.join(folder, filename)
# ---------- end python_5 ----------
python_6 = GhPythonScript(folder=py_2, filename="reachability\map1D.json")  # -> filepath; same code as python_5
python_7 = GhPythonScript(sphere=python_4.sphere, num=Slider(200, range=0..1000))  # -> out, a; inputs num: Int32
# ---------- python_7: Python ----------
import math
from compas.geometry import Point
from compas.artists import PrimitiveArtist

def fibonacci_sphere(samples, sphere):

    points = []
    phi = math.pi * (3. - math.sqrt(5.))  # golden angle in radians

    for i in range(samples):
        y = 1 - (i / float(samples - 1)) * 2  # y goes from 1 to -1
        radius = math.sqrt(1 - y * y)  # radius at y

        theta = phi * i  # golden angle increment

        x = math.cos(theta) * radius
        z = math.sin(theta) * radius
        
        x = sphere.point.x + x * sphere.radius
        y = sphere.point.y + y * sphere.radius
        z = sphere.point.z + z * sphere.radius

        points.append(Point(x, y, z))

    return points



def fibonacci_sphere2(samples, sphere):

    points = []
    
    for theta_deg in range(0, 360, 20):
        
        for phi_deg in range(0, 360, 20):
            
            theta = math.radians(theta_deg)
            phi = math.radians(phi_deg)
            
            y = math.cos(phi)

            x = math.cos(theta)
            z = math.sin(theta)
            
            x = sphere.point.x + x * sphere.radius
            y = sphere.point.y + y * sphere.radius
            z = sphere.point.z + z * sphere.radius
    
            points.append(Point(x, y, z))

    return points


points = fibonacci_sphere2(num, sphere)

a = [PrimitiveArtist(pt).draw() for pt in points]
# ---------- end python_7 ----------
rm = GhPythonScript(filepath=python_5)  # -> map
# ---------- rm: Python ----------
from compas_fab.robots.reachability_map import ReachabilityMap

map = ReachabilityMap.from_json(filepath)
# ---------- end rm ----------
rm_2 = GhPythonScript(filepath=python_6)  # -> map; same code as rm

# ----
# Visualisation
show_end_effector_frame = BooleanToggle(True)
show_base_frame = BooleanToggle(False)
show_collision = BooleanToggle(False)
show_frames = BooleanToggle(False)
show_visual = BooleanToggle(True)
robot_visualize = RobotVisualize(
    robot=robot,
    configuration=forward_kinematics,
    show_visual=show_visual,
    show_collision=show_collision,
    show_frames=show_frames,
    show_base_frame=show_base_frame,
    show_end_effector_frame=show_end_effector_frame)  # -> visual, collision, attached_meshes, frames, base_frame, ee_frame; inputs attached_collision_meshes: list, show_visual: Boolean, show_collision: Boolean, show_frames: Boolean, show_base_frame: Boolean, show_end_effector_frame: Boolean, show_acm: Boolean
#   port group: The planning group used for end-effector and base visualization.
#   port configuration: The robot's full configuration.
#   port attached_collision_meshes: A list of attached collision meshes.
#   port show_visual: Whether or not to show the robot's visual meshes.
#   port show_collision: Whether or not to show the robot's collision meshes.
#   port show_frames: Whether or not to show the robot's joint frames.
#   port show_base_frame: Whether or not to show the robot's base frame.
#   port show_end_effector_frame: Whether or not to show the robot's end-effector frame.
#   port show_acm: Whether or not to show the attached collision meshes (if any).
#   port visual: The robot's visual Rhino meshes (if any).
#   port collision: The robot's collision Rhino meshes (if any).
#   port attached_meshes: The attached collision Rhino meshes (if any).
#   port frames: The robot's joint frames as Rhino planes (if any).
#   port base_frame: The robot's base frame as a Rhino plane (if any).
#   port ee_frame: The robot's end-effector frame as a Rhino plane (if any).
# ---------- robot_visualize: Python ----------
"""
Visualizes the robot.

COMPAS FAB v0.22.0
"""
from compas.geometry import Frame
from compas.geometry import Transformation
from compas_ghpython.artists import FrameArtist
from compas_ghpython.artists import MeshArtist
from ghpythonlib.componentbase import executingcomponent as component


class RobotVisualize(component):
    def RunScript(self, robot, group, configuration, attached_collision_meshes, show_visual, show_collision,
                  show_frames, show_base_frame, show_end_effector_frame, show_acm):

        visual = None
        collision = None
        attached_meshes = None
        frames = None
        base_frame = None
        ee_frame = None

        if robot:
            show_visual = True if show_visual is None else show_visual
            configuration = configuration or robot.zero_configuration()

            robot.update(configuration, visual=show_visual, collision=show_collision)
            compas_frames = robot.transformed_frames(configuration, group)

            if show_visual:
                visual = robot.artist.draw_visual()

            if show_collision:
                collision = robot.artist.draw_collision()

            if show_base_frame:
                base_compas_frame = compas_frames[0]
                artist = FrameArtist(base_compas_frame)
                base_frame = artist.draw()

            if show_end_effector_frame:
                ee_compas_frame = robot.forward_kinematics(configuration, group, options=dict(solver='model'))
                artist = FrameArtist(ee_compas_frame)
                ee_frame = artist.draw()

            if show_frames:
                frames = []
                for compas_frame in compas_frames[1:]:
                    artist = FrameArtist(compas_frame)
                    frame = artist.draw()
                    frames.append(frame)

            if show_acm:
                attached_meshes = []
                for acm in attached_collision_meshes:
                    frame = robot.forward_kinematics(configuration, options=dict(solver='model', link_name=acm.link_name))
                    T = Transformation.from_frame_to_frame(Frame.worldXY(), frame)
                    mesh = acm.collision_mesh.mesh.transformed(T)
                    attached_meshes.append(MeshArtist(mesh).draw())

        return (visual, collision, attached_meshes, frames, base_frame, ee_frame)
# ---------- end robot_visualize ----------
number_slider = Slider(0.1, range=0..1)
draw = GhPythonScript(frames=[robot_visualize.frames, robot_visualize.base_frame, robot_visualize.ee_frame], scale=number_slider)  # -> P, V, C, W; inputs frames: list
# ---------- draw: Python ----------
from System.Drawing import Color
from compas_ghpython.utilities import draw_frame
from compas.geometry import Frame

red = Color.FromArgb(255, 0, 0)
green = Color.FromArgb(0, 255, 0)
blue = Color.FromArgb(0, 0, 255)

P = []
V = []
C = []

scale = float(scale)

for frame in frames:
    
    if not frame:
        continue
    if isinstance(frame, Frame):
        plane = draw_frame(frame)
    else:
        plane = frame
    P += [plane.Origin] * 3
    V.append(plane.XAxis * scale)
    V.append(plane.YAxis * scale)
    V.append(plane.ZAxis * scale)
    C += [red, green, blue]

W = 3
# ---------- end draw ----------
geo = Geometry(robot_visualize.collision)
geo_2 = Geometry(robot_visualize.visual)
vdisex_3 = VectorDisplayEx(Point=draw.P, Vector=draw.V, Colour=draw.C, Width=draw.W)

pt_4 = Point(Point(0.4667804797, 1.470603145, 0))
pt_5 = Point(Point(1.25068974, 2.149468062, 1.139083964))
vec2pt_2 = Vector2Pt(PointA=pt_5, PointB=pt_4, Unitize=True)  # -> Vector, Length
python_8 = GhPythonScript(map=rm, draw_frames=Toggle(False), draw_cloud=Toggle(True))  # -> frames, points, colors
# ---------- python_8: Python ----------
from compas_fab.ghpython.reachability_artist import ReachabilityMapArtist



artist = ReachabilityMapArtist(map)

print map.score

if draw_frames:
    frames = artist.draw_frames()


if draw_cloud:
    points, colors = artist.draw_cloud()
# ---------- end python_8 ----------
python_9 = GhPythonScript(axis=vec2pt_2.Vector, max_alpha=Slider(60, range=0..100))  # -> out, vectors
# ---------- python_9: Python ----------
import math
from compas_fab.robots.reachability_map.frame_generator import OrthonormalVectorsFromAxisGenerator
import Rhino.Geometry as rg 

vectors = []

for zaxis in OrthonormalVectorsFromAxisGenerator(axis, math.radians(max_alpha)):
    print zaxis
    vectors.append(rg.Vector3d(*list(zaxis)))
# ---------- end python_9 ----------
python_10 = GhPythonScript(map=rm_2, draw_frames=Toggle(True), draw_cloud=Toggle(True))  # -> frames, points, colors; same code as python_8
vdisex_4 = VectorDisplayEx(Point=pt_5, Vector=vec2pt_2.Vector, Colour=ColourSwatch(SwatchColor=RGB(255, 0, 0)), Width=5)
vdis_2 = VectorDisplay(Anchor=pt_5, Vector=python_9.vectors)
draw_2 = GhPythonScript(frames=python_8.frames, scale=number_slider)  # -> P, V, C, W; inputs frames: list; same code as draw
cloud = CloudDisplay(Points=python_8.points, Colours=python_8.colors, Size=Slider(0.03, range=0..0.1), SpriteType=0)
draw_3 = GhPythonScript(frames=python_10.frames, scale=number_slider)  # -> P, V, C, W; inputs frames: list; same code as draw
vdisex_5 = VectorDisplayEx(Point=pt_5, Vector=python_9.vectors, Colour=ColourSwatch(SwatchColor=RGB(0, 0, 0)), Width=1)
cloud_2 = CloudDisplay(Points=python_10.points, Colours=python_10.colors, Size=Slider(0.03, range=0..0.1), SpriteType=0)
vdisex_6 = VectorDisplayEx(Point=draw_2.P, Vector=draw_2.V, Colour=draw_2.C, Width=draw_2.W)
vdisex_7 = VectorDisplayEx(Point=draw_3.P, Vector=draw_3.V, Colour=draw_3.C, Width=draw_3.W)
