# Grasshopper definition 0x_load_robot_6.ghx (Grasshopper 1.0.7)

reload = Button()

# ----
# Robot
load = Button()
load_2 = Button()
load_3 = Button()
python = PythonScript(load=load)  # -> robot
# ---------- python: Python ----------
from scriptcontext import sticky as st
import compas
from compas.robots import LocalPackageMeshLoader
from compas.robots import Robot

compas.PRECISION = '12f'

# store robot in component-based key
robot_key = 'robot_{}'.format(str(ghenv.Component.InstanceGuid))

if robot_key not in st:
    st[robot_key] = None

if load:
    # Load robot
    path = "C:\\Users\\gcasas\\eth\\Projects\\ros-packages\\abb"
    #package = 'abb_irb120_support'
    package = 'abb_irb6600_support'
    
    loader = LocalPackageMeshLoader(path, package)
    
    robot = Robot.from_urdf_file(loader.load_urdf('irb6640.urdf'))
    robot.load_geometry(loader)
    print robot.name
    st[robot_key] = robot

robot = st[robot_key]
# ---------- end python ----------
python_2 = PythonScript(load=load_2)  # -> robot
# ---------- python_2: Python ----------
from scriptcontext import sticky as st
import compas
from compas.robots import GithubPackageMeshLoader
from compas.robots import Robot

compas.PRECISION = '12f'

# store robot in component-based key
robot_key = 'robot_{}'.format(str(ghenv.Component.InstanceGuid))

if robot_key not in st:
    st[robot_key] = None

if load:
    # Load robot
    repo = 'ros-industrial/abb'
    #package = 'abb_irb120_support'
    package = 'abb_irb6600_support'
    branch = 'kinetic-devel'
    
    loader = GithubPackageMeshLoader(repo, package, branch)
    
    robot = Robot.from_urdf_file(loader.load_urdf('irb6640.urdf'))
    robot.load_geometry(loader)

    st[robot_key] = robot

robot = st[robot_key]
# ---------- end python_2 ----------
python_3 = PythonScript(load=load_3)  # -> robot
# ---------- python_3: Python ----------
from scriptcontext import sticky as st
import compas
from compas.robots import GithubPackageMeshLoader
from compas.robots import Robot

compas.PRECISION = '12f'

# store robot in component-based key
robot_key = 'robot_{}'.format(str(ghenv.Component.InstanceGuid))

if robot_key not in st:
    st[robot_key] = None

if load:
    # Load robot
    repo = 'ros-industrial/abb_experimental'
    package = 'abb_irb120_support'
    branch = 'kinetic-devel'
    
    loader = GithubPackageMeshLoader(repo, package, branch)
    
    robot = Robot.from_urdf_file(loader.load_urdf('irb120t_3_58.urdf'))
    robot.load_geometry(loader)

    st[robot_key] = robot

robot = st[robot_key]
# ---------- end python_3 ----------
create = PythonScript(robot=python_2)  # -> robot
# ---------- create: Python ----------
import itertools

from compas_fab.ghpython import RobotArtist

artist = RobotArtist(robot)
robot.artist = artist
# ---------- end create ----------
robot = Data(create)

load_4 = Button()  # disabled
py = PythonScript(reload=reload)
# ---------- py: Python ----------
if reload:
    from compas_ghpython import unload_modules
    unload_modules('compas')
# ---------- end py ----------
python_4 = PythonScript(load=load_4)  # -> robot; disabled
# ---------- python_4: Python ----------
from scriptcontext import sticky as st
import compas
from compas.robots import LocalPackageMeshLoader
from compas.robots import Robot

compas.PRECISION = '12f'

# store robot in component-based key
robot_key = 'robot_{}'.format(str(ghenv.Component.InstanceGuid))

if robot_key not in st:
    st[robot_key] = None

if load:
    # Load robot
    
    path = "C:\\Users\\gcasas\\eth\\Labs\\robot_description"
    #package = 'abb_irb120_support'
    package = 'ur_description'
    
    loader = LocalPackageMeshLoader(path, package)
    
    robot = Robot.from_urdf_file(loader.load_urdf('ur5.urdf'))
    robot.load_geometry(loader)
    print robot.name
    st[robot_key] = robot

robot = st[robot_key]
# ---------- end python_4 ----------
python_5 = GhPythonScript(x=python_4)  # -> out, a; disabled
# ---------- python_5: Python ----------
__author__ = "gcasas"
__version__ = "2018.09.04"

import rhinoscriptsyntax as rs
#print x.links[2].visual[0].geometry.geo
# ---------- end python_5 ----------

# ---- group: forward kinematics
# Configuration
a1 = Slider(66, range=-360..360)
a2 = Slider(8, range=-360..360)
a4 = Slider(-95, range=-360..360)
a5 = Slider(-11, range=-360..360)
a3 = Slider(-27, range=-360..360)
a6 = Slider(40, range=-360..360)
forward_kinematics = PythonScript(robot=robot, a1=a1, a2=a2, a3=a3, a4=a4, a5=a5, a6=a6)  # -> configuration
# ---------- forward_kinematics: Python ----------
import math

if robot:
    configuration = [a1, a2, a3, a4, a5, a6]
    configuration = [math.radians(a) for a in configuration]
# ---------- end forward_kinematics ----------

# ----
# Visualisation
list = ValueList({"forward_kinematics": 0, "inverse_kinematics": 1, "calculated_path": 2}, selected="forward_kinematics")
filter = StreamFilter(Gate=list, Stream0=forward_kinematics)
show_end_effector_frame = BooleanToggle(True)
show_base_frame = BooleanToggle(True)
show_collision = BooleanToggle(False)
show_visual = BooleanToggle(True)
show_axes = BooleanToggle(True)
visualize = PythonScript(
    robot=robot,
    configuration=filter,
    show_visual=show_visual,
    show_collision=show_collision,
    show_axes=show_axes,
    show_base_frame=show_base_frame,
    show_end_effector_frame=show_end_effector_frame)  # -> visual, collision, axes, axes_color, ee_frame, ee_color, base_frame, base_color; inputs configuration: list
# ---------- visualize: Python ----------
from System.Drawing import Color

from compas.geometry import Vector
from compas.geometry import Point
from compas.geometry import Frame
from compas_ghpython.utilities import xdraw_frame
from compas_ghpython.utilities import xdraw_pipes

from compas_fab.robots import Configuration

frames = []

size = .100
radius = .001 

red = Color.FromArgb(255, 0, 0)
green = Color.FromArgb(0, 255, 0)
blue = Color.FromArgb(0, 0, 255)

frame_colors = [red, green, blue]

def pipes_from_frame(frame, size, radius): 
    pipes = []
    for axis in [frame.xaxis, frame.yaxis, frame.zaxis]:
        pipe = {}
        pipe['points'] = [list(frame.point), list(Point(*frame.point) + Vector(*axis) * size)]
        pipe['radius'] = radius
        pipes.append(pipe)
    return pipes

if robot and len(configuration):
    #configuration = configuration + [0]
    configuration = Configuration.from_revolute_values(configuration)
    print configuration
    robot.artist.update(configuration, collision=show_collision)
    
    if show_visual:
        visual = robot.artist.draw_visual()
    if show_collision:
        collision = robot.artist.draw_collision()
    
    if show_axes:
        pipes = []
        axes_color = []
        for frame in robot.frames:
            pipes += pipes_from_frame(frame, size, radius)
            axes_color += frame_colors
        axes = xdraw_pipes(pipes, cap=1)



    if show_end_effector_frame:
        link = robot.get_link_by_name(str(robot.get_end_effector_link_name()))
        ee_frame = link.parent_joint.origin.copy()
#        ee_frame = robot.get_end_effector_frame()
        ee_pipes = pipes_from_frame(ee_frame, size, radius)
        ee_frame = xdraw_pipes(ee_pipes, cap=1)
        ee_color = frame_colors
        
    if show_base_frame:
        link = robot.get_link_by_name(str(robot.get_base_link_name()))
        for joint in link.joints:
            if joint.type == 'fixed':
                base_frame = joint.origin.copy()
                break
        else:
            base_frame = Frame.worldXY()

#        base_frame = robot.get_base_frame()
        base_pipes = pipes_from_frame(base_frame, size, radius)
        base_frame = xdraw_pipes(base_pipes, cap=1)
        base_color = frame_colors
# ---------- end visualize ----------
preview = CustomPreview(Geometry=visualize.axes, Shader=visualize.axes_color)
preview_2 = CustomPreview(Geometry=visualize.base_frame, Shader=visualize.base_color)
geo = Geometry(visualize.collision)
preview_3 = CustomPreview(Geometry=visualize.ee_frame, Shader=visualize.ee_color)
geo_2 = Geometry(visualize.visual)
