# Grasshopper definition robot.ghx (Grasshopper 0.9.76)
# plug-ins: Python Interpreter

reload = Button()

# ---- group: ROS client
disconnect = Button()
connect = Button()
restart = Button()
ros = PythonScript(restart=restart)  # -> out, ros_client
# ---------- ros: Python ----------
import time
import logging
import scriptcontext as sc

from roslibpy import Ros
from System import TimeSpan
from System.Threading import ManualResetEventSlim

import sys

LOGGER = logging.getLogger('roslibpy')

key = 'rosclient_%s' % str(ghenv.Component.InstanceGuid)
previous_client = sc.sticky.get(key, None)
if previous_client:
    previous_client.terminate()

ros_client = Ros('127.0.0.1', 9090)
sc.sticky[key] = ros_client

waitLock = ManualResetEventSlim(False)

ros_client.on_ready(lambda: waitLock.Set())

if not waitLock.Wait(TimeSpan.FromSeconds(5)):
    raise Exception('Unable to connect to ROS')

LOGGER.info('ROS connection opened')
# ---------- end ros ----------
connect_2 = PythonScript(ros_client=ros.ros_client, connect=connect, disconnect=disconnect)  # -> out, ros_client
# ---------- connect_2: Python ----------
import logging
from System import TimeSpan
from System.Threading import ManualResetEventSlim

LOGGER = logging.getLogger('roslibpy')

if connect:
    if not ros_client.is_connected:
        LOGGER.debug('Connecting...')
        waitLock = ManualResetEventSlim(False)
        ros_client.on_ready(lambda: waitLock.Set())
        ros_client.connect()

        if not waitLock.Wait(TimeSpan.FromSeconds(5)):
            raise Exception('Unable to connect to ROS')
        LOGGER.debug('Reconnected')

if disconnect:
    if ros_client.is_connected:
        ros_client.terminate()
        LOGGER.debug('Terminated')
# ---------- end connect_2 ----------

# ----
group = PlanningGroups({"groupA", "groupB"}, selected="groupA")  # disabled
toggle = BooleanToggle(True)  # disabled
reset_loggers = Button()
py = PythonScript(reload=reload)
# ---------- py: Python ----------
from compas_rhino.utilities.misc import get_tolerance
from compas_rhino.utilities.misc import unload_modules

from compas_ghpython import unload_modules
unload_modules("compas")
unload_modules("compas_fab")
unload_modules("roslibpy")
# ---------- end py ----------
c_script = CSharpScript()  # -> Out, A; disabled
python = PythonScript()  # -> Out, A; disabled
python_2 = PythonScript()  # -> out, a
# ---------- python_2: Python ----------
import Grasshopper.Kernel.Data as ghp
import Grasshopper.DataTree as ghdt
import Grasshopper
from GhPython.DocReplacement import GrasshopperDocument
from System.Drawing import PointF

ghdoc = ghenv.Component.OnPingDocument()

groups = robot.group_names




if ghenv.Component.Params.Input[1].SourceCount == 0:
    
    inputcount = len(groups)
    vallist = Grasshopper.Kernel.Special.GH_ValueList()
    vallist.CreateAttributes();
    vallist.Name = "Planning groups";
    vallist.NickName = "Group";
    vallist.ListMode = Grasshopper.Kernel.Special.GH_ValueListMode.DropDown;
    
    x = float(ghenv.Component.Attributes.DocObject.Attributes.Bounds.Left - vallist.Attributes.Bounds.Width - 30)
    y = float(ghenv.Component.Params.Input[1].Attributes.Bounds.Y + inputcount * 30)
    vallist.Attributes.Pivot = PointF(x, y)
    
    vallist.ListItems.Clear()
    
    for group in groups:
        vallist.ListItems.Add(Grasshopper.Kernel.Special.GH_ValueListItem(group, group))
    
    
    ghdoc.AddObject(vallist, False);
    ghenv.Component.Params.Input[1].AddSource(vallist)
    vallist.ExpireSolution(True)

else:
    if ghenv.Component.Params.Input[1].SourceCount == 1 and set:
        source = ghenv.Component.Params.Input[1]
        id = source.Attributes.GetTopLevel.DocObject.InstanceGuid;
        obj = ghdoc.FindObject(id, True)
        print obj.Attributes.ToString()
        #GhPython.Component.ZuiPythonComponent.Attributes.ToString
    
        ghdoc.RemoveObject(obj, True)


"""
  int inputcount = this.Component.Params.Input[1].SourceCount;
  vallist.Attributes.Pivot = new PointF((float) this.Component.Attributes.DocObject.Attributes.Bounds.Left - vallist.Attributes.Bounds.Width - 30, (float) this.Component.Params.Input[1].Attributes.Bounds.Y + inputcount * 30);

  vallist.ListItems.Clear();

  for(int i = 0; i < AnalysisTypes.Count; i++)
  {
    vallist.ListItems.Add(new Grasshopper.Kernel.Special.GH_ValueListItem(AnalysisTypes[i], i.ToString()));
  }
  vallist.Description = AnalysisTypes.Count.ToString() + " analyses were found in the SBA file.";

  GrasshopperDocument.AddObject(vallist, false);

  this.Component.Params.Input[1].AddSource(vallist);
  vallist.ExpireSolution(true);
}
"""






"""

private void RunScript(List<string> x, int y, ref object params_, ref object results_)
  {

    var models = new List<Model>();

    //parse input text
    for (int i = 0; i < x.Count; i += (valuecount + 2))
    {
      var model = new Model();
      model.Params = FormatParamString(x[i]); //convert CSV to list of doubles
      for (int j = i + 1; j < i + 4; j++)
      {
        var item = new DictItem();
        FormatModelLine(x[j], out item.Name, out item.Value);
        model.Results.Add(item);
      }
      models.Add(model);
    }
    Component.Message = models.Count.ToString() + " models";

    AnalysisTypes = CalcUniqueAnalyses(models);

    //make dropdown box
    if(Component.Params.Input[1].SourceCount == 0 && Component.Params.Input[0].SourceCount > 0)
    {
      var vallist = new Grasshopper.Kernel.Special.GH_ValueList();
      vallist.CreateAttributes();
      vallist.Name = "Analysis types";
      vallist.NickName = "Analysis:";
      vallist.ListMode = Grasshopper.Kernel.Special.GH_ValueListMode.DropDown;

      int inputcount = this.Component.Params.Input[1].SourceCount;
      vallist.Attributes.Pivot = new PointF((float) this.Component.Attributes.DocObject.Attributes.Bounds.Left - vallist.Attributes.Bounds.Width - 30, (float) this.Component.Params.Input[1].Attributes.Bounds.Y + inputcount * 30);

      vallist.ListItems.Clear();

      for(int i = 0; i < AnalysisTypes.Count; i++)
      {
        vallist.ListItems.Add(new Grasshopper.Kernel.Special.GH_ValueListItem(AnalysisTypes[i], i.ToString()));
      }
      vallist.Description = AnalysisTypes.Count.ToString() + " analyses were found in the SBA file.";

      GrasshopperDocument.AddObject(vallist, false);

      this.Component.Params.Input[1].AddSource(vallist);
      vallist.ExpireSolution(true);
    }

    //we now have our results in a nice classy format. let's convert them to a datatree
    var resultsvals = new DataTree<double>();
    var paramvals = new DataTree<double>();
    string astr = AnalysisTypes[y];

    Component.Params.Output[1].VolatileData.Clear(); //bug fix for when new dropdown is made
    Component.Params.Output[2].VolatileData.Clear(); //bug fix for when new dropdown is made

    for (int i = 0; i < models.Count; i++)
    {
      var pth = new GH_Path(i);
      foreach (var result in models[i].Results)
      {
        if(astr == result.Name)
        {
          resultsvals.Add(result.Value, pth);
          foreach(var param in models[i].Params)
          {
            paramvals.Add(param, pth);
          }
        }
      }
    }
    results_ = resultsvals;
    params_ = paramvals;

"""
# ---------- end python_2 ----------
base = PythonScript()  # -> robot_coordinate_frame
# ---------- base: Python ----------
from compas_fab.geometry import Frame


origin = [-478.32, -214.49, -194.35]
xaxis = [0.00832, 0.99996, -0.00275]
yaxis = [-0.99990, 0.00835, 0.01182]

"""
origin = [0, 0, 0]
xaxis = [1, 0, 0]
yaxis = [0, 1, 0]
"""

base_frame = Frame(list(origin), list(xaxis), list(yaxis))
# ---------- end base ----------
unload = GhPythonScript(reset_loggers=reset_loggers)  # -> out
# ---------- unload: Python ----------
import os
import logging


FORMAT = '%(asctime)-15s [%(levelname)s] %(message)s'
formatter = logging.Formatter(FORMAT)

LOGGER = logging.getLogger('roslibpy')
LOGGER.setLevel(logging.DEBUG)


tmpdir = os.path.join(os.path.expanduser('~'), "Desktop", "tmp")
logfile = os.path.join(tmpdir, "roslibpy.log")
#logging.basicConfig(filename=logfile, filemode='w', level=logging.ERROR)

if reset_loggers:
    print('Removing all logging handlers')
    while LOGGER.handlers:
        LOGGER.handlers.pop()

if not LOGGER.handlers:
    print('Updating logging handlers')
    ch = logging.StreamHandler()
    ch.setLevel(logging.DEBUG)
    ch.setFormatter(formatter)
    LOGGER.addHandler(ch)

    fh = logging.FileHandler(logfile)
    #fh.setLevel(logging.DEBUG)
    fh.setLevel(logging.ERROR)
    fh.setFormatter(formatter)
    LOGGER.addHandler(fh)

    LOGGER.propagate = False
# ---------- end unload ----------
python_3 = PythonScript(x=connect_2.ros_client)  # -> out, a
# ---------- python_3: Python ----------
print x
print x.is_connected
# ---------- end python_3 ----------

# ---- group: Robot
scale_mm = BooleanToggle(True)

# ----
# Robot
panel = Panel("C:\Users\rustr\workspace\robot_description\")
list = ValueList({"ur5", "ur10", "abb_irb6640_185_280", "staubli_tx60l", "panda"}, selected="ur5")
path = PythonScript(path=panel, robot_name=list)  # -> resource_path
# ---------- path: Python ----------
import os

resource_path = os.path.join(os.path.abspath(path), robot_name)

assert(os.path.isdir(resource_path))
# ---------- end path ----------
create = Button()
create_2 = PythonScript(resource_path=path, scale_mm=scale_mm, rcf=base, create=create)  # -> robot
# ---------- create_2: Python ----------
import os

from scriptcontext import sticky as st
import rhinoscriptsyntax as rs

from compas.robots import Robot as UrdfRobot
from compas_fab.robots import Robot


from compas_ghpython import mesh_draw
from compas_ghpython.geometry import xform_from_transformation

from Rhino.RhinoApp import WriteLine

# store data in component
guid = str(ghenv.Component.InstanceGuid)
robot_key = "robot_" + guid

if robot_key not in st:
    st[robot_key] = None

class Mesh(object):

    def __init__(self, compas_mesh):
        self.mesh = mesh_draw(compas_mesh)

    def transform(self, transformation):
        T = xform_from_transformation(transformation)
        self.mesh.Transform(T)
    
    def draw(self):
        return self.mesh
    
    def set_color(self, color_rgba):
        
        from System.Array import CreateInstance
        from System.Drawing import Color
        r, g, b, a = color_rgba
        col = Color.FromArgb(int(a*255), int(r*255), int(g*255), int(b*255))
        count = self.mesh.Vertices.Count
        colors = CreateInstance(Color, count)
        for i in range(count):
            colors[i] = col
        self.mesh.VertexColors.SetColors(colors)

if create:
    st[robot_key] = Robot.from_resource_path(resource_path, client=None)
    st[robot_key].create(Mesh)
    
if scale_mm and st[robot_key]:
    st[robot_key].scale(1000)
    
if rcf:
    
    st[robot_key].set_RCF(rcf)

    def apply_rcf(link, T):
    
        for item in link.visual:
                item.geometry.shape.transform(T)
    
        for item in link.collision:
            item.geometry.shape.transform(T)
                    
        for joint in link.joints:
            joint.transform(T)
            joint.origin.init = joint.origin.copy()
            if joint.axis:
                joint.axis.init = joint.axis.copy()
            apply_rcf(joint.child_link, T)

    T = st[robot_key].transformation_RCF_WCF
    apply_rcf(st[robot_key].urdf_model.root, T)


robot = st[robot_key]
# ---------- end create_2 ----------
set = PythonScript(robot=create_2, client=connect_2.ros_client)
# ---------- set: Python ----------
if robot and client:
    robot.client = client
# ---------- end set ----------
robot = Data(create_2)

panel_2 = Panel(unload)
list_2 = ValueList({"+1": 1, "-1"}, selected="-1")
X = UnitX(Factor=list_2)
pt = Point(Point(296.4261221, -361.5870916, 430.1247299))
py_2 = PythonScript(pt=pt, zaxis=X)  # -> plane; inputs pt: Point3d, zaxis: Vector3d
# ---------- py_2: Python ----------
import Rhino.Geometry as rg

plane = rg.Plane(pt, zaxis)
# ---------- end py_2 ----------
unsubscribe = Button()

# ---- group: forward kinematics
# Configuration
a1 = Slider(4, range=-360..360)
a2 = Slider(-118, range=-360..360)
a3 = Slider(101, range=-360..360)
a4 = Slider(355, range=-360..360)
a5 = Slider(-92, range=-360..360)
a6 = Slider(-18, range=-360..360)
forward_kinematics = PythonScript(robot=robot, a1=a1, a2=a2, a3=a3, a4=a4, a5=a5, a6=a6)  # -> configuration
# ---------- forward_kinematics: Python ----------
import math

if robot:
    configuration = [a1, a2, a3, a4, a5, a6]
    configuration = [math.radians(a) for a in configuration]
# ---------- end forward_kinematics ----------

# ---- group: inverse kinematics
pt_2 = Point(Point(329.0041245, 1.530180451, 529.515584))
xy = XYPlane(Origin=pt_2)
reqmsg = PythonScript(robot=robot, plane=xy)  # -> reqmsg
# ---------- reqmsg: Python ----------
import math

from compas.geometry import Frame

from compas_fab.robots.backends.ros import Header
from compas_fab.robots.backends.ros import Pose
from compas_fab.robots.backends.ros import PoseStamped
from compas_fab.robots.backends.ros import JointState
from compas_fab.robots.backends.ros import MultiDOFJointState
from compas_fab.robots.backends.ros import RobotState
from compas_fab.robots.backends.ros import PositionIKRequest
from compas_fab.robots.backends.ros import GetPositionIKRequest

if robot:
    
    base_link = robot.get_base_link_name()
    print("base_link = '%s'" % base_link)
    planning_group = robot.main_group_name
    print("group = '%s'" % robot.main_group_name)
    frame = Frame(plane.Origin, plane.XAxis, plane.YAxis)
    frame.point = frame.point * (1./robot.urdf_model.scale_factor)
    pose = Pose.from_frame(frame)
    joint_names = robot.get_configurable_joint_names()
    print("joint_names = %s" % joint_names)
    configuration = robot.get_configuration()
    #joint_positions = configuration.values
    joint_positions = [0] * 6
    header = Header(frame_id=base_link)
    pose_stamped = PoseStamped(header, pose)
    joint_state = JointState(name=joint_names, position=joint_positions, header=header)
    #multi_dof_joint_state = MultiDOFJointState(header=header, joint_names=joint_names)
    multi_dof_joint_state = MultiDOFJointState(header=header)
    start_state = RobotState(joint_state, multi_dof_joint_state)
    ik_request = PositionIKRequest(group_name=planning_group,
                                   robot_state=start_state,
                                   pose_stamped=pose_stamped,
                                   avoid_collisions=True)
    reqmsg = GetPositionIKRequest(ik_request)
    print(reqmsg)
# ---------- end reqmsg ----------
step = BooleanToggle(False)
ik = PythonScript(robot=robot, reqmsg=reqmsg, step=step)  # -> out, configuration, error
# ---------- ik: Python ----------
import scriptcontext as sc
import logging
import roslibpy

import scriptcontext as sc
from compas_ghpython.utilities import update_component

from compas_fab.robots.backends.ros import GetPositionIKResponse
from compas_fab.robots.backends.ros import MoveItErrorCodes

LOGGER = logging.getLogger('roslibpy')

guid = str(ghenv.Component.InstanceGuid)
response_key = "response_" + guid

if response_key not in sc.sticky:
    sc.sticky[response_key] = None

def receive_message(msg):
    sc.sticky[response_key] = GetPositionIKResponse.from_msg(msg)
    
if robot:
    if robot.client:
        if robot.client.is_connected:
            srv = roslibpy.Service(robot.client, '/compute_ik', 'GetPositionIK')
            request = roslibpy.ServiceRequest(reqmsg.msg)
            srv.call(request, receive_message, receive_message)

if sc.sticky[response_key]:
    response = sc.sticky[response_key]
    if response.error_code == MoveItErrorCodes.SUCCESS:
        configuration = response.solution.joint_state.position
    error = response.error_code.human_readable
    
else:
    if robot:
        names = robot.get_configurable_joint_names()
        configuration = [0] * len(names)

print configuration
# ---------- end ik ----------
error = Panel(ik.error)

# ----
subscribe = Button()
subscribe_2 = PythonScript(robot=robot, subscribe=subscribe, unsubscribe=unsubscribe)  # -> out, joint_positions
# ---------- subscribe_2: Python ----------
import time
import logging
import datetime
import Grasshopper
from roslibpy import Topic
import scriptcontext as sc

from compas_fab.robots.backends.ros import JointState
from compas_ghpython.utilities import update_component

LOGGER = logging.getLogger('roslibpy')

def receive_message(msg):
    js = JointState.from_msg(msg)
    sc.sticky[response_key] = js.position
    update_component(ghenv, 1000)

guid = str(ghenv.Component.InstanceGuid)
response_key = "response_" + guid
listener_key = "listener_" + guid
function_key = "function_" + guid

if function_key not in sc.sticky:
    sc.sticky[function_key] = receive_message
    
if response_key not in sc.sticky:
    sc.sticky[response_key] = None
    


if robot:
    if robot.client:
        if robot.client.is_connected:
            if subscribe:
                
                needs_subscribe = True
        
                previous_listener = sc.sticky.get(listener_key, None)
                
                if previous_listener and previous_listener.is_subscribed:
                    if previous_listener.ros != robot.client:
                        LOGGER.debug('Previous subscription linked to different ROS client, will terminate.')
                        previous_listener.ros.terminate()
                        sc.sticky[listener_key] = None
                    else:
                        needs_subscribe = False
        
                LOGGER.info('Needs subscribing? ' + str(needs_subscribe))
        
                if needs_subscribe:
                    LOGGER.debug('Subscribing...')
                    try:
                        listener = Topic(robot.client, '/joint_states', 'sensor_msgs/JointState')
                        sc.sticky[listener_key] = listener
            
                        def start_receiving():
                            LOGGER.debug('Listening...')
                            listener.subscribe(sc.sticky[function_key])
                    
                        robot.client.on_ready(start_receiving)
                        
                    except Exception as e:
                        LOGGER.error(e)
                        
            if unsubscribe:
                previous_listener = sc.sticky.get(listener_key, None)
                if previous_listener and previous_listener.is_subscribed:
                    previous_listener.unsubscribe(sc.sticky[function_key])
                    LOGGER.info('Unsubscribed...')
    else:
        LOGGER.debug('Not connected')
else:
    LOGGER.debug('No ROS client found')

joint_positions = sc.sticky[response_key]
# ---------- end subscribe_2 ----------

# ---- group: calculate path
dam = DataDam(DataA=subscribe_2.joint_positions, BufferDelay=10000000, BufferMode=0)
max_step_mm = Slider(10, range=1..500)
avoid_collisions = BooleanToggle(True)
list_3 = ValueList({"inverse": 0, "robot": 1}, selected="inverse")
planes = Plane([xy, py_2])
filter = StreamFilter(Gate=list_3, Stream0=ik.configuration, Stream1=dam)
reqmsg_2 = PythonScript(robot=robot, start_configuration=filter, planes=planes, max_step=max_step_mm, avoid_collisions=avoid_collisions)  # -> reqmsg; inputs start_configuration: list, planes: list, avoid_collisions: Boolean
# ---------- reqmsg_2: Python ----------
import math
import json

from compas.geometry import Frame

from compas_fab.robots.backends.ros import Header
from compas_fab.robots.backends.ros import Pose
from compas_fab.robots.backends.ros import PoseStamped
from compas_fab.robots.backends.ros import JointState
from compas_fab.robots.backends.ros import MultiDOFJointState
from compas_fab.robots.backends.ros import RobotState
from compas_fab.robots.backends.ros import GetCartesianPathRequest


def plane_to_pose(plane):
    frame = Frame(plane.Origin, plane.XAxis, plane.YAxis)
    frame.point = frame.point * (1./robot.urdf_model.scale_factor)
    return Pose.from_frame(frame)


if robot:
    
    waypoints = [plane_to_pose(plane) for plane in planes]
    
    base_link = robot.get_base_link_name()

    ee_link = robot.get_end_effector_link_name()

    main_planning_group = robot.main_group_name
    joint_names = robot.get_configurable_joint_names()
    #joint_positions = [0,0,0,0,0,0]
    joint_positions = start_configuration
    header = Header(frame_id=base_link)
    joint_state = JointState(header=header, name=joint_names, position=joint_positions)
    multi_dof_joint_state = MultiDOFJointState(header=header)
    start_state = RobotState(joint_state=joint_state, multi_dof_joint_state=multi_dof_joint_state)
        
    reqmsg = GetCartesianPathRequest(header=header,
                                     start_state=start_state,
                                     group_name=main_planning_group,
                                     link_name=ee_link,
                                     waypoints=waypoints,
                                     max_step=float(max_step)/1000.,
                                     avoid_collisions=bool(avoid_collisions))
                                     
    #print(reqmsg)
    #print json.dumps(reqmsg.msg, indent=4)
# ---------- end reqmsg_2 ----------
compute = Button()
compute_path = PythonScript(robot=robot, reqmsg=reqmsg_2, compute=compute)  # -> response
# ---------- compute_path: Python ----------
import os
import logging
import pickle
import json

import scriptcontext as sc

import roslibpy

from compas_fab.robots.backends.ros import GetCartesianPathResponse
from compas_fab.robots.backends.ros import MoveItErrorCodes

from compas_ghpython.utilities import update_component

guid = str(ghenv.Component.InstanceGuid)
response_key = "response_" + guid
if response_key not in sc.sticky:
    sc.sticky[response_key] = None

LOGGER = logging.getLogger('roslibpy')
data = dict(requesting_solution=False)

def receive_message(msg):
    sc.sticky[response_key] = GetCartesianPathResponse.from_msg(msg)
    update_component(ghenv, 100)


# must be serialized and de-serialized with pickle, since json sometimes fails
#reqmsg = pickle.loads(pickle.dumps(reqmsg.msg))

if robot:
    if robot.client:
        if robot.client.is_connected and compute:
            srv = roslibpy.Service(robot.client, '/compute_cartesian_path', 'GetCartesianPath')
            request = roslibpy.ServiceRequest(reqmsg.msg)
            srv.call(request, receive_message, receive_message)

    else:
        LOGGER.debug('Not connected')
else:
    LOGGER.debug('No ROS client found')

response = sc.sticky[response_key]
# ---------- end compute_path ----------
py_3 = PythonScript(response=compute_path)  # -> configurations, error
# ---------- py_3: Python ----------
from compas_fab.robots.backends.ros import MoveItErrorCodes

configurations = []

if response:
    if response.error_code == MoveItErrorCodes.SUCCESS:
        start_position = response.start_state.joint_state.position
        
        print ">>", response.solution.multi_dof_joint_trajectory
        positions = []
        for point in response.solution.joint_trajectory.points:
            positions.append(point.positions)
        positions = [start_position] + positions
        configurations = positions
    error = response.error_code.human_readable

print configurations
# ---------- end py_3 ----------
error_2 = Panel(py_3.error)
animate = PythonScript(robot=robot, configurations=py_3.configurations, value=Slider(1, range=0..1))  # -> configuration; inputs configurations: list
# ---------- animate: Python ----------
from compas_fab.utilities import map_range

for c in configurations:
    print c

configurations = configurations[2:]

count = len(configurations)
if count and robot:
    idx = int(map_range(value, 0, 1, 0, count - 1))
    configuration = configurations[idx]
elif robot:
    names = robot.get_configurable_joint_names()
    configuration = [0] * len(names)
# ---------- end animate ----------

# ----
joint_positions = Panel(subscribe_2.joint_positions)
rec = DataRecorder(subscribe_2.out, DataLimit=-10, RecordData=True)
# TODO
# 2. Set tool
# 3. Set the base
list_4 = ValueList({"no_tool": 0, "measurement_tool": 1, "gripper": 2}, selected="gripper")
tools = Tools(tool_id=list_4)
joint_states = Panel(rec)

# ----
# Visualisation
# Select configuration input: from fk, ik, path, or from real robot
list_5 = ValueList({"forward_kinematics": 0, "inverse_kinematics": 1, "calculated_path": 2, "from robot": 3}, selected="forward_kinematics")
filter_2 = StreamFilter(Gate=list_5, Stream0=forward_kinematics, Stream1=ik.configuration, Stream2=animate)
show_end_effector_frame = BooleanToggle(True)
show_base_frame = BooleanToggle(True)
show_collision = BooleanToggle(True)
show_visual = BooleanToggle(True)
show_axes = BooleanToggle(False)
visualize = PythonScript(
    robot=robot,
    configuration=filter_2,
    show_visual=show_visual,
    show_collision=show_collision,
    show_axes=show_axes,
    show_base_frame=show_base_frame,
    show_end_effector_frame=show_end_effector_frame)  # -> out, visual, collision, axes, axes_color, ee_plane, ee_frame, ee_frame_geo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; inputs configuration: list
# ---------- visualize: Python ----------
from System.Drawing import Color

from compas.geometry import Vector
from compas.geometry import Point
from compas_ghpython.utilities import xdraw_frame
from compas_ghpython.utilities import xdraw_pipes

from compas_fab.robots import Configuration

red = Color.FromArgb(255, 0, 0)
green = Color.FromArgb(0, 255, 0)
blue = Color.FromArgb(0, 0, 255)

frame_colors = [red, green, blue]

def pipes_from_frame(frame, size, radius): 
    pipes = []
    for axis in [frame.xaxis, frame.yaxis, frame.zaxis]:
        pipe = {}
        pipe['points'] = [list(frame.point), list(Point(*frame.point) + Vector(*axis) * size)]
        pipe['radius'] = radius
        pipes.append(pipe)
    return pipes

if robot and len(configuration) and configuration != [None]:
    
    size = 0.1 * robot.scale_factor
    radius = 0.001 * robot.scale_factor
    
    configuration = Configuration.from_revolute_values(list(configuration))
    robot.update(configuration, collision=show_collision)
    
    print("Configuration:")
    print(configuration.values)
    
    if show_visual:
        visual = robot.draw_visual()
        
        
        print robot.transformation_RCF_WCF
        
        """
        for v in visual:
            v.transformed()
        T0 = self.transformation_RCS_WCS * T0
        T1 = self.transformation_RCS_WCS * T1
        T2 = self.transformation_RCS_WCS * T2
        T3 = self.transformation_RCS_WCS * T3
        T4 = self.transformation_RCS_WCS * T4
        T5 = self.transformation_RCS_WCS * T5

        return T0, T1, T2, T3, T4, T5
        
        
        pipes = xdraw_pipes(pipes, cap=1)

        red = Color.FromArgb(255, 0, 0)
        green = Color.FromArgb(0, 255, 0)
        blue = Color.FromArgb(0, 0, 255)
        colors = [red, green, blue]
        """
        
        
        
        
    if show_collision:
        collision = robot.draw_collision()
    
    if show_axes:
        pipes = []
        axes_color = []
        for frame in robot.frames:
            pipes += pipes_from_frame(frame, size, radius)
            axes_color += frame_colors
        axes = xdraw_pipes(pipes, cap=1)
    
    ee_frame = robot.get_end_effector_frame()
    ee_plane = xdraw_frame(ee_frame)
    
    print("End-effector frame:")
    print(ee_frame)
    
    if show_end_effector_frame:
        ee_pipes = pipes_from_frame(ee_frame, size, radius)
        ee_frame_geo = xdraw_pipes(ee_pipes, cap=1)
        ee_frame_color = frame_colors
        
    base_frame = robot.get_base_frame()
    base_plane = xdraw_frame(base_frame)
    
    if show_base_frame:
        base_pipes = pipes_from_frame(base_frame, size, radius)
        base_frame_geo = xdraw_pipes(base_pipes, cap=1)
        base_frame_color = frame_colors
# ---------- end visualize ----------
geo = Geometry(visualize.visual)
geo_2 = Geometry(visualize.collision)
preview = CustomPreview(Geometry=visualize.axes, Shader=visualize.axes_color)
preview_2 = CustomPreview(Geometry=visualize.base_frame_geo, Shader=visualize.base_frame_color)
preview_3 = CustomPreview(Geometry=visualize.ee_frame_geo, Shader=visualize.ee_frame_color)
panel_3 = Panel(visualize.out)

python_4 = PythonScript(idx=Slider(10, range=0..10))  # -> out, p
# ---------- python_4: Python ----------
positions = [[-2.64966, 2.71708, 1.92355, -1.49904, -5.20432, 0.0], [3.63353, 4.52584, 4.35963, -5.74388, -5.20432, 6.28319], [6.26122, 4.89894, -4.35964, -3.6809, -1.54883, -6.28319], [-2.64966, 3.17302, 1.56331, 1.54686, -1.07886, -3.14159], [6.26122, 4.89894, -4.35964, 2.60229, 4.73436, 0.0], [6.26122, 0.42452, 4.35964, -1.64256, 4.73435, 6.28319], [3.63352, 4.52584, 4.35964, -5.74388, -5.20432, -0.0]]



idx = int(idx)
idx = min([len(positions) - 1, idx])

p = positions[idx]
# ---------- end python_4 ----------

# ==== cluster Tools
tool_id = ClusterInput()

test_geometry = Geometry([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])
yaxis_line = Curve(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)
xaxis_line = Curve(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)
mesh = Mesh(test_geometry)
brep = Brep(test_geometry)
tool = Tool(meshes=mesh, breps=brep, xline=xaxis_line, yline=yaxis_line)

# ---- group: measurement tool
measurement_tool_geo = Geometry([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])
tool_2 = PythonScript(breps=measurement_tool_geo)  # -> tool; inputs breps: list
# ---------- tool_2: Python ----------
from compas_fab.fab.robots.ur.tools import MeasurementTool
from compas_fab.fab.grasshopper.helpers import draw_mesh

tool = MeasurementTool()
tool.load_model(xdraw_function=draw_mesh)
tool.breps = breps
# ---------- end tool_2 ----------

# ----
tool_id_2 = Integer(tool_id)
tool_3 = PythonScript()  # -> tool
# ---------- tool_3: Python ----------
from compas_fab.fab.geometry import Frame
from compas_fab.fab.robots import Tool

tcp_frame = Frame.worldXY()

tool = Tool(tcp_frame)
tool.model = []
tool.breps = []
# ---------- end tool_3 ----------
filter = StreamFilter(Gate=tool_id_2, Stream0=tool_3, Stream1=tool_2, Stream2=tool)
py = PythonScript(tool=filter)  # -> tcp_frame, model
# ---------- py: Python ----------
tcp_frame = tool.tcp_frame
model = tool.model
# ---------- end py ----------
tool_4 = Data(filter)
draw = PythonScript(frame=py.tcp_frame)  # -> G, C
# ---------- draw: Python ----------
import Rhino.Geometry as rg
from System.Drawing import Color

if not size:
    size = 100

if frame:
    
    plane = rg.Plane(rg.Point3d(*frame.point), rg.Vector3d(*frame.xaxis), rg.Vector3d(*frame.yaxis))

    G = []
    G.append(rg.Line(plane.Origin, size * plane.XAxis))
    G.append(rg.Line(plane.Origin, size * plane.YAxis))
    G.append(rg.Line(plane.Origin, size * plane.ZAxis))
    
    C = []
    C.append(Color.FromArgb(255, 0, 0))
    C.append(Color.FromArgb(0, 255, 0))
    C.append(Color.FromArgb(0, 0, 255))
# ---------- end draw ----------
tool_5 = ClusterOutput(tool_4)
preview = CustomPreview(Geometry=draw.G, Shader=draw.C)
preview_2 = CustomPreview(Geometry=py.model, Shader=ColourSwatch(SwatchColor=RGB(141, 170, 178)))

# ==== cluster Tool
breps = ClusterInput()
meshes = ClusterInput()
meshes_2 = Mesh(meshes)
mjoin = MeshJoin(Meshes=meshes_2)
xline = ClusterInput()
yline = ClusterInput()
tool = PythonScript(meshes=mjoin, breps=breps, xline=xline, yline=yline)  # -> tool; inputs meshes: list of Mesh, breps: list of Brep
# ---------- tool: Python ----------
import Rhino.Geometry as rg
from compas_fab.fab.geometry import Frame
from compas_fab.fab.robots import Tool
from compas.datastructures.mesh import Mesh

xaxis = rg.Line(xline.PointAtStart, xline.PointAtEnd)
yaxis = rg.Line(yline.PointAtStart, yline.PointAtEnd)

if xaxis.From.DistanceTo(yaxis.From) < 0.01:
    origin = xaxis.From
    xaxis = xaxis.Direction
    yaxis = yaxis.Direction
elif xaxis.To.DistanceTo(yaxis.To) < 0.01:
    origin = xaxis.To
    xaxis = -xaxis.Direction
    yaxis = -yaxis.Direction
elif xaxis.From.DistanceTo(yaxis.To) < 0.01:
    origin = xaxis.From
    xaxis = xaxis.Direction
    yaxis = -yaxis.Direction
elif xaxis.To.DistanceTo(yaxis.From) < 0.01:
    origin = xaxis.To
    xaxis = -xaxis.Direction
    yaxis = yaxis.Direction

xaxis.Unitize()
yaxis.Unitize()

print origin
print xaxis
print yaxis

tcp_frame = Frame(origin, xaxis, yaxis)

tool = Tool(tcp_frame)
tool.model = meshes
tool.breps = breps
# ---------- end tool ----------
tool_2 = ClusterOutput(tool)
