# Grasshopper definition 01_visualize_and_pose.ghx (Grasshopper 1.0.8)

name = ValueList({"abb_irb120_3_58", "abb_irb4600_40_255", "abb_irb4600_40_255_gripper_one_beam", "abb_irb4600_40_255_printing_tool", "panda", "rfl", "ur10e", "ur10e_gripper_one_beam", "ur5", "ur5_cone_tool", "ur5_gripper_one_beam"}, selected="ur10e")
load_geometry = BooleanToggle(True)
compas_fab_load_robot_cell_from_library = COMPASFABLoadRobotCellFromLibrary(name=name, load_geometry=load_geometry)  # -> robot_cell, robot_cell_state; inputs name: String, reload: Boolean, tools: list, rigid_bodies: list
#   port name: Name of the RobotCellLibrary classmethod to call. A dropdown is auto-created on first use with every available cell (e.g. 'ur5', 'ur10e', 'abb_irb4600_40_255', 'panda', 'rfl', 'ur5_cone_tool', 'abb_irb4600_40_255_printing_tool').
#   port load_geometry: Whether to load the robot's mesh geometry. Required for visualization. Defaults to True when unwired. A Boolean Toggle is auto-created on this input when nothing is wired.
#   port reload: Force a reload (bypass cache). Defaults to False.
#   port tools: Optional list of ToolModels to register into the cell. Each is keyed by its `.name`.
#   port rigid_bodies: Optional list of RigidBodies to register into the cell. Each is keyed by its `.name` (set it on the Rigid Body From… component).
#   port robot_cell: The loaded RobotCell.
#   port robot_cell_state: The default RobotCellState matching the cell.
# ---------- compas_fab_load_robot_cell_from_library: Python ----------
# r: compas_fab>=1.1.0
"""
Load a pre-defined RobotCell (and matching default RobotCellState) from RobotCellLibrary.

Tools and rigid bodies can be wired directly into `tools` / `rigid_bodies` so the
returned cell already contains them - no separate Add* + set_robot_cell() step is
needed. Each tool/body is registered under its own `.name`.

A dropdown is auto-created on the `name` input listing every available cell.

COMPAS FAB v1.1.0 (built 2026-06-17 18:52 UTC)
"""

import Grasshopper
import Rhino
import System
from compas_ghpython import create_id
from compas_ghpython import error
from scriptcontext import sticky as st

from compas_fab.ghpython import ensure_boolean_toggle
from compas_fab.ghpython import ensure_value_list
from compas_fab.ghpython import register_models_into_cell
from compas_fab.robots import RobotCellLibrary

_LIBRARY_NAMES = sorted(
    name
    for name in dir(RobotCellLibrary)
    if not name.startswith("_") and callable(getattr(RobotCellLibrary, name))
)


class LoadRobotCellFromLibrary(Grasshopper.Kernel.GH_ScriptInstance):
    def RunScript(self,
            name: str,
            load_geometry,
            reload: bool,
            tools: System.Collections.Generic.List[object],
            rigid_bodies: System.Collections.Generic.List[object]):
        ensure_value_list(ghenv.Component, "name", _LIBRARY_NAMES, default="ur5")  # noqa: F821
        ensure_boolean_toggle(ghenv.Component, "load_geometry", default=True)  # noqa: F821

        if not name:
            return (None, None)

        name = name.strip().lower()
        load_geometry = True if load_geometry is None else load_geometry

        loader = getattr(RobotCellLibrary, name, None)
        if loader is None or not callable(loader):
            error(  # noqa: F821
                ghenv.Component,  # noqa: F821
                "Unknown RobotCellLibrary entry '{}'. Available: {}".format(name, ", ".join(_LIBRARY_NAMES)),
            )
            return (None, None)

        # Cache only the base cell; tools/rigid bodies are merged fresh on every run so
        # input edits apply live without re-running the (potentially slow) library loader.
        key = create_id(ghenv.Component, "robot_cell_{}_{}".format(name, load_geometry))  # noqa: F821
        base_cell = st.get(key)

        if reload or base_cell is None:
            try:
                base_cell, _ = loader(load_geometry=load_geometry)
            except Exception as exc:
                # Don't poison the cache; let the user retry by toggling reload or fixing inputs.
                st.pop(key, None)
                error(  # noqa: F821
                    ghenv.Component,  # noqa: F821
                    "Failed to load '{}' (load_geometry={}): {}: {}".format(
                        name, load_geometry, type(exc).__name__, exc
                    ),
                )
                return (None, None)
            st[key] = base_cell

        robot_cell = register_models_into_cell(ghenv.Component, base_cell, tools, rigid_bodies)  # noqa: F821
        robot_cell_state = robot_cell.default_cell_state()
        return (robot_cell, robot_cell_state)
# ---------- end compas_fab_load_robot_cell_from_library ----------
shoulder_pan_joint = Slider(1.130973, range=-6.283185..6.283185)
shoulder_lift_joint = Slider(-0.879646, range=-6.283185..6.283185)
elbow_joint = Slider(0.502655, range=-3.141593..3.141593)
wrist_1_joint = Slider(-0.376991, range=-6.283185..6.283185)
wrist_2_joint = Slider(0.125664, range=-6.283185..6.283185)
wrist_3_joint = Slider(-1.633628, range=-6.283185..6.283185)
compas_fab_robot_configuration = COMPASFABRobotConfiguration(
    robot_cell=compas_fab_load_robot_cell_from_library.robot_cell,
    joints=[shoulder_pan_joint, shoulder_lift_joint, elbow_joint, wrist_1_joint, wrist_2_joint, wrist_3_joint])  # -> configuration, cell_state; inputs joints: list of Double
#   port robot_cell: The RobotCell to derive joint metadata from. Wiring a new cell rebuilds the slider bank to match its configurable joints.
#   port joints: Joint values in canonical joint order. Auto-populated by the per-joint sliders the component creates; wire your own values to override.
#   port configuration: Configuration with joint_names and joint_types extracted from the cell.
#   port cell_state: A copy of the default cell state with `robot_configuration` set to the selected configuration.
# ---------- compas_fab_robot_configuration: Python ----------
# r: compas_fab>=1.1.0
"""
Build a Configuration from per-joint sliders auto-created from a RobotCell.

Wire a `robot_cell` to this component and one `GH_NumberSlider` per
configurable joint is generated automatically and wired to the `joints`
list input, with min/max set to the joint's limits (and ±2π fallback for
continuous joints / ±1m for prismatic when no limit is declared).

Re-wiring a different `robot_cell` replaces the slider bank to match the
new joint signature. Wiring your own values to `joints` overrides the
auto-sliders.

COMPAS FAB v1.1.0 (built 2026-06-17 18:52 UTC)
"""

import Grasshopper
import Rhino
import System
from compas_ghpython import error
from compas_robots import Configuration

from compas_fab.ghpython import ensure_joint_sliders


class RobotConfigurationComponent(Grasshopper.Kernel.GH_ScriptInstance):
    def RunScript(self, robot_cell, joints: System.Collections.Generic.List[float]):
        if robot_cell is None:
            return None

        try:
            robot_model = robot_cell.robot_model
        except AttributeError:
            error(ghenv.Component, "robot_cell must be a RobotCell instance.")  # noqa: F821
            return None

        metadata = ensure_joint_sliders(ghenv.Component, robot_model, input_name="joints")  # noqa: F821
        if not metadata:
            return None

        names = [name for name, _, _ in metadata]
        types = [jtype for _, jtype, _ in metadata]
        defaults = [default for _, _, default in metadata]

        # `joints` may arrive empty on the very first solve (sliders are
        # wired in this pass but their values only flow on the scheduled
        # follow-up solve). Fall back to per-joint defaults then.
        if not joints or len(joints) < len(metadata):
            values = defaults
        else:
            values = [float(v) for v in joints]

        configuration = Configuration(joint_values=values, joint_types=types, joint_names=names)
        cell_state =robot_cell.default_cell_state()
        cell_state.robot_configuration = configuration
        return (configuration, cell_state)
# ---------- end compas_fab_robot_configuration ----------
compas_fab_visualize_robot_cell = COMPASFABVisualizeRobotCell(robot_cell=compas_fab_load_robot_cell_from_library.robot_cell, cell_state=compas_fab_robot_configuration.cell_state)  # -> robot_meshes, tool_meshes, rigid_body_meshes, base_plane; inputs draw_visual: Boolean, draw_collision: Boolean, native_scale: Double
#   port robot_cell: The RobotCell to draw.
#   port cell_state: Optional RobotCellState describing the configuration to draw. If unwired, the cell's default state is used.
#   port draw_visual: Draw visual meshes. Defaults to True.
#   port draw_collision: Draw collision meshes. Defaults to False.
#   port native_scale: Scale factor for the drawn geometry: meter_value / native_scale = native_value. Use 0.001 for a millimeter document. Defaults to 1.0.
#   port robot_meshes: Rhino meshes of the robot model.
#   port tool_meshes: Rhino meshes of all tool models in the cell.
#   port rigid_body_meshes: Rhino meshes of all rigid bodies in the cell.
#   port base_plane: Rhino plane at the robot's base frame.
# ---------- compas_fab_visualize_robot_cell: Python ----------
# r: compas_fab>=1.1.0
"""
Draw a RobotCell at the configuration described by a RobotCellState.

If no `cell_state` is wired, the cell's default state is used, so the cell is
still drawn (in its default configuration with nothing attached).

This component reuses a cached `RobotCellObject` keyed on the input cell's
identity, so meshes are only built once per canvas session and subsequent
state changes only update transforms (fast).

The robot model, tools, and rigid bodies are returned as separate outputs to
make wiring downstream styling/filtering easy.

COMPAS FAB v1.1.0 (built 2026-06-17 18:52 UTC)
"""

import Grasshopper
import Rhino
import System
from compas.scene import SceneObject
from compas_ghpython import create_id
from compas_rhino.conversions import frame_to_rhino_plane
from scriptcontext import sticky as st

from compas_fab.ghpython.scene import RobotCellObject


class VisualizeRobotCell(Grasshopper.Kernel.GH_ScriptInstance):
    def RunScript(self,
            robot_cell,
            cell_state,
            draw_visual: bool,
            draw_collision: bool,
            native_scale: float):
        if robot_cell is None:
            return (None, None, None, None)

        # Fall back to the cell's default state when none is wired. The child
        # scene objects (robot model, tools, rigid bodies) are only built when a
        # state is applied, so without this the draws below hit a None object.
        if cell_state is None:
            cell_state = robot_cell.default_cell_state()

        draw_visual = True if draw_visual is None else draw_visual
        draw_collision = False if draw_collision is None else draw_collision
        native_scale = native_scale if native_scale else 1.0

        key = create_id(  # noqa: F821
            ghenv.Component,  # noqa: F821
            "robot_cell_object_{}_{}_{}_{}".format(id(robot_cell), draw_visual, draw_collision, native_scale),
        )
        scene_object = st.get(key)
        if scene_object is None:
            scene_object = SceneObject(
                item=robot_cell,
                sceneobject_type=RobotCellObject,
                draw_visual=draw_visual,
                draw_collision=draw_collision,
                native_scale=native_scale,
            )
            st[key] = scene_object

        scene_object.update(cell_state)

        # Collect outputs from the child scene objects directly so each output
        # can be wired separately without re-running draw().
        robot_meshes = scene_object._robot_model_scene_object.draw()

        tool_meshes = []
        for tool_so in scene_object._tool_scene_objects.values():
            tool_meshes.extend(tool_so.draw())

        rigid_body_meshes = []
        for rb_so in scene_object._rigid_body_scene_objects.values():
            rigid_body_meshes.extend(rb_so.draw())

        base_plane = None
        if cell_state.robot_base_frame is not None:
            base_plane = frame_to_rhino_plane(cell_state.robot_base_frame)

        return (robot_meshes, tool_meshes, rigid_body_meshes, base_plane)
# ---------- end compas_fab_visualize_robot_cell ----------
