# Grasshopper definition 02_inverse_kinematics.ghx (Grasshopper 1.0.8)

name = ValueList({"abb_irb120_3_58", "abb_irb4600_40_255", "abb_irb4600_40_255_gripper_one_beam", "abb_irb4600_40_255_printing_tool", "panda", "rfl", "ur10e", "ur10e_gripper_one_beam", "ur5", "ur5_cone_tool", "ur5_gripper_one_beam"}, selected="abb_irb4600_40_255")
load_geometry = BooleanToggle(True)
compas_fab_load_robot_cell_from_library = COMPASFABLoadRobotCellFromLibrary(name=name, load_geometry=load_geometry)  # -> robot_cell, robot_cell_state; inputs name: String, reload: Boolean, tools: list, rigid_bodies: list
#   port name: Name of the RobotCellLibrary classmethod to call. A dropdown is auto-created on first use with every available cell (e.g. 'ur5', 'ur10e', 'abb_irb4600_40_255', 'panda', 'rfl', 'ur5_cone_tool', 'abb_irb4600_40_255_printing_tool').
#   port load_geometry: Whether to load the robot's mesh geometry. Required for visualization. Defaults to True when unwired. A Boolean Toggle is auto-created on this input when nothing is wired.
#   port reload: Force a reload (bypass cache). Defaults to False.
#   port tools: Optional list of ToolModels to register into the cell. Each is keyed by its `.name`.
#   port rigid_bodies: Optional list of RigidBodies to register into the cell. Each is keyed by its `.name` (set it on the Rigid Body From… component).
#   port robot_cell: The loaded RobotCell.
#   port robot_cell_state: The default RobotCellState matching the cell.
# ---------- compas_fab_load_robot_cell_from_library: Python ----------
# r: compas_fab>=1.1.0
"""
Load a pre-defined RobotCell (and matching default RobotCellState) from RobotCellLibrary.

Tools and rigid bodies can be wired directly into `tools` / `rigid_bodies` so the
returned cell already contains them - no separate Add* + set_robot_cell() step is
needed. Each tool/body is registered under its own `.name`.

A dropdown is auto-created on the `name` input listing every available cell.

COMPAS FAB v1.1.0 (built 2026-06-17 23:41 UTC)
"""

import Grasshopper
import Rhino
import System
from compas_ghpython import create_id
from compas_ghpython import error
from scriptcontext import sticky as st

from compas_fab.ghpython import ensure_boolean_toggle
from compas_fab.ghpython import ensure_value_list
from compas_fab.ghpython import register_models_into_cell
from compas_fab.robots import RobotCellLibrary

_LIBRARY_NAMES = sorted(
    name
    for name in dir(RobotCellLibrary)
    if not name.startswith("_") and callable(getattr(RobotCellLibrary, name))
)


class LoadRobotCellFromLibrary(Grasshopper.Kernel.GH_ScriptInstance):
    def RunScript(self,
            name: str,
            load_geometry,
            reload: bool,
            tools: System.Collections.Generic.List[object],
            rigid_bodies: System.Collections.Generic.List[object]):
        ensure_value_list(ghenv.Component, "name", _LIBRARY_NAMES, default="ur5")  # noqa: F821
        ensure_boolean_toggle(ghenv.Component, "load_geometry", default=True)  # noqa: F821

        if not name:
            return (None, None)

        name = name.strip().lower()
        load_geometry = True if load_geometry is None else load_geometry

        loader = getattr(RobotCellLibrary, name, None)
        if loader is None or not callable(loader):
            error(  # noqa: F821
                ghenv.Component,  # noqa: F821
                "Unknown RobotCellLibrary entry '{}'. Available: {}".format(name, ", ".join(_LIBRARY_NAMES)),
            )
            return (None, None)

        # Cache only the base cell; tools/rigid bodies are merged fresh on every run so
        # input edits apply live without re-running the (potentially slow) library loader.
        key = create_id(ghenv.Component, "robot_cell_{}_{}".format(name, load_geometry))  # noqa: F821
        base_cell = st.get(key)

        if reload or base_cell is None:
            try:
                base_cell, _ = loader(load_geometry=load_geometry)
            except Exception as exc:
                # Don't poison the cache; let the user retry by toggling reload or fixing inputs.
                st.pop(key, None)
                error(  # noqa: F821
                    ghenv.Component,  # noqa: F821
                    "Failed to load '{}' (load_geometry={}): {}: {}".format(
                        name, load_geometry, type(exc).__name__, exc
                    ),
                )
                return (None, None)
            st[key] = base_cell

        robot_cell = register_models_into_cell(ghenv.Component, base_cell, tools, rigid_bodies)  # noqa: F821
        robot_cell_state = robot_cell.default_cell_state()
        return (robot_cell, robot_cell_state)
# ---------- end compas_fab_load_robot_cell_from_library ----------

target_mode = ValueList({"ROBOT", "TOOL", "WORKPIECE"}, selected="ROBOT")
plane = Plane(Plane(origin=(1.608542947, -0.1742427524, 0.8909854786), x=(0.72857718, -0.08942608956, -0.6791010729), y=(-0.0859405595, -0.9955407944, 0.03889404803)))
compas_fab_frame_target = COMPASFABFrameTarget(plane=plane, target_mode=target_mode)  # -> target; inputs target_mode: String, tolerance_position: Double, tolerance_orientation: Double, native_scale: Double
#   port plane: Rhino plane or COMPAS Frame describing the target pose (in WCF).
#   port target_mode: Which frame on the robot to match. One of 'ROBOT' (PCF, default), 'TOOL' (TCF of attached tool), or 'WORKPIECE' (OCF of attached workpiece).
#   port tolerance_position: Position tolerance in meters (not affected by native_scale). If unset, the planner default is used.
#   port tolerance_orientation: Orientation tolerance in radians. If unset, the planner default is used.
#   port native_scale: Scale factor: user_value * native_scale = meters. Use 0.001 if modeling in millimeters. Defaults to 1.0.
# ---------- compas_fab_frame_target: Python ----------
# r: compas_fab>=1.1.0
"""
Create a FrameTarget for the robot's end-effector motion planning.

Accepts a Rhino plane or a COMPAS Frame. The `target_mode` controls which
frame on the robot/tool/workpiece is matched against the target.

COMPAS FAB v1.1.0 (built 2026-06-17 18:52 UTC)
"""

import Grasshopper
import Rhino
import System
from compas.geometry import Frame
from compas_rhino.conversions import plane_to_compas_frame

from compas_fab.ghpython import ensure_value_list
from compas_fab.robots import FrameTarget
from compas_fab.robots import TargetMode

_TARGET_MODES = [mode.value for mode in TargetMode]


class FrameTargetComponent(Grasshopper.Kernel.GH_ScriptInstance):
    def RunScript(self,
            plane,
            target_mode: str,
            tolerance_position: float,
            tolerance_orientation: float,
            native_scale: float):
        ensure_value_list(ghenv.Component, "target_mode", _TARGET_MODES, default="ROBOT")  # noqa: F821

        if plane is None:
            return None

        frame = plane if isinstance(plane, Frame) else plane_to_compas_frame(plane)

        mode = target_mode or "ROBOT"
        if isinstance(mode, str):
            mode = TargetMode(mode.strip().upper())

        native_scale = native_scale if native_scale else 1.0

        target = FrameTarget(
            target_frame=frame,
            target_mode=mode,
            native_scale=native_scale,
            tolerance_position=tolerance_position,
            tolerance_orientation=tolerance_orientation,
        )
        return target
# ---------- end compas_fab_frame_target ----------
compas_fab_analytical_kinematics_planner = COMPASFABAnalyticalKinematicsPlanner(solver=name, robot_cell=compas_fab_load_robot_cell_from_library.robot_cell)  # -> planner; inputs solver: String, verbose: Boolean
#   port solver: Name of the analytical solver: 'ur3', 'ur3e', 'ur5', 'ur5e', 'ur10', 'ur10e', 'staubli_tx260l', or 'abb_irb4600_40_255'.
#   port robot_cell: Optional RobotCell to assign to the planner (planner.set_robot_cell). Recommended so FK/IK/Cartesian-motion components can resolve TargetMode.TOOL / TargetMode.WORKPIECE.
#   port verbose: Print solver diagnostics. Defaults to False.
#   port planner: Configured AnalyticalKinematicsPlanner.
# ---------- compas_fab_analytical_kinematics_planner: Python ----------
# r: compas_fab>=1.1.0
"""
Create an AnalyticalKinematicsPlanner for closed-form FK/IK.

The planner runs in-process inside Rhino (no ROS/PyBullet required). It supports
a fixed set of robots whose kinematics are implemented analytically.

Note: the analytical kinematics convention may differ from the URDF model
(different base/flange frames). Pair this planner with a RobotCell that
matches its convention, or use it for FK/IK without visualization.

COMPAS FAB v1.1.0 (built 2026-06-17 18:52 UTC)
"""

import Grasshopper
import Rhino
import System
from compas_ghpython import create_id
from compas_ghpython import error
from scriptcontext import sticky as st

from compas_fab.backends import AnalyticalKinematicsPlanner
from compas_fab.backends.kinematics.solvers import PLANNER_BACKENDS


class AnalyticalKinematicsPlannerComponent(Grasshopper.Kernel.GH_ScriptInstance):
    def RunScript(self, solver: str, robot_cell, verbose: bool):
        if not solver:
            return None

        solver = solver.strip().lower()
        if solver not in PLANNER_BACKENDS:
            error(ghenv.Component, "Unknown analytical solver '{}'. Available: {}".format(solver, ", ".join(sorted(PLANNER_BACKENDS.keys()))))  # noqa: F821
            return None

        verbose = bool(verbose)

        key = create_id(ghenv.Component, "planner_{}_{}".format(solver, verbose))  # noqa: F821
        cached = st.get(key)

        if cached is None:
            solver_instance = PLANNER_BACKENDS[solver]()
            planner = AnalyticalKinematicsPlanner(solver_instance, verbose=verbose)
            st[key] = planner
            cached = planner

        planner = cached

        if robot_cell is not None:
            planner.set_robot_cell(robot_cell)

        return planner
# ---------- end compas_fab_analytical_kinematics_planner ----------
compas_fab_inverse_kinematics = COMPASFABInverseKinematics(
    planner=compas_fab_analytical_kinematics_planner,
    target=compas_fab_frame_target,
    start_state=compas_fab_load_robot_cell_from_library.robot_cell_state)  # -> configuration, cell_state, debug_info; inputs group: String, check_collision: Boolean
#   port planner: A planner instance (AnalyticalKinematicsPlanner, MoveItPlanner, PyBulletPlanner, AnalyticalPyBulletPlanner).
#   port target: Target to reach (FrameTarget, PointAxisTarget, etc.).
#   port start_state: Starting RobotCellState. The robot's configuration in this state is used as the IK seed.
#   port group: Optional planning group name. Defaults to the cell's main planning group.
#   port check_collision: When True, only collision-free IK solutions are returned; when False, in-collision solutions are accepted. Unwired keeps the backend default (True: collision-free).
#   port cell_state: A copy of the start_state with `robot_configuration` set to the IK result. Wire straight into VisualizeRobotCell / ForwardKinematics / next planner step- no SetRobotConfiguration needed.
#   port debug_info: The warnings / errors raised by this run (including a collision diagnostic on failure), as a single string. Wire a panel to read them; empty on a clean solve.
# ---------- compas_fab_inverse_kinematics: Python ----------
# r: compas_fab>=1.1.0
"""
Compute inverse kinematics for a target using a stateless planner.

`target` accepts either a proper Target object (`FrameTarget`,
`PointAxisTarget`, `ConfigurationTarget`, ...) or a bare `compas.geometry.Frame`
or Rhino `Plane`. In the latter two cases the component auto-wraps the input
as a `FrameTarget(target_mode=ROBOT)` with default tolerances and emits a
warning. Wire a dedicated Target component for non-default settings.

The starting RobotCellState provides the robot's seed configuration and any
attached tools/workpieces (which affect what 'TOOL'/'WORKPIECE' target modes
resolve to). The component returns both the resulting Configuration and a
copy of the start_state with that Configuration applied (`cell_state`), so
the next stage (Visualize / FK / next planner step) can wire directly
without an intermediate SetRobotConfiguration. The input state is not
mutated.

If `start_state` is left unwired, a zero-configuration default state is
derived from the planner's robot_cell and used as the seed; a warning is
surfaced on the component so the user knows attachments aren't being
considered. Wire an explicit `start_state` to pose the robot mid-process
or to use a state with attached tools / workpieces.

If no IK solution is found, the component is flagged with an error message and
returns nothing. When the planner supports collision checking, the start state is
additionally checked: a concise hint (the colliding pairs, or "collision-free /
likely unreachable") is appended to explain the failure. Every warning/error is
also mirrored to the `debug_info` output so it can be read in a wired panel.

COMPAS FAB v1.1.0 (built 2026-06-17 18:52 UTC)
"""

from copy import deepcopy

import Grasshopper
import Rhino
import System
from compas.geometry import Frame
from compas_ghpython import error
from compas_ghpython import warning
from compas_rhino.conversions import plane_to_compas_frame

from compas_fab.backends.exceptions import BackendTargetNotSupportedError
from compas_fab.backends.exceptions import InverseKinematicsError
from compas_fab.ghpython import collision_diagnostic
from compas_fab.robots import FrameTarget
from compas_fab.robots import RobotCellState
from compas_fab.robots import Target
from compas_fab.robots import TargetMode


class InverseKinematicsComponent(Grasshopper.Kernel.GH_ScriptInstance):
    def RunScript(self,
            planner,
            target,
            start_state,
            group: str,
            check_collision: bool):
        # `debug_info` mirrors every warning/error the component raises, so the
        # messages can be read in a wired panel instead of only the balloon.
        debug = []

        def _warn(message):
            warning(ghenv.Component, message)  # noqa: F821
            debug.append(message)

        def _err(message):
            error(ghenv.Component, message)  # noqa: F821
            debug.append(message)

        def _result(configuration, cell_state):
            return (configuration, cell_state, "\n".join(debug))

        if planner is None or target is None:
            # Warn only when the input *is* wired but the upstream returned
            # None (i.e. upstream silently failed). If nothing is wired, the
            # user is still building the canvas: staying quiet keeps it clean.
            for name, value in (("planner", planner), ("target", target)):
                if value is None:
                    param = next(p for p in ghenv.Component.Params.Input if p.Name == name)  # noqa: F821
                    if param.SourceCount > 0:
                        _warn("{} input is wired but received None; check the upstream component for errors.".format(name))
            return _result(None, None)

        if not isinstance(target, Target):
            wrap_msg = "Wrapped a {} as FrameTarget(target_mode=ROBOT) with default tolerances. Wire a Target component for non-default settings."
            if isinstance(target, Frame):
                target = FrameTarget(target_frame=target, target_mode=TargetMode.ROBOT)
                _warn(wrap_msg.format("bare COMPAS Frame"))
            else:
                # Anything else (Rhino Plane, GH_Plane wrapper, ...): try the
                # plane-to-frame conversion. If it isn't plane-shaped, surface
                # a clean error.
                try:
                    frame = plane_to_compas_frame(target)
                except Exception:
                    _err("target must be a Target, a COMPAS Frame or a Rhino Plane; got {}.".format(type(target).__name__))
                    return _result(None, None)
                target = FrameTarget(target_frame=frame, target_mode=TargetMode.ROBOT)
                _warn(wrap_msg.format("Rhino Plane"))

        if start_state is None:
            if planner.robot_cell is None:
                _err("No start_state wired and the planner has no robot_cell to derive one from.")
                return _result(None, None)
            start_state = planner.robot_cell_state or RobotCellState.from_robot_cell(planner.robot_cell)
            _warn(
                "No start_state wired; using zero-configuration default from planner.robot_cell. "
                "Wire a state explicitly to seed from a different configuration or to keep tool/workpiece attachments."
            )

        options = None
        if check_collision is not None:
            options = {"check_collision": bool(check_collision)}

        try:
            configuration = planner.inverse_kinematics(
                target=target,
                robot_cell_state=start_state,
                group=group or None,
                options=options,
            )
        except BackendTargetNotSupportedError:
            # The exception is raised with no payload: surface something
            # actionable: name the target type and the planner that rejected it.
            _err(
                "Planner '{}' does not support target type '{}'. "
                "Use a target type supported by this backend (typically `FrameTarget` "
                "for the Analytical planner) or switch backends.".format(type(planner).__name__, type(target).__name__)
            )
            return _result(None, None)
        except InverseKinematicsError as e:
            msg = str(e)
            hint = collision_diagnostic(planner, start_state, group or None)
            if hint:
                msg += "\n" + hint
            _err(msg)
            return _result(None, None)

        if configuration is None:
            return _result(None, None)

        new_state = deepcopy(start_state)
        new_state.robot_configuration = configuration
        return _result(configuration, new_state)
# ---------- end compas_fab_inverse_kinematics ----------
compas_fab_visualize_robot_cell = COMPASFABVisualizeRobotCell(robot_cell=compas_fab_load_robot_cell_from_library.robot_cell, cell_state=compas_fab_inverse_kinematics.cell_state)  # -> robot_meshes, tool_meshes, rigid_body_meshes, base_plane; inputs draw_visual: Boolean, draw_collision: Boolean, native_scale: Double
#   port robot_cell: The RobotCell to draw.
#   port cell_state: Optional RobotCellState describing the configuration to draw. If unwired, the cell's default state is used.
#   port draw_visual: Draw visual meshes. Defaults to True.
#   port draw_collision: Draw collision meshes. Defaults to False.
#   port native_scale: Scale factor for the drawn geometry: meter_value / native_scale = native_value. Use 0.001 for a millimeter document. Defaults to 1.0.
#   port robot_meshes: Rhino meshes of the robot model.
#   port tool_meshes: Rhino meshes of all tool models in the cell.
#   port rigid_body_meshes: Rhino meshes of all rigid bodies in the cell.
#   port base_plane: Rhino plane at the robot's base frame.
# ---------- compas_fab_visualize_robot_cell: Python ----------
# r: compas_fab>=1.1.0
"""
Draw a RobotCell at the configuration described by a RobotCellState.

If no `cell_state` is wired, the cell's default state is used, so the cell is
still drawn (in its default configuration with nothing attached).

This component reuses a cached `RobotCellObject` keyed on the input cell's
identity, so meshes are only built once per canvas session and subsequent
state changes only update transforms (fast).

The robot model, tools, and rigid bodies are returned as separate outputs to
make wiring downstream styling/filtering easy.

COMPAS FAB v1.1.0 (built 2026-06-17 18:52 UTC)
"""

import Grasshopper
import Rhino
import System
from compas.scene import SceneObject
from compas_ghpython import create_id
from compas_rhino.conversions import frame_to_rhino_plane
from scriptcontext import sticky as st

from compas_fab.ghpython.scene import RobotCellObject


class VisualizeRobotCell(Grasshopper.Kernel.GH_ScriptInstance):
    def RunScript(self,
            robot_cell,
            cell_state,
            draw_visual: bool,
            draw_collision: bool,
            native_scale: float):
        if robot_cell is None:
            return (None, None, None, None)

        # Fall back to the cell's default state when none is wired. The child
        # scene objects (robot model, tools, rigid bodies) are only built when a
        # state is applied, so without this the draws below hit a None object.
        if cell_state is None:
            cell_state = robot_cell.default_cell_state()

        draw_visual = True if draw_visual is None else draw_visual
        draw_collision = False if draw_collision is None else draw_collision
        native_scale = native_scale if native_scale else 1.0

        key = create_id(  # noqa: F821
            ghenv.Component,  # noqa: F821
            "robot_cell_object_{}_{}_{}_{}".format(id(robot_cell), draw_visual, draw_collision, native_scale),
        )
        scene_object = st.get(key)
        if scene_object is None:
            scene_object = SceneObject(
                item=robot_cell,
                sceneobject_type=RobotCellObject,
                draw_visual=draw_visual,
                draw_collision=draw_collision,
                native_scale=native_scale,
            )
            st[key] = scene_object

        scene_object.update(cell_state)

        # Collect outputs from the child scene objects directly so each output
        # can be wired separately without re-running draw().
        robot_meshes = scene_object._robot_model_scene_object.draw()

        tool_meshes = []
        for tool_so in scene_object._tool_scene_objects.values():
            tool_meshes.extend(tool_so.draw())

        rigid_body_meshes = []
        for rb_so in scene_object._rigid_body_scene_objects.values():
            rigid_body_meshes.extend(rb_so.draw())

        base_plane = None
        if cell_state.robot_base_frame is not None:
            base_plane = frame_to_rhino_plane(cell_state.robot_base_frame)

        return (robot_meshes, tool_meshes, rigid_body_meshes, base_plane)
# ---------- end compas_fab_visualize_robot_cell ----------
