# Grasshopper definition 02_modify_configuration_interactively.gh (Grasshopper 1.0.8)
# plug-ins: RhinoCodePluginGH

load_robot_cell = Python3Script()  # -> out, robot_cell, robot_cell_state
# ---------- load_robot_cell: Python ----------
# r: compas_fab
# venv: compas_fab

from compas_fab.robots import RobotCellLibrary

# Load the robot model
robot_cell, robot_cell_state = RobotCellLibrary.ur5()
# ---------- end load_robot_cell ----------
change_configuration = Python3Script(
    robot_cell_state=load_robot_cell.robot_cell_state,
    j0=Slider(0, range=-3.141..3.141),
    j1=Slider(-1, range=-3.141..3.141),
    j2=Slider(1, range=-3.141..3.141),
    j3=Slider(-1, range=-3.141..3.141),
    j4=Slider(0, range=-3.141..3.141),
    j5=Slider(0, range=-3.141..3.141))  # -> out, robot_cell_state_out
# ---------- change_configuration: Python ----------
# venv: compas_fab

robot_cell_state_out = robot_cell_state.copy()
robot_cell_state_out.robot_configuration.joint_values[0] = j0
robot_cell_state_out.robot_configuration.joint_values[1] = j1
robot_cell_state_out.robot_configuration.joint_values[2] = j2
robot_cell_state_out.robot_configuration.joint_values[3] = j3
robot_cell_state_out.robot_configuration.joint_values[4] = j4
robot_cell_state_out.robot_configuration.joint_values[5] = j5
# ---------- end change_configuration ----------
visualization = Python3Script(robot_cell=load_robot_cell.robot_cell, robot_cell_state=change_configuration.robot_cell_state_out)  # -> out, native_geometry
# ---------- visualization: Python ----------
# venv: compas_fab

from scriptcontext import sticky
from compas_ghpython import create_id
from compas.scene import Scene

# Create hash (scope limited to this component) for caching SceneObject
object_hash = str(id(robot_cell))
gh_component = ghenv.Component
cache_id = create_id(gh_component, object_hash)

# If scene object exist in sticky, retrieve it
scene_object = None
if sticky.has_key(cache_id):
    scene_object = sticky[cache_id]
    # Double check if the item is the same
    if scene_object.item is robot_cell:
        print("SceneObject '{}' reused for '{}'".format(type(scene_object).__name__, type(robot_cell).__name__))
    else:
        scene_object = None

# Create Scene Object and cache it
if scene_object is None:
    scene = Scene()
    scene_object = scene.add(robot_cell)
    print("SceneObject {} newly created for {}".format(type(scene_object).__name__, type(robot_cell).__name__))
    sticky[cache_id] = scene_object

# The draw method is the same as before
native_geometry = scene_object.draw(robot_cell_state)
# ---------- end visualization ----------
