# Grasshopper definition 03_plan_motion.gh (Grasshopper 1.0.8)
# plug-ins: RhinoCodePluginGH

load_robot_cell = Python3Script()  # -> out, robot_cell, robot_cell_state
# ---------- load_robot_cell: Python ----------
# r: compas, compas_robots, roslibpy, scipy
# venv: compas_fab

import compas
print(compas.__file__)
print(compas.__version__)

import compas_fab
print(compas_fab.__file__)
print(compas_fab.__version__)


from compas_fab.robots import RobotCellLibrary

# Load the robot model
robot_cell, robot_cell_state = RobotCellLibrary.ur5()
# ---------- end load_robot_cell ----------
panel = Panel(load_robot_cell.out)
construct_point = ConstructPoint(XCoordinate=Slider(0.43, range=0..1), YCoordinate=Slider(0.12, range=0..1), ZCoordinate=Slider(0.43, range=0..1))
change_configuration = Python3Script(
    robot_cell_state=load_robot_cell.robot_cell_state,
    j0=Slider(-2.201, range=-3.141..3.141),
    j1=Slider(-0.418, range=-3.141..3.141),
    j2=Slider(-1.063, range=-3.141..3.141),
    j3=Slider(0.171, range=-3.141..3.141),
    j4=Slider(1.825, range=-3.141..3.141),
    j5=Slider(0, range=-3.141..3.141))  # -> out, robot_cell_state_out, robot_configuration_out
# ---------- change_configuration: Python ----------
# venv: compas_fab

robot_cell_state_out = robot_cell_state.copy()
robot_configuration_out = robot_cell_state_out.robot_configuration

robot_configuration_out.joint_values[0] = j0
robot_configuration_out.joint_values[1] = j1
robot_configuration_out.joint_values[2] = j2
robot_configuration_out.joint_values[3] = j3
robot_configuration_out.joint_values[4] = j4
robot_configuration_out.joint_values[5] = j5
# ---------- end change_configuration ----------
change_configuration_2 = Python3Script(
    robot_cell_state=load_robot_cell.robot_cell_state,
    j0=Slider(0, range=-3.141..3.141),
    j1=Slider(-1, range=-3.141..3.141),
    j2=Slider(1, range=-3.141..3.141),
    j3=Slider(-1, range=-3.141..3.141),
    j4=Slider(0, range=-3.141..3.141),
    j5=Slider(0, range=-3.141..3.141))  # -> out, robot_cell_state_out
# ---------- change_configuration_2: Python ----------
# venv: compas_fab

robot_cell_state_out = robot_cell_state.copy()
robot_cell_state_out.robot_configuration.joint_values[0] = j0
robot_cell_state_out.robot_configuration.joint_values[1] = j1
robot_cell_state_out.robot_configuration.joint_values[2] = j2
robot_cell_state_out.robot_configuration.joint_values[3] = j3
robot_cell_state_out.robot_configuration.joint_values[4] = j4
robot_cell_state_out.robot_configuration.joint_values[5] = j5
# ---------- end change_configuration_2 ----------
center_box = CenterBox(Base=construct_point, X=Slider(0.12, range=0..1), Y=Slider(0.12, range=0..1), Z=Slider(0.34, range=0..1))
ros_moveit_planner = Python3Script(reconnect=Button())  # -> out, robot_cell, planner
# ---------- ros_moveit_planner: Python ----------
# r: compas, compas_robots, roslibpy, scipy
# venv: compas_fab

from compas_fab.backends import MoveItPlanner
from compas_fab.backends import RosClient

# with RosClient() as client:
#     robot_cell = client.load_robot_cell()
#     planner = MoveItPlanner(client)
#     robot_cell.print_info()

from scriptcontext import sticky

from compas_fab.backends import RosClient
from compas_fab.backends import MoveItPlanner

moveit_planner_cache_id = 'moveit_planner'
moveit_robot_cell_cache_id = 'moveit_robot_cell'

planner = None
if sticky.has_key(moveit_planner_cache_id):
    print("Has Key.")
    planner = sticky[moveit_planner_cache_id]
    robot_cell = sticky[moveit_robot_cell_cache_id]
    print("Connected:", planner.client.is_connected)
    if reconnect:
        planner.client.close()

if not planner or reconnect:
    client = RosClient()
    client.run()
    robot_cell = client.load_robot_cell()
    planner = MoveItPlanner(client)
    sticky[moveit_planner_cache_id] = planner
    sticky[moveit_robot_cell_cache_id] = robot_cell
    print("Connected:", client.is_connected)
# ---------- end ros_moveit_planner ----------
python_3_script = Python3Script()  # -> out, a
# ---------- python_3_script: Python ----------
# r: compas, compas_robots, roslibpy, scipy
# venv: compas_fab

import compas
print(compas.__file__)
print(compas.__version__)

import compas_fab
print(compas_fab.__file__)
print(compas_fab.__version__)

from compas_fab.robots import RigidBody

from compas_rhino.conversion import mesh_to_compas

# mesh_to_compas()
# box_visual = Box(x_size, y_size, z_size)
# box_collision = Box(x_size, y_size, z_size)

# rigid_body = RigidBody([box_visual.to_mesh()], [box_collision.to_mesh()])
# if name:
#     rigid_body.name = name
# ---------- end python_3_script ----------
number_slider = Slider(0.3, range=0..1)  # disabled
number_slider_2 = Slider(0.3, range=0..1)  # disabled
visualization = Python3Script(robot_cell=load_robot_cell.robot_cell, robot_cell_state=change_configuration_2.robot_cell_state_out)  # -> out, native_geometry
# ---------- visualization: Python ----------
# venv: compas_fab_dev

from scriptcontext import sticky
from compas_ghpython import create_id
from compas.scene import Scene

# Create hash (scope limited to this component) for caching SceneObject
object_hash = str(id(robot_cell))
gh_component = ghenv.Component
cache_id = create_id(gh_component, object_hash)

# If scene object exist in sticky, retrieve it
scene_object = None
if sticky.has_key(cache_id):
    scene_object = sticky[cache_id]
    # Double check if the item is the same
    if scene_object.item is robot_cell:
        print("SceneObject '{}' reused for '{}'".format(type(scene_object).__name__, type(robot_cell).__name__))
    else:
        scene_object = None

# Create Scene Object and cache it
if scene_object is None:
    scene = Scene()
    scene_object = scene.add(robot_cell)
    print("SceneObject {} newly created for {}".format(type(scene_object).__name__, type(robot_cell).__name__))
    sticky[cache_id] = scene_object

# The draw method is the same as before
native_geometry = scene_object.draw(robot_cell_state)
# ---------- end visualization ----------
visualization_2 = Python3Script(robot_cell=load_robot_cell.robot_cell, robot_cell_state=change_configuration.robot_cell_state_out)  # -> out, native_geometry; same code as visualization
panel_2 = Panel("boxy")  # disabled
panel_3 = Panel(ros_moveit_planner.planner)
panel_4 = Panel(ros_moveit_planner.robot_cell)
plan_motion = Python3Script(
    robot_cell=ros_moveit_planner.robot_cell,
    planner=ros_moveit_planner.planner,
    start_state=change_configuration_2.robot_cell_state_out,
    target_configuration=change_configuration.robot_configuration_out)  # -> out, trajectory
# ---------- plan_motion: Python ----------
# venv: compas_fab
from compas_fab.robots import ConfigurationTarget
configuration_target = ConfigurationTarget(target_configuration)

trajectory = planner.plan_motion(configuration_target, start_state)
# ---------- end plan_motion ----------
number_slider_3 = Slider(0, range=0..1)  # disabled
box_rigid_body = GhPythonScript(name=panel_2, x_size=number_slider, y_size=number_slider, z_size=number_slider_2)  # -> out, rigid_body; disabled
# ---------- box_rigid_body: Python ----------
from compas_fab.robots import RigidBody

from compas.geometry import Box

box_visual = Box(x_size, y_size, z_size)
box_collision = Box(x_size, y_size, z_size)

rigid_body = RigidBody([box_visual.to_mesh()], [box_collision.to_mesh()])
if name:
    rigid_body.name = name
# ---------- end box_rigid_body ----------
visualize_trajectory = Python3Script(start_state=change_configuration_2.robot_cell_state_out, trajectory=plan_motion.trajectory, fraction=number_slider_3)  # -> out, robot_cell_state_out; disabled
# ---------- visualize_trajectory: Python ----------
from compas_robots import Configuration

# Convert fraction number to index of trajectory point
config_index = round(fraction * (len(trajectory.points)-1))
print(config_index)

# The start_configuration of the trajectory has names and joint type info
configuration = trajectory.start_configuration.copy()
configuration.joint_values =  trajectory.points[config_index].joint_values

# Merge configuration with a copy of the state
robot_cell_state_out = start_state.copy()
robot_cell_state_out.robot_configuration.merge(configuration)
# ---------- end visualize_trajectory ----------
visualization_3 = Python3Script(robot_cell=load_robot_cell.robot_cell, robot_cell_state=visualize_trajectory.robot_cell_state_out)  # -> out, native_geometry; disabled; same code as visualization
