# Grasshopper definition kitchen_sink_2.gh (Grasshopper 1.0.8)
# plug-ins: RhinoCodePluginGH

script = Script(unload_module=Button())  # -> out, a
# ---------- script: Python ----------
# r: compas, compas_robots, roslibpy
# venv: compas_fab_dev

from compas_rhino import unload_modules

import scriptcontext as sc
if unload_module:
    unload_modules('compas')
    unload_modules('compas_fab')
    sc.sticky.clear()
# ---------- end script ----------
number_slider = Slider(0.3, range=0..1)
number_slider_2 = Slider(0.3, range=0..1)
script_2 = Script()  # -> out, a
# ---------- script_2: Python ----------
# r: compas, compas_robots, roslibpy, scipy
# venv: compas_fab_dev

# import sys
# path_to_cf = "C:/Users/leungp/Documents/GitHub/compas_fab/src"
# if path_to_cf not in sys.path:
#     sys.path.append(path_to_cf)

import compas
print(compas.__file__)
print(compas.__version__)

import compas_fab
print(compas_fab.__file__)
print(compas_fab.__version__)
# ---------- end script_2 ----------
python_3_script = Python3Script(x=script_2.a)  # -> out, robot_cell, robot_cell_state
# ---------- python_3_script: Python ----------
# venv: compas_fab_dev

from compas_fab.robots import RobotCell
from compas_fab.robots import RobotCellState
from compas_fab.robots import RigidBodyState
from compas.geometry import Box
from compas.geometry import Frame

#from compas_fab.ghpython.scene import *


from compas_fab.robots import RobotCellLibrary
robot_cell = RobotCell()
robot_cell, robot_cell_state = RobotCellLibrary.abb_irb4600_40_255_gripper_one_beam()
#robot_cell, robot_cell_state = RobotCellLibrary.abb_irb4600_40_255()

if rigid_bodies:
    assert len(set([rb.name for rb in rigid_bodies])) == len(rigid_bodies)
    for rb in rigid_bodies:
        assert rb.name
        robot_cell.rigid_body_models[rb.name] = rb
        robot_cell_state.rigid_body_states[rb.name] = RigidBodyState(Frame.worldXY())

robot_cell_state = robot_cell.default_cell_state()
# ---------- end python_3_script ----------
python_3_script_2 = Python3Script()  # -> out, a
# ---------- python_3_script_2: Python ----------
from compas_fab.robots import RigidBody

from compas.geometry import Box

box_visual = Box(x_size, y_size, z_size)
box_collision = Box(x_size, y_size, z_size)

rigid_body = RigidBody([box_visual.to_mesh()], [box_collision.to_mesh()])
if name:
    rigid_body.name = name
# ---------- end python_3_script_2 ----------
box_rigid_body = GhPythonScript(name="boxy", x_size=number_slider, y_size=number_slider, z_size=Slider(0.3, range=0..1))  # -> out, rigid_body; same code as python_3_script_2
box_rigid_body_2 = GhPythonScript(name="tally", x_size=number_slider_2, y_size=number_slider_2, z_size=Slider(0.6, range=0..1))  # -> out, rigid_body; same code as python_3_script_2
robot_cell_test = GhPythonScript()  # -> out, robot_cell, robot_cell_state; inputs rigid_bodies: list
# ---------- robot_cell_test: Python ----------
from compas_fab.robots import RobotCell
from compas_fab.robots import RobotCellState
from compas_fab.robots import RigidBodyState
from compas.geometry import Box
from compas.geometry import Frame

#from compas_fab.ghpython.scene import *


from compas_fab.robots import RobotCellLibrary
robot_cell = RobotCell()
robot_cell, robot_cell_state = RobotCellLibrary.abb_irb4600_40_255_gripper_one_beam()
#robot_cell, robot_cell_state = RobotCellLibrary.abb_irb4600_40_255()

assert len(set([rb.name for rb in rigid_bodies])) == len(rigid_bodies)
for rb in rigid_bodies:
    assert rb.name
    robot_cell.rigid_body_models[rb.name] = rb
    robot_cell_state.rigid_body_states[rb.name] = RigidBodyState(Frame.worldXY())

#robot_cell_state = RobotCellState.from_robot_cell(robot_cell)
# ---------- end robot_cell_test ----------
robot_cell_test_2 = GhPythonScript(rigid_bodies=[box_rigid_body.rigid_body, box_rigid_body_2.rigid_body])  # -> out, robot_cell, robot_cell_state; inputs rigid_bodies: list; same code as robot_cell_test
number_slider_3 = Slider(4.23, range=0..10)  # disabled
number_slider_4 = Slider(0, range=0..10)  # disabled
number_slider_5 = Slider(0, range=0..10)  # disabled
number_slider_6 = Slider(0.38, range=0..1)  # disabled
ghpython_script = GhPythonScript(robot_cell=robot_cell_test_2.robot_cell)  # -> out, a
# ---------- ghpython_script: Python ----------
for link in robot_cell.robot_model.links:
    print(link.name)
    for visual in link.visual:
        print(visual.origin)
# ---------- end ghpython_script ----------
construct_point = ConstructPoint(XCoordinate=Slider(0, range=0..1), YCoordinate=0, ZCoordinate=0)
change_robot_config = GhPythonScript(
    robot_cell_state=robot_cell_test_2.robot_cell_state,
    j1=Slider(0.16, range=0..10),
    j2=Slider(1.6, range=0..10),
    j3=Slider(1.08, range=0..10))  # -> out, new_robot_cell_state
# ---------- change_robot_config: Python ----------
new_robot_cell_state = robot_cell_state.copy()
new_robot_cell_state.robot_configuration.joint_values[0] = j1
new_robot_cell_state.robot_configuration.joint_values[1] = j2
new_robot_cell_state.robot_configuration.joint_values[2] = j3
new_robot_cell_state.robot_configuration.joint_values[3] = j4
new_robot_cell_state.robot_configuration.joint_values[4] = j5
new_robot_cell_state.robot_configuration.joint_values[5] = j6
# ---------- end change_robot_config ----------
change_robot_config_2 = GhPythonScript(robot_cell_state=robot_cell_test_2.robot_cell_state, j1=number_slider_5, j2=number_slider_3, j3=number_slider_4)  # -> out, new_robot_cell_state; disabled; same code as change_robot_config
construct_point_2 = ConstructPoint(XCoordinate=number_slider_6, YCoordinate=0, ZCoordinate=0)  # disabled
xy_plane = XYPlane(Origin=construct_point)
xy_plane_2 = XYPlane(Origin=construct_point_2)  # disabled
change_robot_base_frame = GhPythonScript(robot_cell_state=change_robot_config.new_robot_cell_state, plane=xy_plane)  # -> out, new_robot_cell_state; inputs plane: Plane
# ---------- change_robot_base_frame: Python ----------
new_robot_cell_state = robot_cell_state.copy()

from compas.geometry import Frame
from compas_rhino.conversions import plane_to_compas_frame

frame = plane_to_compas_frame(plane)
assert isinstance(frame, Frame)
new_robot_cell_state.robot_base_frame = frame
# ---------- end change_robot_base_frame ----------
change_robot_base_frame_2 = GhPythonScript(robot_cell_state=change_robot_config_2.new_robot_cell_state, plane=xy_plane_2)  # -> out, new_robot_cell_state; inputs plane: Plane; disabled; same code as change_robot_base_frame
robot_cell_explode = GhPythonScript(robot_cell=robot_cell_test_2.robot_cell)  # -> out, robot_model, robot_semantics, tool_ids, tool_models, rigid_body_ids, rigid_body_models
# ---------- robot_cell_explode: Python ----------
robot_model = robot_cell.robot_model
robot_semantics = robot_cell.robot_semantics
tool_ids = robot_cell.tool_ids
tool_models = list(robot_cell.tool_models.values())
rigid_body_ids = robot_cell.rigid_body_ids
rigid_body_models = list(robot_cell.rigid_body_models.values())
# ---------- end robot_cell_explode ----------
panel = Panel(robot_cell_explode.rigid_body_ids)
construct_point_3 = ConstructPoint(XCoordinate=0, YCoordinate=Slider(1, range=0..1), ZCoordinate=0)
visualize_object = GhPythonScript(object=flatten(robot_cell_test_2.robot_cell), object_state=flatten(change_robot_base_frame_2.new_robot_cell_state))  # -> out, draw; inputs draw_collision: Boolean, draw_visual: Boolean; disabled
# ---------- visualize_object: Python ----------
import scriptcontext as sc
from compas.scene import SceneObject
from compas.scene import Scene

from compas_fab.ghpython.components import create_id

debug = True
def debug_print(s):
    if debug:
        print(s)

# Create hash (scope limited to this component) for cacheing SceneObject
# The Data.sha256 function includes the guid of the compas object
#object_hash = object.sha256(as_string=True)
# The ID function is much faster than the sha256()
object_hash = id(object)
# The ghenv.Component has a guid assigned by GH to each component instance
gh_component = ghenv.Component
sticky_id = create_id(gh_component, object_hash)
debug_print("Cacheing ID: '{}'".format(sticky_id))


# If scene object exist in sticky
scene_object = None
if sc.sticky.has_key(sticky_id):
    scene_object = sc.sticky[sticky_id]
    # Double check if the item is the same
    if scene_object.item is object:
        debug_print("SceneObject '{}' reused for '{}'".format(type(scene_object).__name__, type(object).__name__))

# Create Scene Object
if scene_object is None:
    scene = Scene()
    scene_object = scene.add(object)
    debug_print("SceneObject {} newly created for {}".format(type(scene_object).__name__, type(object).__name__))
    sc.sticky[sticky_id] = scene_object

# Update Object State and draw
print(type(scene_object))

print(type(scene_object.robot_model_scene_object))
draw = scene_object.draw(object_state)

for m in scene_object.robot_model_scene_object.links_visual_mesh_transformation.values():
    print(m)
# This script will leak memory due to unused and untracked sceneobject in sticky
# ---------- end visualize_object ----------
xy_plane_3 = XYPlane(Origin=construct_point_3)

ghpython_script_2 = GhPythonScript(robot_cell_state=change_robot_base_frame.new_robot_cell_state)  # -> out, rigid_body_ids, rigid_body_states
# ---------- ghpython_script_2: Python ----------
rigid_body_ids = robot_cell_state.rigid_body_ids
rigid_body_states = [robot_cell_state.rigid_body_states[id] for id in rigid_body_ids]
# ---------- end ghpython_script_2 ----------
list_item = ListItem(List=ghpython_script_2.rigid_body_states, Index=0, Wrap=True)  # -> Item, Item1
ghpython_script_3 = GhPythonScript(rigid_body_state=ghpython_script_2.rigid_body_states)  # -> out, rigid_body_states
# ---------- ghpython_script_3: Python ----------
frame = rigid_body_state.frame
print(frame)
# ---------- end ghpython_script_3 ----------
change_rigidbodystate = GhPythonScript(rigid_body_state=list_item.Item1, plane=xy_plane_3)  # -> out, new_rigid_body_state
# ---------- change_rigidbodystate: Python ----------
from compas_rhino.conversions import plane_to_compas_frame

new_rigid_body_state = rigid_body_state.copy()
if plane:
    frame = plane_to_compas_frame(plane)
    new_rigid_body_state.frame = frame
if attached_to_link:
    new_rigid_body_state.attached_to_link = attached_to_link
if attached_to_tool:
    new_rigid_body_state.attached_to_tool = attached_to_tool
# ---------- end change_rigidbodystate ----------
panel_2 = Panel(ghpython_script_2.rigid_body_ids)
merge = Merge(Data1=list_item.Item, Data2=change_rigidbodystate.new_rigid_body_state)
change_rigidbodystate_2 = GhPythonScript(
    robot_cell_state=change_robot_base_frame.new_robot_cell_state,
    rigid_body_ids=ghpython_script_2.rigid_body_ids,
    rigid_body_states=merge)  # -> out, new_robot_cell_state; inputs rigid_body_ids: list, rigid_body_states: list
# ---------- change_rigidbodystate_2: Python ----------
new_robot_cell_state = robot_cell_state.copy()

for id, state in zip(rigid_body_ids, rigid_body_states):
    new_robot_cell_state.rigid_body_states[id] = state.copy()
# ---------- end change_rigidbodystate_2 ----------

panel_3 = Panel(visualize_object.out)  # disabled

visualization_scale = Slider(1, range=0..2)
panel_4 = Panel("0.5")
vis_options = GhPythonScript(draw_collision=Toggle(True), draw_visual=Toggle(False), scale=visualization_scale)  # -> out, options; inputs draw_collision: Boolean, draw_visual: Boolean
# ---------- vis_options: Python ----------
from compas.data import Data
class RobotCellVisualizationOptions(Data):
    def __init__(self, draw_collision, draw_visual, scale):
        super(RobotCellVisualizationOptions, self).__init__()
        self.draw_collision = draw_collision
        self.draw_visual = draw_visual
        self.scale = scale

    @property
    def __data__(self):
        data = {
            'draw_collision': self.draw_collision,
            'draw_visual': self.draw_visual,
            'scale': self.scale,
            }
        return data

options = RobotCellVisualizationOptions(draw_collision, draw_visual, scale)

print(options.sha256(True))
# ---------- end vis_options ----------

visualize_object_2 = GhPythonScript(
    object=flatten(robot_cell_test_2.robot_cell),
    object_state=flatten(change_rigidbodystate_2.new_robot_cell_state),
    vis_options=vis_options.options)  # -> out, draw
# ---------- visualize_object_2: Python ----------
import scriptcontext as sc
from compas.scene import SceneObject
from compas.scene import Scene

from compas_fab.ghpython.components import create_id

# This script will leak memory due to unused and untracked sceneobject in sticky

debug = True
def debug_print(s):
    if debug:
        print(s)

# Create hash (scope limited to this component) for cacheing SceneObject
# The Data.sha256 function includes the guid of the compas object
#object_hash = object.sha256(as_string=True)
# The ID function is much faster than the sha256()
object_hash = str(id(object))
options_hash = vis_options.sha256(True)
# The ghenv.Component has a guid assigned by GH to each component instance
gh_component = ghenv.Component
sticky_id = create_id(gh_component, object_hash +"_"+ options_hash)
debug_print("Cacheing ID: '{}'".format(sticky_id))


# If scene object exist in sticky
scene_object = None
if sc.sticky.has_key(sticky_id):
    scene_object = sc.sticky[sticky_id]
    # Double check if the item is the same
    if scene_object.item is object:
        debug_print("SceneObject '{}' reused for '{}'".format(type(scene_object).__name__, type(object).__name__))

# Create Scene Object
if scene_object is None:
    scene = Scene()
    kwargs = vis_options.__data__
    scene_object = scene.add(object, **kwargs)
    debug_print("SceneObject {} newly created for {}".format(type(scene_object).__name__, type(object).__name__))
    sc.sticky[sticky_id] = scene_object

print(scene_object._scale)
draw = scene_object.draw(object_state)
# ---------- end visualize_object_2 ----------
panel_5 = Panel(visualize_object_2.out)
