# Grasshopper definition model.gh (Grasshopper 0.9.76)
# plug-ins: Python Interpreter

# ----
# set path
# set path
# set path
# set path
# set path
# set path
# set path
# force
# force
# force
# force
# force
# force
# angleA
# angleA
# angleA
# angleA
# angleA
# angleA
# angleB
# angleB
# angleB
# angleB
# angleB
# angleB
# speed
# speed
# speed
# speed
# speed
# speed
# force
# force
# force
# force
# force
# force
# angleA
# angleA
# angleA
# angleA
# angleA
# angleA
# angleA
# angleA
# angleA
# angleA
# angleA
# angleA
# angleA
# angleB
# angleB
# angleB
# angleB
# angleB
# angleB
# speed
# speed
# speed
# speed
# speed
# speed
# speed
# speed
# speed
# speed
# speed
# speed
# speed
# data for further calculation
# data for further calculation
# data for further calculation
# data for further calculation
# data for further calculation
# data for further calculation
# angleA
# angleB
# speed
# force
# Check your IP address and set UR IP address
# angleA
# angleB
# speed
server_port = Integer(30003)
ur_ip = ValueList({"192.168.10.11", "192.168.10.10", "127.0.0.1"}, selected="192.168.10.10")
# angleB
# speed
# data for further calculation
# material resistance
# force
# Settings
server_address = ValueList({"192.168.10.12", "192.168.10.11", "127.0.0.1"}, selected="192.168.10.11")
globals = PythonScript(server_address=server_address, server_port=server_port, ur_ip=ur_ip)  # inputs server_port: Int32
# ---------- globals: Python ----------
from scriptcontext import sticky as st

st["server_address"] = server_address
st["server_port"] = server_port

st["ur_ip"] = ur_ip
# ---------- end globals ----------

# ----
# Check if UR is available
ping = Button()
py = PythonScript(ip=ur_ip, ping=ping)  # -> out
# ---------- py: Python ----------
from scriptcontext import sticky as st
from ur_online_control.communication import is_available


guid = str(ghenv.Component.InstanceGuid)
txt_key = "txt_" + guid
if txt_key not in st:
    st[txt_key] = ""

if ping:
    
    available = is_available(ip)
    
    if available:
        st[txt_key] = "%s is up!" % ip
    else:
        st[txt_key] = "%s is down!" % ip

print st[txt_key]
# ---------- end py ----------
panel = Panel(py)

# ---- group: Define path
# Planning
# material resistance
# angleA
# material resistance
# angleB
# force
# speed
# angleA
# angleB
# force
# speed
# angleA
# angleB
# force
# speed
# angleA
# angleB
# speed
# material resistance
# force
# angleA
# angleB
# speed
# force
# angleA
# angleB
# speed
# material resistance
# material resistance
# material resistance
# force
# force
# force
# angleA
# angleA
# angleA
# angleB
# angleB
# angleB
# speed
# speed
# speed
# force
# force
# force
# angleA
# angleA
# angleA
# angleB
# angleB
# angleB
# speed
# speed
# speed
number = Slider(30, range=0..100)
Z = UnitZ(Factor=1)
crv = Curve(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)
py_2 = PythonScript(crv=crv, number=number, normal=Z)  # -> planes
# ---------- py_2: Python ----------
import Rhino.Geometry as rg

normal.Unitize()

# 1. Divide curve
params = rg.Curve.DivideByCount(crv, number - 1, True)
planes = []
for param in params:
    point = rg.Curve.PointAt(crv, param)
    tangent = rg.Curve.TangentAt(crv, param)
    tangent.Unitize()
    # tangent = xaxis, normal is given, so we calculate yaxis
    yaxis = rg.Vector3d.CrossProduct(normal, tangent)
    yaxis.Unitize()
    planes.append(rg.Plane(point, tangent, yaxis))
    
print len(params)
# ---------- end py_2 ----------

# ----
panel_2 = Panel("Unload libraries")
bang = Button()
unload = PythonScript(bang=bang)
# ---------- unload: Python ----------
from compas_fab.fab.grasshopper.utilities import unload_modules

unload_modules("compas")
# ---------- end unload ----------

# ---- group: Robot
# 1. load robot model
# 2. set tool
# 3. set basis
list = ValueList({"no_tool": 0, "measurement_tool": 1, "gripper": 2}, selected="measurement_tool")
tools = Tools(tool_id=list)
base = PythonScript()  # -> base_frame
# ---------- base: Python ----------
from compas_fab.fab.geometry import Frame

"""
origin = [-478.32, -214.49, -194.35]
xaxis = [0.00832, 0.99996, -0.00275]
yaxis = [-0.99990, 0.00835, 0.01182]

"""
origin = [0, 0, 0]
xaxis = [1, 0, 0]
yaxis = [0, 1, 0]

base_frame = Frame(list(origin), list(xaxis), list(yaxis))
# ---------- end base ----------
list_2 = ValueList({"UR5", "UR10"}, selected="UR10")
robot = PythonScript(model=list_2, tool=tools, base_frame=base)  # -> robot
# ---------- robot: Python ----------
from compas_fab.fab.robots.ur.ur10 import UR10
from compas_fab.fab.robots.ur.ur5 import UR5
from scriptcontext import sticky as st

if model == "UR5":
    robot = UR5()
elif model == "UR10":
    robot = UR10()

if tool:
    robot.set_tool(tool)
if base_frame:
    robot.set_base(base_frame)

st["robot"] = robot
# ---------- end robot ----------
robot_2 = Data(robot)

# ----
# Visualisation
pose_joints = Data()
planes_wcs = Plane(py_2)
robot_3 = Data(robot_2)

# ---- group: Calculate joint positions for path
# Add init joint states
joint_states = Data([-0.1728179112, -1.415058186, 1.813991282, -1.971940356, -1.571654205, -3.308720436])
init_configuration = Slider(2, range=0..7)
py_3 = PythonScript(robot=robot_3, planes_WCS=planes_wcs, configuration_idx=init_configuration, init_configuration=joint_states)  # -> configurations; inputs planes_WCS: list, configuration_idx: Int32, init_configuration: list
# ---------- py_3: Python ----------
import Rhino.Geometry as rg
from compas_fab.fab.geometry import Frame, Transformation
from compas_fab.fab.grasshopper import xdraw_frame
from compas_fab.fab.robots.ur.kinematics import calculate_configurations_for_path, format_joint_positions


# TODO this must be optimized! matrix multiplication!
frames_tool0_RCS = []
for plane_WCS in planes_WCS:
    tcp_WCS = Frame(plane_WCS.Origin, plane_WCS.XAxis, plane_WCS.YAxis)
    tcp_RCS = robot.get_frame_in_RCS(tcp_WCS)
    frames_tool0_RCS.append(robot.get_tool0_frame_from_tcp_frame(tcp_RCS))
    

configurations = calculate_configurations_for_path(frames_tool0_RCS, robot, init_configuration)

configurations = configurations[min([configuration_idx, len(configurations) - 1])]

def format(numbers, k=4):
    #numbers = format_joint_positions(numbers)
    return "[" + ", ".join([("%." + str(k) + "f") % n for n in numbers]) + "]"

print "Q1 = ", format(configurations[0])
print "Q2 = ", format(configurations[10])
print "Q3 = ", format(configurations[20])

"""
Q1 =  [-0.1727, -1.4144, 1.8145, -1.9709, -1.5708, 2.9757]
Q2 =  [-0.6497, -1.4872, 1.7623, -1.7329, -1.7115, -2.4608]
Q3 =  [-1.2111, -1.9716, 2.4040, -1.9940, -1.6098, -2.9102]
"""
# ---------- end py_3 ----------
start = Button()
stop = Button()
step = Button()
counter = CountThroughList(L=py_3, start=start, stop=stop, step=step, interval=100)  # -> item; inputs L: list, start: Boolean, stop: Boolean
# ---------- counter: Python ----------
from scriptcontext import sticky as st
from compas_fab.fab.grasshopper import gh_component_timer


# store data in component
guid = str(ghenv.Component.InstanceGuid)
counter_key = "counter_" + guid
running_key = "running_" + guid

if counter_key not in st:
    st[counter_key] = 0

if running_key not in st:
    st[running_key] = False

if start:
    st[running_key] = True

if stop:
    st[running_key] = False

if step:
    if st[counter_key] < len(L) - 1:
        st[counter_key] += 1
    
if len(L):
    item = L[st[counter_key]]

if st[running_key]:
    if st[counter_key] < len(L) - 1:
        st[counter_key] += 1
        gh_component_timer(ghenv, interval)
    else:
        st[counter_key] = 0
        st[running_key] = False
# ---------- end counter ----------

# ---- group: Define plane in WCS, calculate joint positions
select_configuration = Slider(0, range=0..7)
pt = Point(Point(-360.5993803, 127.1359598, 433.9356602))
xy = XYPlane(Origin=pt)
plane_wcs = Plane(xy)
inverse = PythonScript(robot=robot_3, plane_WCS=plane_wcs, idx=select_configuration)  # -> configuration; inputs plane_WCS: Plane, idx: Int32
# ---------- inverse: Python ----------
import Rhino.Geometry as rg
from compas_fab.fab.geometry import Frame, Transformation
from compas_fab.fab.grasshopper import xdraw_frame

tcp_WCS = Frame(plane_WCS.Origin, plane_WCS.XAxis, plane_WCS.YAxis)

# transform frame to robot coordinate system
tcp_RCS = robot.get_frame_in_RCS(tcp_WCS)

# get the frame of tool0
tool0_RCS = robot.get_tool0_frame_from_tcp_frame(tcp_RCS)

# calculate solutions to frame
solutions = robot.inverse_kinematics(tool0_RCS)

if not len(solutions):
    q = [0,0,0,0,0,0]
else:
    idx = min(len(solutions) - 1, idx)
    q = solutions[idx]
    
print q

configuration = q
# ---------- end inverse ----------

# ---- group: Calculate joint positions for path / Shows joint positions along path
flip = BooleanToggle(True)
l2t = PythonScript(L=py_3, flip=flip)  # -> T; inputs L: list, flip: Boolean
# ---------- l2t: Python ----------
from compas_fab.fab.grasshopper import list_to_tree

if flip:
    L = zip(*L)
T = list_to_tree(L)
# ---------- end l2t ----------
graph = QuickGraph(l2t)

# ---- group: Define joint positions
elbow = Slider(158.393, range=-360..360)
wrist2 = Slider(89, range=-360..360)
base_2 = Slider(-214.102, range=-360..360)
shoulder = Slider(-57.05, range=-360..360)
wrist1 = Slider(-108.821, range=-360..360)
wrist3 = Slider(-33.607, range=-360..360)
ur1_q1_q6 = Data([base_2, wrist3, shoulder, wrist2, elbow, wrist1])
rad = Radians(Degrees=ur1_q1_q6)

# ---- group: Visualise / robot model brep
py_4 = PythonScript(model=list_2)  # -> n
# ---------- py_4: Python ----------
if model == "UR5":
    n = 0
if model == "UR10":
    n = 1

print n
# ---------- end py_4 ----------
ur10_brep = UR10Brep([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])
ur5_brep = UR5Brep([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])
show_brep = BooleanToggle(False)
filter = StreamFilter(Gate=py_4, Stream0=ur5_brep, Stream1=ur10_brep)

# ---- group: Visualise
list_3 = ValueList({"0 forward, from angles": 0, "1 inverse, from one plane": 1, "2 inverse, from multiple planes": 2, "3 forward, from robot": 3}, selected="2 inverse, from multiple planes")
filter_2 = StreamFilter(Gate=list_3, Stream0=rad, Stream1=inverse, Stream2=counter, Stream3=pose_joints)
configuration = Panel(filter_2)
mesh = Mesh(filter)
draw = PythonScript(robot=robot_3, configuration=filter_2, mesh=mesh, brep=filter, show_brep=show_brep)  # -> meshes, tool0_plane, tcp_plane, robot_brep; inputs configuration: list, mesh: list, brep: list
# ---------- draw: Python ----------
from compas_fab.fab.grasshopper import xdraw_frame
from compas_fab.fab.grasshopper import draw_mesh 
from compas_fab.fab.grasshopper import xform_from_transformation
from compas_fab.fab.geometry import Frame, Transformation
from compas_fab.fab.geometry.helpers import mesh_update_vertices

import Rhino.Geometry as rg
import Rhino

q = configuration

R0, R1, R2, R3, R4, R5 = robot.get_forward_transformations(q)

tool0_frame2 = robot.tool0_frame.transform(R5, copy=True)
tcp_frame2 = Frame.from_transformation(Transformation.from_frame(tool0_frame2) * robot.transformation_tool0_tcp)

print robot.transformation_tool0_tcp
print robot.transformation_tcp_tool0
print robot.transformation_tool0_tcp * robot.transformation_tcp_tool0
print tcp_frame2
tcp_frame2 = Frame.from_transformation(Transformation.from_frame(tool0_frame2) * robot.transformation_tcp_tool0)
print tcp_frame2


tool0_frame, tcp_frame = robot.get_transformed_tool_frames(R5)

tool0_frame = tool0_frame2
tcp_frame = tcp_frame2

m0, m1, m2, m3, m4, m5 = mesh
for i in range(6):
    exec("R%drg = xform_from_transformation(R%d)" % (i, i))
    exec("m%d.Transform(R%drg)" % (i, i))
meshes = [m0, m1, m2, m3, m4, m5]

mt = robot.get_transformed_tool_model(tcp_frame)
if mt:
    meshes.append(draw_mesh(mt))

"""
m0, m1, m2, m3, m4, m5, tool0_frame, tcp_frame = robot.get_transformed_model(q)
mt = robot.get_transformed_tool_model(tcp_frame)

meshes = []
meshes.append(draw_mesh(m0))
meshes.append(draw_mesh(m1))
meshes.append(draw_mesh(m2))
meshes.append(draw_mesh(m3))
meshes.append(draw_mesh(m4))
meshes.append(draw_mesh(m5))
if mt:
    meshes.append(draw_mesh(mt))

"""

tool0_plane = xdraw_frame(tool0_frame)
tcp_plane = xdraw_frame(tcp_frame)

if show_brep:
    
    b0, b1, b2, b3, b4, b5 = brep
    
    b0.Transform(R0rg)
    b1.Transform(R1rg)
    b2.Transform(R2rg)
    b3.Transform(R3rg)
    b4.Transform(R4rg)
    b5.Transform(R5rg)
    
    robot_brep = [b0, b1, b2, b3, b4, b5]
# ---------- end draw ----------
robot_brep = Brep(draw.robot_brep)
tcp_plane = Plane(draw.tcp_plane)
tool0_plane = Plane(draw.tool0_plane)
draw_2 = RepresentPlaneAsLines(plane=tcp_plane, size=100)  # -> G, C
# ---------- draw_2: Python ----------
import Rhino.Geometry as rg
from System.Drawing import Color

if plane:

    G = []
    G.append(rg.Line(plane.Origin, size * plane.XAxis))
    G.append(rg.Line(plane.Origin, size * plane.YAxis))
    G.append(rg.Line(plane.Origin, size * plane.ZAxis))
    
    C = []
    C.append(Color.FromArgb(255, 0, 0))
    C.append(Color.FromArgb(0, 255, 0))
    C.append(Color.FromArgb(0, 0, 255))
# ---------- end draw_2 ----------
preview = CustomPreview(Geometry=draw.meshes, Shader=ColourSwatch(SwatchColor=RGBA(99, 94, 94, 96)))
preview_2 = CustomPreview(Geometry=draw_2.G, Shader=draw_2.C)

# ---- group: breps
base_shoulder = Brep(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)
upperarm = Brep(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)
forearm = Brep(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)
wrist3_2 = Brep(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)
wrist1_2 = Brep(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)
wrist2_2 = Brep(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)

base_shoulder_2 = Brep(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)
upperarm_2 = Brep(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)
forearm_2 = Brep(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)
wrist1_3 = Brep(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)
wrist2_3 = Brep(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)
wrist3_3 = Brep(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)

# ----
ur10_geo = Brep([base_shoulder_2, wrist2_3, upperarm_2, wrist1_3, forearm_2, wrist3_3])
# inclination_length for 2, 4, 10, 15
# inclination_length for 30
# Calculate edge curves
ur5_brep_2 = Brep([base_shoulder, upperarm, forearm, wrist1_2, wrist2_2, wrist3_2])

# ==== cluster Tools
tool_id = ClusterInput()

yaxis_line = Curve(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)
xaxis_line = Curve(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)
test_geometry = Geometry([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])
mesh = Mesh(test_geometry)
brep = Brep(test_geometry)
tool = Tool(M=mesh, brep=brep, xline=xaxis_line, yline=yaxis_line)

# ---- group: measurement tool
measurement_tool_geo = Geometry([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])
tool_2 = PythonScript(brep=measurement_tool_geo)  # -> tool; inputs brep: list
# ---------- tool_2: Python ----------
from compas_fab.fab.robots.ur.tools import MeasurementTool

tool = MeasurementTool()
tool.brep = brep
# ---------- end tool_2 ----------

# ----
tool_id_2 = Integer(tool_id)
filter = StreamFilter(Gate=tool_id_2, Stream1=tool_2, Stream2=tool)
py = PythonScript(tool=filter)  # -> tcp_frame, model
# ---------- py: Python ----------
from compas_fab.fab.grasshopper import draw_mesh 

tcp_frame = tool.tcp_frame
model = draw_mesh(tool.model)
# ---------- end py ----------
tool_3 = Data(filter)
draw = PythonScript(frame=py.tcp_frame)  # -> G, C
# ---------- draw: Python ----------
import Rhino.Geometry as rg
from System.Drawing import Color

if not size:
    size = 100

if frame:
    
    plane = rg.Plane(rg.Point3d(*frame.point), rg.Vector3d(*frame.xaxis), rg.Vector3d(*frame.yaxis))

    G = []
    G.append(rg.Line(plane.Origin, size * plane.XAxis))
    G.append(rg.Line(plane.Origin, size * plane.YAxis))
    G.append(rg.Line(plane.Origin, size * plane.ZAxis))
    
    C = []
    C.append(Color.FromArgb(255, 0, 0))
    C.append(Color.FromArgb(0, 255, 0))
    C.append(Color.FromArgb(0, 0, 255))
# ---------- end draw ----------
tool_4 = ClusterOutput(tool_3)
preview = CustomPreview(Geometry=draw.G, Shader=draw.C)
preview_2 = CustomPreview(Geometry=py.model, Shader=ColourSwatch(SwatchColor=RGB(141, 170, 178)))

# ==== cluster Tool
M = ClusterInput()
mjoin = MeshJoin(Meshes=M)
brep = ClusterInput()
xline = ClusterInput()
yline = ClusterInput()
tool = PythonScript(mesh=mjoin, brep=brep, xline=xline, yline=yline)  # -> tool; inputs mesh: Mesh, brep: list
# ---------- tool: Python ----------
import Rhino.Geometry as rg
from compas_fab.fab.geometry import Frame
from compas_fab.fab.robots import Tool
from compas.datastructures.mesh import Mesh

xaxis = rg.Line(xline.PointAtStart, xline.PointAtEnd)
yaxis = rg.Line(yline.PointAtStart, yline.PointAtEnd)

if xaxis.From.DistanceTo(yaxis.From) < 0.01:
    origin = xaxis.From
    xaxis = xaxis.Direction
    yaxis = yaxis.Direction
elif xaxis.To.DistanceTo(yaxis.To) < 0.01:
    origin = xaxis.To
    xaxis = -xaxis.Direction
    yaxis = -yaxis.Direction
elif xaxis.From.DistanceTo(yaxis.To) < 0.01:
    origin = xaxis.From
    xaxis = xaxis.Direction
    yaxis = -yaxis.Direction
elif xaxis.To.DistanceTo(yaxis.From) < 0.01:
    origin = xaxis.To
    xaxis = -xaxis.Direction
    yaxis = yaxis.Direction

xaxis.Unitize()
yaxis.Unitize()

print origin
print xaxis
print yaxis

tcp_frame = Frame(origin, xaxis, yaxis)
vertices = [[v.X, v.Y, v.Z] for v in mesh.Vertices]
faces = map(list, mesh.Faces)

tool = Tool(tcp_frame)
tool.model = Mesh.from_vertices_and_faces(vertices, faces)
tool.model_xyz = tool.model.xyz
tool.brep = brep
# ---------- end tool ----------
tool_2 = ClusterOutput(tool)
