# Grasshopper definition UR10_model.gh (Grasshopper 0.9.76)
# plug-ins: Python Interpreter

use_brep = BooleanToggle(False)
ur10_model = UR10Model(use_brep=use_brep)  # -> ur10_axes_2, ur5_geo_2, ur10_tp_2, ur10_workspace_2
set_robot = PythonScript(
    joint_axes=ur10_model.ur10_axes_2,
    link_geo=ur10_model.ur5_geo_2,
    tcp_plane=ur10_model.ur10_tp_2,
    workspace_geo=ur10_model.ur10_workspace_2)  # -> ur10; inputs joint_axes: list, link_geo: list
# ---------- set_robot: Python ----------
from mas_lib.robots import Robot

ur10 = Robot(link_geo, joint_axes, tcp_plane, workspace_geo)
# ---------- end set_robot ----------

list = ValueList({"measurement tool": 0}, selected="measurement tool")
ur1_base = PythonScript()  # -> base_plane
# ---------- ur1_base: Python ----------
import Rhino.Geometry as rg

origin = rg.Point3d(0,0,0)
x_axis = rg.Vector3d.XAxis
y_axis = rg.Vector3d.YAxis
z_axis = rg.Vector3d.ZAxis

"""
origin = rg.Point3d(350, -1150.0, -500)
x_axis = rg.Vector3d(0, 1, 0)
y_axis = rg.Vector3d(-1, 0, 0)
z_axis = rg.Vector3d(0, 0, 1)

# measured base
origin = rg.Point3d( -8.53783,522.092,-368.686 )
x_axis = rg.Vector3d( -0.0382537622225462,0.999200355098442,-0.0116318548378337 )
y_axis = rg.Vector3d( -0.999256972508005,-0.0381959188496163,0.00515506327500067 )
z_axis = rg.Vector3d( 0.00470665167147919,0.0118204126146703,0.999919059362138 )

origin = rg.Point3d( -12.4393,650.147,-367.116 )
x_axis = rg.Vector3d( -0.0355719657899595,0.999346086970958,-0.00648334062606253 )
y_axis = rg.Vector3d( -0.999353483146585,-0.0355368444158786,0.00545421046072267 )
z_axis = rg.Vector3d( 0.00522024641431573,0.00667316602500141,0.999964108297181 )
"""

# adjustment
#origin += z_axis * -5.139135
#origin += z_axis * -9.262913

# origin is +300mm in RCS xaxis 
#origin += x_axis * 300

base_plane = rg.Plane(origin, x_axis, y_axis)
# ---------- end ur1_base ----------
tool = Tool(tool_id=list)
set_tool_and_base = PythonScript(ur5=set_robot, tool=tool, base_plane=ur1_base)  # -> out, ur5
# ---------- set_tool_and_base: Python ----------
ur5.set_tool(tool)
ur5.set_robot_origin_with_measured_base(base_plane)
# ---------- end set_tool_and_base ----------

# ----
# 2
# animate! plane, inverse kinematic
reset = Button()
run = BooleanToggle(False)
lng = ListLength()
py = PythonScript(run=run, reset=reset, list_length=lng)  # -> C; inputs list_length: Int32
# ---------- py: Python ----------
from scriptcontext import sticky as st
import Grasshopper as gh

guid = str(ghenv.Component.InstanceGuid)

counter_key = "counter_" + guid
anchors = "anchors_" + guid
length = list_length


def ghComponentTimer(run,interval):
    """ Update the component at the interval like using a GH timer """
    
    # Ensure interval is larger than zero
    if interval <= 0:
        interval = 1
        
    # Get the Grasshopper document and component that owns this script
    ghComp = ghenv.Component
    ghDoc = ghComp.OnPingDocument()
    
    # Define the callback function
    def callBack(ghDoc):
        ghComp.ExpireSolution(False)
        
    # Update the solution
    if run:
        ghDoc.ScheduleSolution(interval, gh.Kernel.GH_Document.GH_ScheduleDelegate(callBack))


if reset or counter_key not in st:
    st[counter_key] = 0

else:
    if run:
        st[counter_key] += 1
        st[counter_key] %= length
        ghComponentTimer(run, 500)

C = st[counter_key]
# ---------- end py ----------
list_2 = ValueList({"counter": 0, "idx": 1}, selected="counter")
filter = StreamFilter(Gate=list_2, Stream0=py)
idx = Integer(filter)
idx_2 = Panel(idx)
ur1 = PythonScript(idx=idx_2)  # -> flatten(q); inputs joints: list, idx: Int32
# ---------- ur1: Python ----------
try:
    idx = min(idx, len(joints) - 1)
    
    q = joints[idx]
except:
    q = [0,0,0,0,0,0]
# ---------- end ur1 ----------

# ----
# 0
# angles, forward kinematic
base = Slider(-70.23, range=-360..360)
elbow = Slider(110.931, range=-360..360)
wrist2 = Slider(285.365, range=-360..360)
wrist3 = Slider(88.985, range=-360..360)
shoulder = Slider(-115.97, range=-360..360)
wrist1 = Slider(-100.64, range=-360..360)
ur1_a1_a6 = Data([base, shoulder, elbow, wrist1, wrist2, wrist3])
rad = Radians(Degrees=ur1_a1_a6)

# ----
# 1
# plane, inverse kinematic
idx_3 = Slider(5, range=0..7)
inverse = PythonScript(ur5=set_tool_and_base.ur5, idx=idx_3)  # -> flatten(q); inputs planeWCS: Plane, idx: Int32
# ---------- inverse: Python ----------
import Rhino.Geometry as rg
from mas_lib.robots.ur5.kinematic.ur5_kinematics import inverse, forward


# planeWCS is the Frame we want to reach in WCS
try:
    # 1. Bring it into Robot Coordinate System
    #planeWCS.Transform(transW2R)
    # 2. Get the plane in Robot Coordinate System without Tool Transformation
    #plane_RCS_minTPT = get_planeRCS_without_tool(planeWCS, tcp_plane)
    
    # Get the tcp plane in robot coordinate system
    tcp_plane_in_RCS = ur5.get_tcp_plane_in_RCS(planeWCS)
    
    qsols = inverse(tcp_plane_in_RCS, 0.0)
    
    print "Solutions:", len(qsols)
    
    idx = min(len(qsols) - 1, idx)
    q = qsols[idx]
    print q
except:
    q = [0,0,0,0,0,0]
# ---------- end inverse ----------

panel = Panel(rad)

# ----
# Select input for
# representation
list_3 = ValueList({"0 forward, from angles": 0, "1 inverse, from plane single": 1, "2 inverse, from plane multiple": 2}, selected="0 forward, from angles")
entwine = Entwine(Branch00=rad, Branch01=inverse, Branch02=ur1, FlattenInputs=True)

urrep = PythonScript(ur5=set_tool_and_base.ur5, input_type=list_3, joint_values=entwine)  # -> link_geo, tool_geo, tcp_plane, tool_plane, workspace; inputs joint_values: tree
# ---------- urrep: Python ----------
joint_vals = list(joint_values.Branch(input_type))
print joint_vals


link_geo, axes, tcp_plane, tool_plane, workspace, tool_geo = ur5.get_geo_with_rotated_joints(joint_vals)
# ---------- end urrep ----------
pln = Plane(urrep.tcp_plane)
pln_2 = Plane(urrep.tool_plane)

preview = CustomPreview(Geometry=urrep.workspace, Shader=ColourSwatch(SwatchColor=RGBA(209, 208, 188, 24)))
preview_2 = CustomPreview(Geometry=[urrep.link_geo, urrep.tool_geo], Shader=ColourSwatch(SwatchColor=RGBA(85, 134, 161, 100)))

# ==== cluster UR10Model
panel = Panel("C:\Users\rustr\workspace\compas_fabrication\fabrication\robots\ur\ur10\model\visual")
python = PythonScript()  # -> base, shoulder, upperarm, forearm, wrist1, wrist2, wrist3, tool0_plane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; inputs shoulder: list, upperarm: list, forearm: list, wrist1: list, wrist2: list
# ---------- python: Python ----------
import Rhino.Geometry as rg
import ghpythonlib.components as ghcomp
import math

#define UR10_PARAMS
d1 = 0.1273
a2 = -0.612
a3 = -0.5723
d4 = 0.163941
d5 = 0.1157
d6 = 0.0922

shoulder_offset = 0.220941
elbow_offset = -0.1719

d1 *= 1000
a2 *= 1000
a3 *= 1000
d4 *= 1000
d5 *= 1000
d6 *= 1000


shoulder_offset *= 1000
elbow_offset    *= 1000

"""
# ===============>> scale meshed from m to mm
S = rg.Transform.Scale(rg.Plane.WorldXY, 1000, 1000, 1000)

base     = ghcomp.Transform(base, S)
shoulder = ghcomp.Transform(shoulder, S)
upperarm = ghcomp.Transform(upperarm, S)
forearm  = ghcomp.Transform(forearm, S)
wrist1   = ghcomp.Transform(wrist1, S)
wrist2   = ghcomp.Transform(wrist2, S)
wrist3   = ghcomp.Transform(wrist3, S)
"""
# ===============>> transform every mesh
# base
R1 = rg.Transform.Rotation(math.radians(90), rg.Vector3d.XAxis, rg.Point3d(0,0,0))
R2 = rg.Transform.Rotation(math.radians(180), rg.Vector3d.ZAxis, rg.Point3d(0,0,0))
#base = ghcomp.Transform(base, R2 * R1)

# shoulder
T1 = rg.Transform.Translation(rg.Vector3d.ZAxis * d1)
#shoulder = ghcomp.Transform(shoulder, T1 * R2 * R1)

# upperarm
R3 = rg.Transform.Rotation(math.radians(90), rg.Vector3d.ZAxis, rg.Point3d(0,0,0))
R4 = rg.Transform.Rotation(-math.radians(90), rg.Vector3d.XAxis, rg.Point3d(0,0,0))
T2 = rg.Transform.Translation(rg.Vector3d.YAxis * -shoulder_offset)
#upperarm = ghcomp.Transform(upperarm, T2 * T1 * R4 * R3)

# forearm
T3 = rg.Transform.Translation(rg.Vector3d.XAxis * a2)
T4 = rg.Transform.Translation(rg.Vector3d.YAxis * -elbow_offset)
#forearm = ghcomp.Transform(forearm, T4 * T3 * T2 * T1 * R4 * R3)

# wrist1
T5 = rg.Transform.Translation((a2 + a3) * rg.Vector3d.XAxis)
T6 = rg.Transform.Translation(-d4 * rg.Vector3d.YAxis)
T7 = rg.Transform.Translation(d5 * rg.Vector3d.YAxis)
#wrist1 = ghcomp.Transform(wrist1, T7 * T6 * T5 * T1 * R4)

# wrist2
#wrist2 = ghcomp.Transform(wrist2, T6 * T5 * T1 * R4)

# wrist3
T8 = rg.Transform.Translation(rg.Vector3d.ZAxis * -d5)
#wrist3 = ghcomp.Transform(wrist3, T8 * T6 * T5 * T1 * R4)


R5 = rg.Transform.Rotation(math.radians(90), rg.Vector3d.XAxis, rg.Point3d(0,0,0))
T9 = rg.Transform.Translation(rg.Vector3d.YAxis * -d6)
tool0_plane = rg.Plane.WorldXY
tool0_plane = ghcomp.Transform(tool0_plane, T9 * T8 * T6 * T5 * T1 * R5)


lines = []

j1 = rg.Line(rg.Point3d(0,0,0), rg.Vector3d.ZAxis * d1)
j2 = rg.Line(j1.To, -rg.Vector3d.YAxis * 176.) # measured from model
j3 = rg.Line(j2.To + rg.Vector3d.XAxis * a2, rg.Vector3d.YAxis * 127.809)
j3.Flip()
j4 = rg.Line(j3.From + rg.Vector3d.XAxis * a3, -rg.Vector3d.YAxis * 115.750)
j5 = rg.Line(j4.To, -rg.Vector3d.ZAxis * d5)
j6 = rg.Line(j5.To, -rg.Vector3d.YAxis * d6)

lines = [j1]
# ---------- end python ----------
use_brep = ClusterInput()

# ---- group: meshes
base_shoulder = Mesh(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)
upperarm = Mesh(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)
forearm = Mesh(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)
wrist1 = Mesh(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)
wrist2 = Mesh(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)
wrist3 = Mesh(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)

# ---- group: breps
base_shoulder_2 = Brep(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)
upperarm_2 = Brep(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)
forearm_2 = Brep(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)
wrist1_2 = Brep(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)
wrist2_2 = Brep(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)
wrist3_2 = Brep(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)

# ----
j1 = Curve(python.j1)
j2 = Curve(python.j2)
j3 = Curve(python.j3)
j4 = Curve(python.j4)
j5 = Curve(python.j5)
j6 = Curve(python.j6)
use_brep_2 = Boolean(use_brep)
ur10_axes = Curve([j1, j2, j3, j4, j5, j6])
ur10_geo = Geometry([base_shoulder_2, upperarm_2, forearm_2, wrist1_2, wrist2_2, wrist3_2])
ur10_geo_mesh = Mesh([base_shoulder, upperarm, forearm, wrist1, wrist2, wrist3])
filter = StreamFilter(Gate=use_brep_2, Stream0=ur10_geo_mesh, Stream1=ur10_geo)
ur10_workspace = Geometry()
ur5_geo = Geometry(filter)
ur10_tp = Plane(python.tool0_plane)
ur10_axes_2 = ClusterOutput(ur10_axes)
ur5_geo_2 = ClusterOutput(ur5_geo)
ur10_tp_2 = ClusterOutput(ur10_tp)
ur10_workspace_2 = ClusterOutput(ur10_workspace)

# ==== cluster Tool
measurement_tool_geo = Geometry([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])
use_brep = ClusterInput()
tool_id = ClusterInput()
# mesh!!!
tool_geo_mesh = Mesh(measurement_tool_geo)
use_brep_2 = Boolean(use_brep)
tool_id_2 = Boolean(tool_id)
brep_or_mesh = StreamFilter(Gate=use_brep_2, Stream0=tool_geo_mesh, Stream1=measurement_tool_geo)
x_axis = Curve(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)
y_axis = Curve(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)
set_tool = PythonScript(tool_geo=brep_or_mesh, tool_axes=[x_axis, y_axis])  # -> out, tool, tool_plane, tool_geo, tool_axes, tool_axes_colors; inputs tool_geo: list, tool_axes: list
# ---------- set_tool: Python ----------
import Rhino.Geometry as rg
import ghpythonlib.components as ghcomp

from mas_lib.useful import import_or_reload
import_or_reload("mas_lib.robots.tool", "Tool")
import_or_reload("mas_lib.robots", "Tool")

from mas_lib.robots import Tool
from mas_lib.geometry import Frame

x_axis, y_axis = tool_axes

x_axis = rg.Line(x_axis.PointAtStart, x_axis.PointAtEnd)
y_axis = rg.Line(y_axis.PointAtStart, y_axis.PointAtEnd)

if x_axis.From.DistanceTo(y_axis.From) < 0.01:
    origin = x_axis.From
    xvec = x_axis.Direction
    yvec = y_axis.Direction
elif x_axis.To.DistanceTo(y_axis.To) < 0.01:
    origin = x_axis.To
    xvec = -x_axis.Direction
    yvec = -y_axis.Direction
elif x_axis.From.DistanceTo(y_axis.To) < 0.01:
    origin = x_axis.From
    xvec = x_axis.Direction
    yvec = -y_axis.Direction
elif x_axis.To.DistanceTo(y_axis.From) < 0.01:
    origin = x_axis.To
    xvec = -x_axis.Direction
    yvec = y_axis.Direction

tool_plane = rg.Plane(origin, xvec, yvec)

tool = Tool(tool_geo, tool_plane)

tool_plane = tool.get_plane()
tool_axes, tool_axes_colors = tool.get_frame_axes_as_lines()
# ---------- end set_tool ----------
preview = CustomPreview(Geometry=set_tool.tool_axes, Shader=set_tool.tool_axes_colors)
pln = Plane(set_tool.tool_plane)
geo = Geometry(set_tool.tool_geo)
preview_2 = CustomPreview(Geometry=geo, Shader=ColourSwatch(SwatchColor=RGBA(100, 168, 178, 162)))
select_tool = StreamFilter(Gate=tool_id_2, Stream0=set_tool.tool)
tool = Data(select_tool)
tool_2 = ClusterOutput(tool)
