# Grasshopper definition model.gh (Grasshopper 0.9.76)
# plug-ins: Python Interpreter

# ----
# angleA
# angleB
# speed
# speed
# force
# force
# force
# angleA
# angleA
# angleA
# angleA
# angleA
# angleA
# angleA
# angleA
# angleA
# angleB
# angleB
# angleB
# angleB
# angleB
# speed
# speed
# speed
# speed
# speed
# speed
# speed
# speed
# speed
# speed
# speed
# speed
# data for further calculation
# data for further calculation
# data for further calculation
# data for further calculation
# data for further calculation
# data for further calculation
# angleB
# speed
# load model
# set tool
# set basis
# 0
# angles, forward kinematic
base = Slider(70.14, range=-360..360)
elbow = Slider(100.645, range=-360..360)
wrist1 = Slider(-105.783, range=-360..360)
wrist2 = Slider(51.012, range=-360..360)
# material resistance
# angleA
# material resistance
# angleB
# force
# speed
# angleA
# angleB
# force
# speed
# angleA
# angleB
# force
# speed
# angleA
# angleB
# speed
# material resistance
# material resistance
# force
# force
# angleA
# angleA
# angleB
# angleB
# speed
# speed
# force
# angleA
# angleB
# speed
wrist3 = Slider(360, range=-360..360)
shoulder = Slider(135.714, range=-360..360)
ur1_a1_a6 = Data([base, shoulder, elbow, wrist1, wrist2, wrist3])
rad = Radians(Degrees=ur1_a1_a6)

# ----
# angleB
# speed
# data for further calculation
# set path
# set path
# set path
# set path
# set path
# set path
# set path
# force
# force
# force
# force
# force
# force
# angleA
# angleA
# angleA
# angleA
# angleA
# angleB
# angleB
# angleB
# angleB
# angleB
# speed
# speed
# speed
# speed
# force
# force
# force
# angleA
# angleA
# angleA
# angleA
# angleB
# speed
# material resistance
# force
# angleA
# angleB
# speed
# force
# angleA
bang = Button()

# ---- group: meshes
base_shoulder = Mesh(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)
upperarm = Mesh(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)
forearm = Mesh(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)
wrist1_2 = Mesh(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)
wrist3_2 = Mesh(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)
wrist2_2 = Mesh(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)

# ---- group: breps
# force
# angleA
base_shoulder_2 = Brep(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)
upperarm_2 = Brep(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)
forearm_2 = Brep(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)
wrist1_3 = Brep(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)
wrist2_3 = Brep(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)
# Calculate spring extension
# material resistance
# force
# angleA
# angleB
# speed
# force
# angleA
# angleB
# speed
# material resistance
# force
# angleA
# angleB
# speed
# force
# angleA
# angleB
# angleB
# speed
# speed
wrist3_3 = Brep(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)

# ----
unload = PythonScript(bang=bang)
# ---------- unload: Python ----------
from compas_fabrication.fabrication.utilities.utilities import unload_module

unload_module("compas")
# ---------- end unload ----------
panel = Panel(rad)
num = Number(rad)
ur10_geo = Geometry([base_shoulder_2, upperarm_2, forearm_2, wrist1_3, wrist2_3, wrist3_3])
ur10_geo_mesh = Mesh([base_shoulder, upperarm, forearm, wrist1_2, wrist2_2, wrist3_2])

# ----
# UR5
# Ex 1
use_brep = BooleanToggle(False)
ur5 = UR5(use_brep=use_brep)  # -> ur5_axes_2, ur5_geo_2, ur5_tp_2, ur5_workspace_2
set_robot = PythonScript(joint_axes=ur5.ur5_axes_2, link_geo=ur5.ur5_geo_2, tcp_plane=ur5.ur5_tp_2, workspace_geo=ur5.ur5_workspace_2)  # -> ur5; inputs joint_axes: list, link_geo: list
# ---------- set_robot: Python ----------
#import sys
#sys.path.append(r"C:\Users\kathrind\polybox\MAS")

from mas_lib.useful import import_or_reload

import_or_reload("mas_lib.robots", "Robot")
from mas_lib.robots import Robot

ur5 = Robot(link_geo, joint_axes, tcp_plane, workspace_geo)
# ---------- end set_robot ----------

python = PythonScript(x=Button())  # -> ur10, tool0
# ---------- python: Python ----------
from compas_fabrication.fabrication.robots.ur.ur10 import UR10
import Rhino.Geometry as rg

ur10 = UR10()



tool0 = rg.Plane(rg.Point3d(ur10.a2 + ur10.a3, -ur10.d4-ur10.d6, ur10.d1-ur10.d5), rg.Vector3d.XAxis, rg.Vector3d.ZAxis)
# ---------- end python ----------

# ---- group: Robot
# 1. load robot model
# 2. set tool
# 3. set basis
list = ValueList({"measurement tool": 0}, selected="measurement tool")
tools = Tools(tool_number=list)
basis = PythonScript()  # -> basis_frame
# ---------- basis: Python ----------
from compas_fabrication.fabrication.geometry import Frame

origin = rg.Point3d(300,300,0)
xaxis = rg.Vector3d.XAxis
yaxis = rg.Vector3d.YAxis

basis_frame = Frame(list(origin), list(xaxis), list(yaxis))
# ---------- end basis ----------
list_2 = ValueList({"UR5", "UR10"}, selected="UR10")
robot = PythonScript(model=list_2, tool=tools, basis_frame=basis)  # -> robot
# ---------- robot: Python ----------
from compas_fabrication.fabrication.robots.ur.ur10 import UR10
from compas_fabrication.fabrication.robots.ur.ur5 import UR5

if model == "UR5":
    robot = UR5()
elif model == "UR10":
    robot = UR10()
    
robot.set_tool(tool)
robot.set_basis_frame(basis_frame)
# ---------- end robot ----------

# ----
pln = Plane(python.tool0)
python_2 = PythonScript(q=num, ur10=python.ur10, M=ur10_geo_mesh)  # -> ur10, M; inputs q: list, M: list
# ---------- python_2: Python ----------
from compas_fabrication.fabrication.grasshopper.mesh import draw_mesh
import Rhino.Geometry as rg

R0, R1, R2, R3, R4, R5 = ur10.get_forward_transformations(q)

print R0

def rhino_transform(transformation_matrix):
    T = rg.Transform(1)
    for x in range(4):
        for y in range(4):
            exec("T.M%i%i = transformation_matrix[%i][%i]" % (x,y,x,y))
    return T
robot_color = (180,180,180)

R0 = rhino_transform(R0.matrix)
R1 = rhino_transform(R1.matrix)
R2 = rhino_transform(R2.matrix)
R3 = rhino_transform(R3.matrix)
R4 = rhino_transform(R4.matrix)
R5 = rhino_transform(R5.matrix)

m0, m1, m2, m3, m4, m5 = M

m0.Transform(R0)
m1.Transform(R1)
m2.Transform(R2)
m3.Transform(R3)
m4.Transform(R4)
m5.Transform(R5)

#M = [m0, m1, m2, m3, m4, m5]

"""
M = []
M.append(draw_mesh(m0, vertexcolor = robot_color))
M.append(draw_mesh(m1, vertexcolor = robot_color))
M.append(draw_mesh(m2, vertexcolor = robot_color))
M.append(draw_mesh(m3, vertexcolor = robot_color))
M.append(draw_mesh(m4, vertexcolor = robot_color))
M.append(draw_mesh(m5, vertexcolor = robot_color))
"""
# ---------- end python_2 ----------
python_3 = PythonScript(ur10=python.ur10, q=num, tool0=pln)  # -> tool0; inputs q: list
# ---------- python_3: Python ----------
import Rhino.Geometry as rg

R0, R1, R2, R3, R4, R5 = ur10.get_forward_transformations(q)

def rhino_transform(transformation_matrix):
    T = rg.Transform(1)
    for x in range(4):
        for y in range(4):
            exec("T.M%i%i = transformation_matrix[%i][%i]" % (x,y,x,y))
    return T
robot_color = (180,180,180)

R0 = rhino_transform(R0.matrix)
R1 = rhino_transform(R1.matrix)
R2 = rhino_transform(R2.matrix)
R3 = rhino_transform(R3.matrix)
R4 = rhino_transform(R4.matrix)
R5 = rhino_transform(R5.matrix)


tool0.Transform(R5)
# ---------- end python_3 ----------
python_4 = PythonScript(q=num, ur10=python.ur10)  # -> ur10, M, pl; inputs q: list
# ---------- python_4: Python ----------
from compas_fabrication.fabrication.grasshopper.mesh import draw_mesh
import Rhino.Geometry as rg
from compas.geometry.elements import Point, Vector

robot_color = (180,180,180)

m0, m1, m2, m3, m4, m5, tool0_frame, tool_frame = ur10.get_transformed_model(q)

R0, R1, R2, R3, R4, R5 = ur10.get_forward_transformations(q)

M = []
M.append(draw_mesh(m0, vertexcolor = robot_color))
M.append(draw_mesh(m1, vertexcolor = robot_color))
M.append(draw_mesh(m2, vertexcolor = robot_color))
M.append(draw_mesh(m3, vertexcolor = robot_color))
M.append(draw_mesh(m4, vertexcolor = robot_color))
M.append(draw_mesh(m5, vertexcolor = robot_color))

print tool0_frame

pl = rg.Plane(rg.Point3d(tool0_frame.point.x, tool0_frame.point.y, tool0_frame.point.z), rg.Vector3d(tool0_frame.xaxis.x, tool0_frame.xaxis.y, tool0_frame.xaxis.z), rg.Vector3d(tool0_frame.yaxis.x, tool0_frame.yaxis.y, tool0_frame.yaxis.z))
# ---------- end python_4 ----------
pln_2 = Plane(python_3)
pln_3 = Plane(python_4.pl)
panel_2 = Panel(pln_2)

list_3 = ValueList({"measurement tool": 0}, selected="measurement tool")
tool = Tool(tool_id=list_3)

panel_3 = Panel(pln_3)
pt = Point(Point(-360.8691124, 430.8494185, 417.5825565))
xy = XYPlane(Origin=pt)

# ---- group: define plane in WCS, calculate inverse
idx = Slider(5, range=0..7)
plane_wcs = Plane(xy)
inverse = PythonScript(robot=robot, plane_WCS=plane_wcs, idx=idx)  # -> q; inputs plane_WCS: Plane, idx: Int32
# ---------- inverse: Python ----------
import Rhino.Geometry as rg
from compas_fabrication.fabrication.geometry import Frame

frame_WCS = Frame(list(plane_WCS.Origin), list(plane_WCS.XAxis), list(plane_WCS.YAxis))

# transform frame to robot coordinate system
frame_tool_RCS = robot.get_frame_in_RCS(frame_WCS)
# get the frame of tool0
frame_tool0_RCS = robot.get_tool0_frame_from_tcp_frame(frame_tool_RCS)
# calculate solutions to frame
solutions = robot.inverse_kinematic(frame_tool0_RCS)

if not len(solutions):
    q = [0,0,0,0,0,0]
else:
    idx = min(len(solutions) - 1, idx)
    q = solutions[idx]
# ---------- end inverse ----------

# ---- group: define angles, forward kinematics
base_2 = Slider(-70.23, range=-360..360)
shoulder_2 = Slider(-115.97, range=-360..360)
elbow_2 = Slider(110.931, range=-360..360)
wrist1_4 = Slider(-100.64, range=-360..360)
wrist2_4 = Slider(285.365, range=-360..360)
wrist3_4 = Slider(88.985, range=-360..360)
ur1_q1_q6 = Data([base_2, shoulder_2, elbow_2, wrist1_4, wrist2_4, wrist3_4])
rad_2 = Radians(Degrees=ur1_q1_q6)

# ----
ur1_base = PythonScript()  # -> base_plane
# ---------- ur1_base: Python ----------
import Rhino.Geometry as rg

origin = rg.Point3d(0,0,0)
x_axis = rg.Vector3d.XAxis
y_axis = rg.Vector3d.YAxis
z_axis = rg.Vector3d.ZAxis

"""
origin = rg.Point3d(350, -1150.0, -500)
x_axis = rg.Vector3d(0, 1, 0)
y_axis = rg.Vector3d(-1, 0, 0)
z_axis = rg.Vector3d(0, 0, 1)

# measured base
origin = rg.Point3d( -8.53783,522.092,-368.686 )
x_axis = rg.Vector3d( -0.0382537622225462,0.999200355098442,-0.0116318548378337 )
y_axis = rg.Vector3d( -0.999256972508005,-0.0381959188496163,0.00515506327500067 )
z_axis = rg.Vector3d( 0.00470665167147919,0.0118204126146703,0.999919059362138 )

origin = rg.Point3d( -12.4393,650.147,-367.116 )
x_axis = rg.Vector3d( -0.0355719657899595,0.999346086970958,-0.00648334062606253 )
y_axis = rg.Vector3d( -0.999353483146585,-0.0355368444158786,0.00545421046072267 )
z_axis = rg.Vector3d( 0.00522024641431573,0.00667316602500141,0.999964108297181 )
"""

# adjustment
#origin += z_axis * -5.139135
#origin += z_axis * -9.262913

# origin is +300mm in RCS xaxis 
#origin += x_axis * 300

base_plane = rg.Plane(origin, x_axis, y_axis)
# ---------- end ur1_base ----------
list_4 = ValueList({"0 forward, from angles": 0, "1 inverse, from plane single": 1, "2 inverse, from plane multiple": 2}, selected="0 forward, from angles")
set_tool_and_base = PythonScript(tool=tool, base_plane=ur1_base)  # -> out, ur5
# ---------- set_tool_and_base: Python ----------
ur5.set_tool(tool)
ur5.set_robot_origin_with_measured_base(base_plane)
# ---------- end set_tool_and_base ----------
filter = StreamFilter(Gate=list_4, Stream0=rad_2, Stream1=inverse)
crv = Curve(<curve referenced from the Rhino model>)
crv_2 = Curve(<curve referenced from the Rhino model>)
panel_4 = Panel("visualize")
draw = PythonScript(robot=robot, q=filter)  # -> meshes, tool0_plane, tool_plane; inputs q: list
# ---------- draw: Python ----------
from compas_fabrication.fabrication.grasshopper.mesh import draw_mesh
from compas.geometry.elements import Point, Vector
import Rhino.Geometry as rg

def draw_plane(pl):
    return rg.Plane(rg.Point3d(pl.point.x, pl.point.y, pl.point.z), rg.Vector3d(pl.xaxis.x, pl.xaxis.y, pl.xaxis.z), rg.Vector3d(pl.yaxis.x, pl.yaxis.y, pl.yaxis.z))

m0, m1, m2, m3, m4, m5, tool0_frame, tool_frame = robot.get_transformed_model(q)

robot_color = (180,180,180)

meshes = []
meshes.append(draw_mesh(m0, vertexcolor = robot_color))
meshes.append(draw_mesh(m1, vertexcolor = robot_color))
meshes.append(draw_mesh(m2, vertexcolor = robot_color))
meshes.append(draw_mesh(m3, vertexcolor = robot_color))
meshes.append(draw_mesh(m4, vertexcolor = robot_color))
meshes.append(draw_mesh(m5, vertexcolor = robot_color))

tool0_plane = draw_plane(tool0_frame)
tool_plane = draw_plane(tool_frame)
# ---------- end draw ----------
py = PythonScript(line=crv_2)  # -> plane; inputs line: Line
# ---------- py: Python ----------
import Rhino.Geometry as rg


plane = rg.Plane(line.From, line.To - line.From)
# ---------- end py ----------
py_2 = PythonScript(line=crv)  # -> plane; inputs line: Line; same code as py
python_5 = PythonScript(plane1=py, plane2=py_2)  # -> out, a
# ---------- python_5: Python ----------
import Rhino.Geometry as rg


plane1 = rg.Plane(rg.Point3d(-636.57, 370.83, 293.21), rg.Vector3d(0.00000, -0.54972, -0.83535), rg.Vector3d(0.92022, -0.32695, 0.21516))
plane2 = rg.Plane(rg.Point3d(-983.14, 80.27, 152.91), rg.Vector3d(-0.70235, 0.00000, 0.71184), rg.Vector3d(-0.26490, -0.92818, -0.26137))

T = rg.Transform.PlaneToPlane(plane1, plane2)

def plane_to_str(pl):
    str = "Frame("
    str += "[%.2f, %.2f, %.2f], " % tuple(list(pl.Origin))
    str += "[%.5f, %.5f, %.5f], " % tuple(list(pl.XAxis))
    str += "[%.5f, %.5f, %.5f])" % tuple(list(pl.YAxis))
    return str
    
print "plane_from =", plane_to_str(plane1)
print "plane_to =", plane_to_str(plane2)


print T

print rg.Transform.Scale(rg.Plane.WorldXY, 5, 5, 5)
# ---------- end python_5 ----------

# ----
# 2
# animate! plane, inverse kinematic
reset = Button()
run = BooleanToggle(False)
lng = ListLength()
py_3 = PythonScript(run=run, reset=reset, list_length=lng)  # -> C; inputs list_length: Int32
# ---------- py_3: Python ----------
from scriptcontext import sticky as st
import Grasshopper as gh

guid = str(ghenv.Component.InstanceGuid)

counter_key = "counter_" + guid
anchors = "anchors_" + guid
length = list_length


def ghComponentTimer(run,interval):
    """ Update the component at the interval like using a GH timer """
    
    # Ensure interval is larger than zero
    if interval <= 0:
        interval = 1
        
    # Get the Grasshopper document and component that owns this script
    ghComp = ghenv.Component
    ghDoc = ghComp.OnPingDocument()
    
    # Define the callback function
    def callBack(ghDoc):
        ghComp.ExpireSolution(False)
        
    # Update the solution
    if run:
        ghDoc.ScheduleSolution(interval, gh.Kernel.GH_Document.GH_ScheduleDelegate(callBack))


if reset or counter_key not in st:
    st[counter_key] = 0

else:
    if run:
        st[counter_key] += 1
        st[counter_key] %= length
        ghComponentTimer(run, 500)

C = st[counter_key]
# ---------- end py_3 ----------
list_5 = ValueList({"counter": 0, "idx": 1}, selected="counter")
filter_2 = StreamFilter(Gate=list_5, Stream0=py_3)
idx_2 = Integer(filter_2)
idx_3 = Panel(idx_2)
ur1 = PythonScript(idx=idx_3)  # -> flatten(q); inputs joints: list, idx: Int32
# ---------- ur1: Python ----------
try:
    idx = min(idx, len(joints) - 1)
    
    q = joints[idx]
except:
    q = [0,0,0,0,0,0]
# ---------- end ur1 ----------

# ----
# 0
# angles, forward kinematic
base_3 = Slider(-70.23, range=-360..360)
shoulder_3 = Slider(-115.97, range=-360..360)
elbow_3 = Slider(110.931, range=-360..360)
wrist1_5 = Slider(-100.64, range=-360..360)
wrist2_5 = Slider(285.365, range=-360..360)
wrist3_5 = Slider(88.985, range=-360..360)
ur1_a1_a6_2 = Data([base_3, shoulder_3, elbow_3, wrist1_5, wrist2_5, wrist3_5])
rad_3 = Radians(Degrees=ur1_a1_a6_2)

# ----
# 1
# plane, inverse kinematic
idx_4 = Slider(5, range=0..7)
inverse_2 = PythonScript(ur5=set_tool_and_base.ur5, idx=idx_4)  # -> flatten(q); inputs planeWCS: Plane, idx: Int32
# ---------- inverse_2: Python ----------
import Rhino.Geometry as rg
from mas_lib.robots.ur5.kinematic.ur5_kinematics import inverse, forward


# planeWCS is the Frame we want to reach in WCS
try:
    # 1. Bring it into Robot Coordinate System
    #planeWCS.Transform(transW2R)
    # 2. Get the plane in Robot Coordinate System without Tool Transformation
    #plane_RCS_minTPT = get_planeRCS_without_tool(planeWCS, tcp_plane)
    
    # Get the tcp plane in robot coordinate system
    tcp_plane_in_RCS = ur5.get_tcp_plane_in_RCS(planeWCS)
    
    qsols = inverse(tcp_plane_in_RCS, 0.0)
    
    print "Solutions:", len(qsols)
    
    idx = min(len(qsols) - 1, idx)
    q = qsols[idx]
    print q
except:
    q = [0,0,0,0,0,0]
# ---------- end inverse_2 ----------

panel_5 = Panel(rad_3)

# ----
# Select input for
# representation
list_6 = ValueList({"0 forward, from angles": 0, "1 inverse, from plane single": 1, "2 inverse, from plane multiple": 2}, selected="0 forward, from angles")
entwine = Entwine(Branch00=rad_3, Branch01=inverse_2, Branch02=ur1, FlattenInputs=True)

urrep = PythonScript(ur5=set_tool_and_base.ur5, input_type=list_6, joint_values=entwine)  # -> link_geo, tool_geo, tcp_plane, tool_plane, workspace; inputs joint_values: tree
# ---------- urrep: Python ----------
joint_vals = list(joint_values.Branch(input_type))
print joint_vals


link_geo, axes, tcp_plane, tool_plane, workspace, tool_geo = ur5.get_geo_with_rotated_joints(joint_vals)
# ---------- end urrep ----------
pln_4 = Plane(urrep.tcp_plane)
pln_5 = Plane(urrep.tool_plane)

# ----
# inclination_length for 2, 4, 10, 15
# inclination_length for 30
# Calculate edge curves
preview = CustomPreview(Geometry=urrep.workspace, Shader=ColourSwatch(SwatchColor=RGBA(209, 208, 188, 24)))
preview_2 = CustomPreview(Geometry=[urrep.link_geo, urrep.tool_geo], Shader=ColourSwatch(SwatchColor=RGBA(85, 134, 161, 100)))

# ==== cluster UR5
use_brep = ClusterInput()

# ---- group: meshes
base_shoulder = Mesh(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)
upperarm = Mesh(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)
forearm = Mesh(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)
wrist1 = Mesh(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)
wrist2 = Mesh(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)
wrist3 = Mesh(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)

# ---- group: breps
base_shoulder_2 = Brep(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)
upperarm_2 = Brep(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)
forearm_2 = Brep(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)
wrist1_2 = Brep(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)
wrist2_2 = Brep(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)
wrist3_2 = Brep(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)

# ----
python = PythonScript()  # -> j1, j2, j3, j4, j5, j6, lines
# ---------- python: Python ----------
import Rhino.Geometry as rg
import ghpythonlib.components as ghcomp
import math

#define UR5_PARAMS
d1 =  89.159
a2 = -425.00
a3 = -392.25
d4 =  109.15
d5 =  94.65
d6 =  82.3

shoulder_offset = 135.85
elbow_offset =   -119.7


vectors = []
vectors.append(rg.Vector3d.ZAxis)
vectors.append(-rg.Vector3d.YAxis)
vectors.append(rg.Vector3d.XAxis)
vectors.append(-rg.Vector3d.YAxis)
vectors.append(rg.Vector3d.XAxis)

vectors.append(-rg.Vector3d.YAxis)
vectors.append(-rg.Vector3d.ZAxis)
vectors.append(-rg.Vector3d.YAxis)

lines = []
lines.append(rg.Line(rg.Point3d(0,0,0), vectors[0] * d1))
lines.append(rg.Line(lines[-1].To, vectors[1] * shoulder_offset))
lines.append(rg.Line(lines[-1].To, vectors[2] * a2))
lines.append(rg.Line(lines[-1].To, vectors[3] * elbow_offset))
lines.append(rg.Line(lines[-1].To, vectors[4] * a3))


lines.append(rg.Line(lines[0].To + rg.Vector3d.XAxis * (a2 + a3), vectors[5] * d4))
lines.append(rg.Line(lines[-1].To, vectors[6] * d5))
lines.append(rg.Line(lines[-1].To, vectors[7] * d6))
# ---------- end python ----------
ur5_mesh = Mesh([base_shoulder, upperarm, forearm, wrist1, wrist2, wrist3])
ur5_brep = Geometry([base_shoulder_2, upperarm_2, forearm_2, wrist1_2, wrist2_2, wrist3_2])
use_brep_2 = Boolean(use_brep)
j1 = Curve(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)
j2 = Curve(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)
j3 = Curve(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)
j4 = Curve(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)
j5 = Curve(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)
j6 = Curve(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)
filter = StreamFilter(Gate=use_brep_2, Stream0=ur5_mesh, Stream1=ur5_brep)
py = PythonScript(j1=j1)  # -> workspace
# ---------- py: Python ----------
import Rhino.Geometry as rg

workspace_center = j1.PointAtEnd
workspace_radius = 1860.50/2

WS = rg.Sphere(workspace_center, workspace_radius)

plane = rg.Plane.WorldXY
plane.Origin = workspace_center - plane.ZAxis * workspace_radius
C = rg.Cylinder(rg.Circle(plane,110), workspace_radius * 2)

workspace = rg.Brep.CreateBooleanDifference(rg.Brep.CreateFromSphere(WS), rg.Brep.CreateFromCylinder(C, True, True), 0.1)[0]
# ---------- end py ----------
ur5_axes = Curve([j1, j2, j3, j4, j5, j6])
ur5_workspace = Geometry(py)
ur5_tp = Plane(PlaneXZ(-817.25, -191.45, -5.491))
ur5_geo = Geometry(filter)
ur5_axes_2 = ClusterOutput(ur5_axes)
ur5_geo_2 = ClusterOutput(ur5_geo)
ur5_workspace_2 = ClusterOutput(ur5_workspace)
ur5_tp_2 = ClusterOutput(ur5_tp)

# ==== cluster Tool
measurement_tool_geo = Geometry([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])
use_brep = ClusterInput()
tool_id = ClusterInput()
# mesh!!!
tool_geo_mesh = Mesh(measurement_tool_geo)
use_brep_2 = Boolean(use_brep)
tool_id_2 = Boolean(tool_id)
brep_or_mesh = StreamFilter(Gate=use_brep_2, Stream0=tool_geo_mesh, Stream1=measurement_tool_geo)
x_axis = Curve(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)
y_axis = Curve(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)
set_tool = PythonScript(tool_geo=brep_or_mesh, tool_axes=[x_axis, y_axis])  # -> out, tool, tool_plane, tool_geo, tool_axes, tool_axes_colors; inputs tool_geo: list, tool_axes: list
# ---------- set_tool: Python ----------
import Rhino.Geometry as rg
import ghpythonlib.components as ghcomp

from mas_lib.useful import import_or_reload
import_or_reload("mas_lib.robots.tool", "Tool")
import_or_reload("mas_lib.robots", "Tool")

from mas_lib.robots import Tool
from mas_lib.geometry import Frame

x_axis, y_axis = tool_axes

x_axis = rg.Line(x_axis.PointAtStart, x_axis.PointAtEnd)
y_axis = rg.Line(y_axis.PointAtStart, y_axis.PointAtEnd)

if x_axis.From.DistanceTo(y_axis.From) < 0.01:
    origin = x_axis.From
    xvec = x_axis.Direction
    yvec = y_axis.Direction
elif x_axis.To.DistanceTo(y_axis.To) < 0.01:
    origin = x_axis.To
    xvec = -x_axis.Direction
    yvec = -y_axis.Direction
elif x_axis.From.DistanceTo(y_axis.To) < 0.01:
    origin = x_axis.From
    xvec = x_axis.Direction
    yvec = -y_axis.Direction
elif x_axis.To.DistanceTo(y_axis.From) < 0.01:
    origin = x_axis.To
    xvec = -x_axis.Direction
    yvec = y_axis.Direction

tool_plane = rg.Plane(origin, xvec, yvec)

tool = Tool(tool_geo, tool_plane)

tool_plane = tool.get_plane()
tool_axes, tool_axes_colors = tool.get_frame_axes_as_lines()
# ---------- end set_tool ----------
preview = CustomPreview(Geometry=set_tool.tool_axes, Shader=set_tool.tool_axes_colors)
pln = Plane(set_tool.tool_plane)
geo = Geometry(set_tool.tool_geo)
preview_2 = CustomPreview(Geometry=geo, Shader=ColourSwatch(SwatchColor=RGBA(100, 168, 178, 162)))
select_tool = StreamFilter(Gate=tool_id_2, Stream0=set_tool.tool)
tool = Data(select_tool)
tool_2 = ClusterOutput(tool)

# ==== cluster Tools
tool_number = ClusterInput()

# ---- group: Tool 0
measurement_tool_geo = Geometry([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])
tool_geo_mesh = Mesh(measurement_tool_geo)
yaxis_line = Curve(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)
xaxis_line = Curve(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)
tool = PythonScript(meshes=tool_geo_mesh, other_geometry=measurement_tool_geo, xaxis_line=xaxis_line, yaxis_line=yaxis_line)  # -> tool, tcp_plane; inputs meshes: list, other_geometry: list
# ---------- tool: Python ----------
import Rhino.Geometry as rg
from compas_fabrication.fabrication.robots import Tool
from compas_fabrication.fabrication.geometry import Frame

xaxis = rg.Line(xaxis_line.PointAtStart, xaxis_line.PointAtEnd)
yaxis = rg.Line(yaxis_line.PointAtStart, yaxis_line.PointAtEnd)

if xaxis.From.DistanceTo(yaxis.From) < 0.01:
    origin = xaxis.From
    xvec = xaxis.Direction
    yvec = yaxis.Direction
elif xaxis.To.DistanceTo(yaxis.To) < 0.01:
    origin = xaxis.To
    xvec = -xaxis.Direction
    yvec = -yaxis.Direction
elif xaxis.From.DistanceTo(yaxis.To) < 0.01:
    origin = xaxis.From
    xvec = xaxis.Direction
    yvec = -yaxis.Direction
elif xaxis.To.DistanceTo(yaxis.From) < 0.01:
    origin = xaxis.To
    xvec = -xaxis.Direction
    yvec = yaxis.Direction

tcp_frame = Frame(list(origin), list(xvec), list(yvec))
tcp_plane = rg.Plane(origin, xvec, yvec)

tool = Tool(tcp_frame)
tool.set_meshes(meshes)
tool.other_geometry = other_geometry
# ---------- end tool ----------
pln = Plane(tool.tcp_plane)

# ----
select_tool = StreamFilter(Tool_number=tool_number, Stream0=tool.tool)
tool_2 = Data(select_tool)
tool_3 = ClusterOutput(tool_2)
