# Grasshopper definition gripper_export.gh (Grasshopper 1.0.7)

mesh = Mesh(<mesh referenced from the Rhino model>)
point = Point(<point referenced from the Rhino model>)
link = GhPythonScript(collision_meshes=mesh, visual_meshes=mesh, link_name="body", origin=point)  # -> out, link; inputs collision_meshes: list of Mesh, visual_meshes: list of Mesh, origin: Plane
# ---------- link: Python ----------
"""Provides a scripting component.
    Inputs:
        collision_meshes: The collision meshes for the link
        visual_meshes: The visual meshes for the link
        link_name: The y script variable
        origin: The Plane that describes the origin of the link.
    Output:
        link: The new compas robots Link object"""

__author__ = "leungp"
__version__ = "2024.10.10"

import rhinoscriptsyntax as rs
from compas.geometry import Transformation
from compas_robots.model import Link
from compas_robots.model import LinkGeometry
from compas_robots.model import MeshDescriptor

from compas_robots.model import Visual
from compas_robots.model import Collision
from compas_rhino.conversions import mesh_to_compas
from compas_rhino.conversions import plane_to_compas_frame

assert collision_meshes
assert visual_meshes

if origin:
    origin = plane_to_compas_frame(origin)
    transformation = Transformation.from_frame(origin).inverse()
    print("Meshes Transformed by {}".format(transformation))

visuals = []
for m in visual_meshes:
    visual = Visual(LinkGeometry(MeshDescriptor("")))
    cm = mesh_to_compas(m)
    if origin:
        cm.transform(transformation)
    visual.geometry.shape.meshes = [cm]
    visuals.append(visual)

collisions = []
for m in collision_meshes:
    collision = Collision(LinkGeometry(MeshDescriptor("")))
    cm = mesh_to_compas(m)
    if origin:
        cm.transform(transformation)
    collision.geometry.shape.meshes = [cm]
    collisions.append(collision)

link = Link(name=link_name, visual = visuals, collision = collisions)
# ---------- end link ----------

point_2 = Point(<point referenced from the Rhino model>)
mesh_2 = Mesh(<mesh referenced from the Rhino model>)
xy_plane = XYPlane(Origin=point_2)
link_2 = GhPythonScript(collision_meshes=mesh_2, visual_meshes=mesh_2, link_name="left_finger", origin=xy_plane)  # -> out, link; inputs collision_meshes: list of Mesh, visual_meshes: list of Mesh, origin: Plane; same code as link

mesh_3 = Mesh(<mesh referenced from the Rhino model>)
point_3 = Point(<point referenced from the Rhino model>)
xy_plane_2 = XYPlane(Origin=point_3)
link_3 = GhPythonScript(collision_meshes=mesh_3, visual_meshes=mesh_3, link_name="right_finger", origin=xy_plane_2)  # -> out, link; inputs collision_meshes: list of Mesh, visual_meshes: list of Mesh, origin: Plane; same code as link

image_sampler = ImageSampler(FilePath="C:\Users\leungp\Desktop\joint.png", Filter="Colour", Interpolate=False, Umax=1, Umin=0, Vmax=1, Vmin=0, Wrap=1)
image_sampler_2 = ImageSampler(
    FilePath="C:\Users\leungp\Desktop\inertial.png",
    Filter="Colour",
    Interpolate=False,
    Umax=1,
    Umin=0,
    Vmax=1,
    Vmin=0,
    Wrap=1)

supported_types = ValueList({"REVOLUTE": 0, "CONTINUOUS": 1, "PRISMATIC": 2, "FIXED": 3, "FLOATING": 4, "PLANAR": 5}, selected="PRISMATIC")
unit_y = UnitY(Factor="-1")
joint = GhPythonScript(
    name="right_finger_joint",
    type=supported_types,
    origin=xy_plane_2,
    axis=unit_y,
    parent_link=link.link,
    child_link=link_3.link,
    lower_limit=Slider(0, range=0..0.01),
    upper_limit=Slider(0.025, range=0..0.025))  # -> out, joint; inputs type: Int32, origin: Plane, axis: Vector3d
# ---------- joint: Python ----------
__author__ = "leungp"
__version__ = "2024.10.10"

import rhinoscriptsyntax as rs
from compas_robots.model import Joint
from compas_robots.model import Limit
from compas_robots.model import Axis

from compas_rhino.conversions import plane_to_compas_frame
from compas_rhino.conversions import vector_to_compas

axis = vector_to_compas(axis).unitized()
urdf_axis = Axis()
urdf_axis.x = axis.x
urdf_axis.y = axis.y
urdf_axis.z = axis.z

parent = parent_link.name if hasattr(parent_link, 'name') else str(parent_link)
child = child_link.name if hasattr(child_link, 'name') else str(child_link)

joint = Joint(
    name = name,
    type = type,
    parent = parent,
    child = child, 
    origin = plane_to_compas_frame(origin), 
    axis = urdf_axis,
    limit = Limit(lower = lower_limit, upper = upper_limit),
    )
# ---------- end joint ----------

supported_types_2 = ValueList({"REVOLUTE": 0, "CONTINUOUS": 1, "PRISMATIC": 2, "FIXED": 3, "FLOATING": 4, "PLANAR": 5}, selected="PRISMATIC")
unit_y_2 = UnitY(Factor=1)
joint_2 = GhPythonScript(
    name="left_finger_joint",
    type=supported_types_2,
    origin=xy_plane,
    axis=unit_y_2,
    parent_link=link.link,
    child_link=link_2.link,
    lower_limit=Slider(0, range=0..0.01),
    upper_limit=Slider(0.025, range=0..0.025))  # -> out, joint; inputs type: Int32, origin: Plane, axis: Vector3d; same code as joint

robotmodel = GhPythonScript(name="gripper", joints=[joint_2.joint, joint.joint], links=[link.link, link_2.link, link_3.link])  # -> out, robot_model; inputs joints: list, links: list
# ---------- robotmodel: Python ----------
__author__ = "leungp"
__version__ = "2024.10.10"

import rhinoscriptsyntax as rs
from compas_robots import RobotModel

# The following check is essential to ensure a properly formed RobotModel object
# Otherwise the subsequent Scene operation can create infinite loops that crashes.

assert len(joints) + 1 == len(links)

links_dict={}
for link in links:
    assert link.name not in links_dict
    links_dict[link.name] = [None, []]

for joint in joints:
    if str(joint.parent) not in links_dict:
        print ("Parent Link '{}' for Joint {} missing".format(joint.parent, joint.name))
        assert False
    if str(joint.child) not in links_dict:
        print ("Child Link '{}' for Joint {} missing".format(joint.child, joint.name))
        assert False
    links_dict[str(joint.parent)][1].append(str(joint.child))
    links_dict[str(joint.child)][0] = str(joint.parent)

no_parent = [l[0] is None for l in links_dict.values()]
assert sum(no_parent) == 1

robot_model = RobotModel(name, joints, links)
# ---------- end robotmodel ----------
point_4 = Point(<point referenced from the Rhino model>)
xy_plane_3 = XYPlane(Origin=point_4)
panel = Panel(robotmodel.robot_model)
ghpython_script = GhPythonScript(robot_model=robotmodel.robot_model, tcf=xy_plane_3)  # -> out, tool_model; inputs tcf: Plane
# ---------- ghpython_script: Python ----------
__author__ = "leungp"
__version__ = "2024.10.11"

import rhinoscriptsyntax as rs
from compas_robots import ToolModel

from compas_rhino.conversions import plane_to_compas_frame

tool_model = ToolModel.from_robot_model(robot_model, plane_to_compas_frame(tcf))
# ---------- end ghpython_script ----------
save = Button()
zero_configuration = GhPythonScript(robot_model=ghpython_script.tool_model)  # -> out, zero_configuration
# ---------- zero_configuration: Python ----------
zero_configuration = robot_model.zero_configuration()
# ---------- end zero_configuration ----------
number_slider = Slider(0.025, range=0..0.025)
python = GhPythonScript(tool_model=ghpython_script.tool_model, output=save)  # -> out, json_path
# ---------- python: Python ----------
from Rhino.RhinoDoc import ActiveDoc
import os
from compas import json_dump
json_path = os.path.split(ActiveDoc.Path)[0] + os.path.sep + tool_model.name +".json"

if output:
    import json
    with open(json_path, 'w') as f:
        json_dump(tool_model, f, pretty=True)
# ---------- end python ----------
tool_model_will_be_saved_to_this_path = Panel(python.json_path)
scene_object = GhPythonScript(robot_model=ghpython_script.tool_model)  # -> out, scene_object
# ---------- scene_object: Python ----------
__author__ = "leungp"
__version__ = "2024.10.11"

from compas.scene import SceneObject
try:
    scene_object = SceneObject(item=robot_model)
except:
    pass
# ---------- end scene_object ----------
ghpython_script_2 = GhPythonScript(configuration=zero_configuration.zero_configuration, value_0=number_slider, value_1=number_slider)  # -> out, configuration_out
# ---------- ghpython_script_2: Python ----------
__author__ = "leungp"
__version__ = "2024.10.11"

configuration_out = configuration.copy()
keys = list(configuration_out.keys())

values = [eval("value_"+str(i)) for i in range (6)]
for key, value in zip(keys, values):
    if value:
        configuration_out[key] = value
        print (key, value)
# ---------- end ghpython_script_2 ----------
robotmodelsceneobjectupdate = GhPythonScript(scene_object=scene_object.scene_object, configuration=ghpython_script_2.configuration_out)  # -> out, meshes
# ---------- robotmodelsceneobjectupdate: Python ----------
__author__ = "leungp"
__version__ = "2024.10.11"



scene_object.update(configuration)
meshes = scene_object.draw()
# ---------- end robotmodelsceneobjectupdate ----------
